# Grasshopper definition Yellow_Deform.gh (Grasshopper 1.0.5)
# plug-ins: Yellow

# You can make effect in all cordinates (XYZ)
xyz = Slider(7, range=0..100)
# YELLOW
# YELLOW VER 1.0
# 
# * This is the release 1.018 from Yellow plugin: A set of tools for dealing with meshes in Grasshopper.
# 
# * Press Ctrl+M to show mesh edges.
# 
# * use Draw Icons mode to correct the text alignment.
# Just play with sliders !
mesh = Mesh(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)
# Set to negative for reverse effect
mesh_2 = Mesh(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)
mesh_3 = Mesh(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)
# Set to any kind of mesh
mesh_4 = Mesh(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)
neg = Negative(Value=Slider(33, range=0..100))
# 1.018
# by Amir Habibi
flatten = Flatten(Mesh=mesh, X=Slider(11, range=0..100), Y=0, Z=0)
taper = Taper(Mesh=mesh_2, X=0, Y=0, Z=neg)
# Set to negative for RHINO 5
inflate = Inflate(Mesh=mesh_3, X=xyz, Y=xyz, Z=xyz)
perspective = Perspective(Mesh=mesh_4, X=0, Y=Slider(2, range=0..100), Z=0)
number_slider = Slider(4, range=0..100)
mesh_5 = Mesh(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)
mesh_6 = Mesh(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)
# Deform
# You can set optional axis for Gravity
mesh_7 = Mesh(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)
mesh_8 = Mesh(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)
gcoaxis = GeometryCordinateAxis(Geometry=mesh_7)  # -> XAxis, YAxis, ZAxis
neg_2 = Negative(Value=Slider(0.789, range=0..2))
# Set to negative for RHINO 5
inflateb = InflateBalloon(Mesh=mesh_5, X=number_slider, Y=number_slider, Z=number_slider)
sbend = SmoothBend(Mesh=mesh_6, X=0, Y=0, Z=neg_2)
rskew = ReverseSkew(Mesh=mesh_8, X=0, Y=0, Z=Slider(0.59, range=0..1))
gravity = Gravity(Mesh=mesh_7, Value=Slider(0.064, range=0..4), Axis=gcoaxis.ZAxis)
number_slider_2 = Slider(0.859, range=0..2)
mesh_9 = Mesh(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)
mesh_10 = Mesh(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)
mesh_11 = Mesh(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)
mesh_12 = Mesh(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)
rpopingeo = RandomPopulateInGeometry(Geometry=mesh_9, Mass=Slider(33, range=0..100), Seed=1)
neg_3 = Negative(Value=Slider(50, range=0..100))
item = ListItem(List=rpopingeo, Index=0, Wrap=True)
chaghalize = Chaghalize(Mesh=mesh_9, Value=Slider(9, range=0..100), Center=item)
squeeze = Squeeze(Mesh=mesh_11, X=neg_3, Y=neg_3, Z=0)
skew = Skew(Mesh=mesh_12, X=0, Y=0, Z=Slider(0.59, range=0..1))
noise = Noise(Mesh=mesh_10, X=number_slider_2, Y=number_slider_2, Z=number_slider_2)
mesh_13 = Mesh(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)
mesh_14 = Mesh(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)
# You can set optional axis for Twist
mesh_15 = Mesh(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)
mesh_16 = Mesh(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)
gcoaxis_2 = GeometryCordinateAxis(Geometry=mesh_15)  # -> XAxis, YAxis, ZAxis
neg_4 = Negative(Value=Slider(32, range=0..100))
neg_5 = Negative(Value=Slider(0.4971, range=0..1))
sskew = SmoothSkew(Mesh=mesh_14, X=0, Y=0, Z=Slider(7, range=0..10))
bend = Bend(Mesh=mesh_16, X=neg_5, Y=0, Z=neg_5)
ssskew = SingleSideSkew(Mesh=mesh_13, X=0, Y=neg_4, Z=0)
twist = Twist(Mesh=mesh_15, Value=Slider(3, range=0..3), Axis=gcoaxis_2.ZAxis)
