# Grasshopper definition Yellow_Refine.gh (Grasshopper 1.0.5)
# plug-ins: Yellow

# Set large numbers
number_slider = Slider(88, range=0..1000)
crv = Curve(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)
# YELLOW
# YELLOW VER 1.0
# 
# * This is the release 1.018 from Yellow plugin: A set of tools for dealing with meshes in Grasshopper.
# 
# * Press Ctrl+M to show mesh edges.
# 
# * use Draw Icons mode to correct the text alignment.
# Enable preview for each component
# Currently not for non-manifold meshes
mbox = MeshBox(Base={Plane=PlaneXY(0, 0, 0), X=Domain(-10, 10), Y=Domain(-10, 10), Z=Domain(-10, 10)}, XCount=10, YCount=10, ZCount=10)
# Threshold : Don't subdivide the
# faces less than this area
number_slider_2 = Slider(3.3, range=0..10)
# Mesh patch Ccomponent from Yellow<Utilities
panel = Panel("12")
# Warning :
# Don't go
# far !
number_slider_3 = Slider(2, range=1..4)
mpatch = MeshPatch(Curve=crv, Tolerance=panel)
# 1.018
# Refine
# by Amir Habibi
# Butterfly Subdivision Based on
# scheme by  Dyn, Levin and Gregory
bfsub = ButterflySubdivide(Mesh=mbox, Steps=number_slider_3)
# Catmull-Clark Subdivision Based
# on scheme by Ed Catmull , Jim Clark
ccsubd = CatmullClarkSubdivide(Mesh=mbox, Steps=Slider(2, range=0..10))
# Kobbelt Subdivision Based on
# scheme by Leif P. Kobbelt
ksubd = KobbeltSubdivde(Mesh=mbox, Steps=Slider(2, range=0..10))
# Loop Subdivision Based on scheme
# by Charles Loop
lsubd = LoopSubdivide(Mesh=mbox, Steps=Slider(2, range=0..10))
# Laplacian Smoothing
smooth = Smooth(Mesh=mbox, Strength=number_slider)
# Constant Subdivision (without
# changing the mesh size)
csubd = ConstantSubdivide(Mesh=mpatch, Steps=Slider(2, range=1..4), Threshold=number_slider_2)
