# Grasshopper definition Yellow_Samples.gh (Grasshopper 1.0.5)
# plug-ins: Yellow

xyz = Slider(0.722, range=0..5)
mesh = Mesh(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)

# ---- group: سلطانعلی
# YELLOW
# YELLOW VER 1.0
# 
# * This is the release 1.018 from Yellow plugin: A set of tools for dealing with meshes in Grasshopper.
# 
# * Press Ctrl+M to show mesh edges.
# 
# * use Draw Icons mode to correct the text alignment.
mesh_2 = Mesh(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)

# ----
number_slider = Slider(1, range=0..100)
number_slider_2 = Slider(1.65, range=0..4)
volume = Volume(Geometry=mesh)  # -> Volume, Centroid
gcoaxis = GeometryCordinateAxis(Geometry=mesh)  # -> XAxis, YAxis, ZAxis
# 1.018
# Deform
# by Amir Habibi
# Turn Preview for Each Component On
flatten = Flatten(Mesh=mesh_2, X=0, Y=Slider(3.236, range=0..5), Z=0)
taper = Taper(Mesh=mesh_2, X=0, Y=0, Z=Slider(100, range=0..100))
# Set to negative for RHINO 5
inflate = Inflate(Mesh=mesh_2, X=xyz, Y=xyz, Z=xyz)
perspective = Perspective(Mesh=mesh_2, X=Slider(12, range=0..100), Y=0, Z=0)
chaghalize = Chaghalize(Mesh=mesh, Value=Slider(12, range=0..100), Center=volume.Centroid)
noise = Noise(Mesh=mesh, X=number_slider, Y=number_slider, Z=0)
perspective_2 = Perspective(Mesh=mesh, X=0, Y=0, Z=Slider(15, range=0..100))
sskew = SmoothSkew(Mesh=mesh, X=Slider(4, range=0..100), Y=0, Z=0)
sbend = SmoothBend(Mesh=mesh, X=number_slider_2, Y=0, Z=number_slider_2)
twist = Twist(Mesh=mesh, Value=Slider(4, range=0..4), Axis=gcoaxis.YAxis)
number_slider_3 = Slider(1, range=0..100)
gcoaxis_2 = GeometryCordinateAxis(Geometry=mesh_2)  # -> XAxis, YAxis, ZAxis
neg = Negative(Value=Slider(0.967, range=0..2))
# Set to negative for RHINO 5
inflateb = InflateBalloon(Mesh=mesh_2, X=number_slider_3, Y=number_slider_3, Z=number_slider_3)
sbend_2 = SmoothBend(Mesh=mesh_2, X=neg, Y=0, Z=0)
rskew = ReverseSkew(Mesh=mesh_2, X=0, Y=Slider(1, range=0..1), Z=0)
gravity = Gravity(Mesh=mesh_2, Value=Slider(0.118, range=0..4), Axis=gcoaxis_2.YAxis)
number_slider_4 = Slider(0.254, range=0..2)
rpopingeo = RandomPopulateInGeometry(Geometry=mesh_2, Mass=Slider(104, range=0..1000), Seed=Slider(1, range=0..10))
neg_2 = Negative(Value=Slider(50, range=0..100))
item = ListItem(List=rpopingeo, Index=0, Wrap=True)
squeeze = Squeeze(Mesh=mesh_2, X=neg_2, Y=neg_2, Z=0)
skew = Skew(Mesh=mesh_2, X=0, Y=Slider(0.688, range=0..1), Z=0)
noise_2 = Noise(Mesh=mesh_2, X=number_slider_4, Y=number_slider_4, Z=number_slider_4)
chaghalize_2 = Chaghalize(Mesh=mesh_2, Value=Slider(20, range=0..100), Center=item)
gcoaxis_3 = GeometryCordinateAxis(Geometry=mesh_2)  # -> XAxis, YAxis, ZAxis
neg_3 = Negative(Value=Slider(37, range=0..100))
neg_4 = Negative(Value=Slider(59, range=0..100))
neg_5 = Negative(Value=Slider(0.6836, range=0..1))
sskew_2 = SmoothSkew(Mesh=mesh_2, X=0, Y=0, Z=neg_4)
bend = Bend(Mesh=mesh_2, X=neg_5, Y=0, Z=0)
ssskew = SingleSideSkew(Mesh=mesh_2, X=neg_3, Y=neg_3, Z=0)
twist_2 = Twist(Mesh=mesh_2, Value=Slider(4.158, range=0..12), Axis=gcoaxis_3.ZAxis)
