# Grasshopper definition Yellow_Utiities.gh (Grasshopper 1.0.5)
# plug-ins: Yellow

count = Slider(13, range=0..100)
count_2 = Slider(619, range=0..1000)
# Tolerance input defines the mesh subdivision
number_slider = Slider(12, range=0..100)
# Define the Direction with Text
panel = Panel("Z")
# YELLOW
# YELLOW VER 1.0
# 
# * This is the release 1.018 from Yellow plugin: A set of tools for dealing with meshes in Grasshopper.
# 
# * Press Ctrl+M to show mesh edges.
# 
# * use Draw Icons mode to correct the text alignment.
# Enable preview for each Yellow component
brep = Brep(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)
brep_2 = Brep(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)
mesh = Mesh(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)
crv = Curve(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)
msphere = MeshSphere(Base=PlaneXY(0, 0, 0), Radius=10, UCount=10, VCount=20)
mbox = MeshBox(Base={Plane=PlaneXY(0, 0, 0), X=Domain(-10, 10), Y=Domain(-10, 10), Z=Domain(-10, 10)}, XCount=10, YCount=10, ZCount=10)
msphere_2 = MeshSphere(Base=PlaneXY(0, 0, 0), Radius=10, UCount=10, VCount=20)
crv_2 = Curve(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)
Z = UnitZ(Factor=1)
cyl = Cylinder(Base=PlaneXY(0, 0, 0), Radius="12", Length="36")
crv_3 = Curve([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])
ex2smheight = Extrude2SameHeight(Bases=crv_3, Direction=panel, Distance=Slider(12, range=0..100))
# Count input is the count of mass not
# the number of output points
rpopingeo = RandomPopulateInGeometry(Geometry=brep_2, Count=count_2, Seed=1)
# ONLY FOR RHINO 6
mfill = MeshFillHoles(Mesh=mesh)
# 1.018
# Utilities
# by Amir Habibi
# You can set any kind of geometry
# Be carefull with input numbers !
cpopingeo = CordiantePopulateInGeometry(Geometry=brep, XCount=count, YCount=count, ZCount=count)
# ONLY FOR RHINO 6
mpatch = MeshPatch(Curve=crv, Tolerance=number_slider)
# Mesh vertex normals
mvertnorm = MeshVertexNormal(Mesh=msphere)
demesh = DeconstructMesh(Mesh=msphere)  # -> Vertices, Faces, Colours, Normals
p2mesh = Project2Mesh(Mesh=msphere_2, Curve=crv_2, Direction=Z, Tolerance=Slider(0.0005, range=0..0.01))
mvnorms = MeshVertexNeighbours(Mesh=mbox, Index=Slider(99, range=0..100), Ring=Slider(4, range=0..10))  # -> Points, Center
gcoaxis = GeometryCordinateAxis(Geometry=cyl)  # -> XAxis, YAxis, ZAxis
vdis = VectorDisplay(Anchor=demesh.Vertices, Vector=mvertnorm)
