# Grasshopper definition Yellow_Voxel.gh (Grasshopper 1.0.5)
# plug-ins: Yellow

mesh = Mesh([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])
mesh_2 = Mesh(flatten([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]))
count = Slider(6, range=0..10)
# YELLOW
# YELLOW VER 1.0
# 
# * This is the release 1.018 from Yellow plugin: A set of tools for dealing with meshes in Grasshopper.
# 
# * Press Ctrl+M to show mesh edges.
# 
# * use Draw Icons mode to correct the text alignment.
# Enable preview for each Yellow component
mesh_3 = Mesh([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])
pop3d = Populate3D(
    Region={Plane=Plane(origin=(0, 0, 0), x=(0, 1, 0), y=(1, 0, 0)), X=Domain(0, 20), Y=Domain(0, 20), Z=Domain(-20, 0)},
    Count=2000,
    Seed=1)
mesh_4 = Mesh(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)
mesh_5 = Mesh([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])
point = Point([Point(-24.41315285, -6.642694086, 0), Point(26.55059455, -16.79374123, 0), Point(-25.83485404, -26.16133457, 0), Point(3.5047394, 2.041048121, 0), Point(-16.45364364, -6.876122986, 0), Point(-10.86285454, -15.49749145, 0)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])
pdecon = Deconstruct(Point=pop3d)  # -> XComponent, YComponent, ZComponent
# Construct Single Voxel
construct_single_voxel = ConstructSingleVoxel(Point=point, Size=Slider(2, range=0..10))
# Find Neighbours
voxnbrs = VoxelNeighbours(Voxels=mesh, Voxel="35")  # -> Right, Left, Up, Down, Top, Bottom
# Merge Voxels
merge_voxel = MergeVoxel(Voxels=mesh_5)
# Sort Voxels
svoxels = SortVoxels(Voxels=mesh_2)
# Voxelize Geometry
voxgeom = VoxelizeGeometry(Geometry=mesh_4, Size=Slider(1.5, range=0..10))
# 1.018
# Voxel
# by Amir Habibi
# Extend Voxels
extend_voxel = ExtendVoxel(Voxel=mesh_3, Direction="-X", ExtensionCount=count)
graph = GraphMapper(pdecon.ZComponent, x0=0, x1=20, y0=0, y1=20, Ox=0, Oy=0, Px=1, Py=1, container_name="Parabola")
# Extend Voxels to Same Height
extend_voxels_2_same_height = ExtendVoxels2SameHeight(Voxels=construct_single_voxel, Direction="Z", Distance=0)  # -> flatten(Voxels)
panel = Panel(mesh_2)
panel_2 = Panel(svoxels)
item = ListItem(List=mesh, Index=[voxnbrs.Up, voxnbrs.Top, voxnbrs.Right], Wrap=True)
pt = ConstructPoint(XCoordinate=pdecon.XComponent, YCoordinate=pdecon.YComponent, ZCoordinate=graph)
line = Line(Line((-3, -4, 0), (23, 22, 23)))
# Gridize Voxels
gridize_voxels = GridizeVoxels(Voxels=extend_voxels_2_same_height)
crv_cp = CurveClosestPoint(Point=pt, Curve=line)  # -> Point, Parameter, Distance
larger = LargerThan(FirstNumber=crv_cp.Distance, SecondNumber=5)  # -> LargerThan, OrEqualTo
cull = CullPattern(List=pt, CullPattern=larger.LargerThan)
# Voxel From Points
voxel_from_points = VoxelFromPoints(Point=cull, Size=Slider(1.2, range=0.2..10))
