# Grasshopper definition wirePrint.gh (Grasshopper 1.0.7)
# plug-ins: MarchingCubes, Pufferfish

cluster = Cluster_3()  # -> G, R
cluster_2 = Cluster_2()  # -> _0_0_0, _0_0_1, R

crv = Curve([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])
crv_2 = Curve([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])
crv_3 = Curve([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])

crv_4 = Curve([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])
crv_5 = Curve([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])
crv_6 = Curve([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])

cluster_3 = Cluster_4()  # -> R_2, R

crv_7 = Curve([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])
crv_8 = Curve([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])
crv_9 = Curve([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])

crv_10 = Curve(cluster_3.R_2)
crv_11 = Curve(cluster_3.R)
crv_12 = Curve(cluster_2._0_0_1)
crv_13 = Curve(cluster_2.R)
crv_14 = Curve(cluster.R)
crv_15 = Curve(cluster_2._0_0_0)
crv_16 = Curve(cluster.G)

# ---- group: 初期の格子の分割数
x軸の分割数 = Slider(3, range=0..10)
y軸の分割数 = Slider(6, range=0..10)
z軸の分割数 = Slider(20, range=0..100)

# ---- group: 外形のCurve
crv_17 = Curve(crv_7)
crv_18 = Curve(crv_8)
crv_19 = Curve(crv_9)

# ----
cluster_4 = Cluster_5(int=x軸の分割数, int_2=y軸の分割数, int_3=z軸の分割数, C_3=crv_19, C_2=crv_17, C=crv_18)  # -> R, int_7, pl, R_2

crv_20 = Curve(flatten(cluster_4.pl))
crv_21 = Curve(cluster_4.R_2)

num = Number(cluster_4.int_7)
num_2 = Number(cluster_4.R)

cluster_5 = Cluster(x=crv_21, y=crv_20, num_2=num_2, num=num)  # -> T_2, T
crv_22 = Curve(simplify(cluster_5.T_2))
crv_23 = Curve(simplify(cluster_5.T))

# ---- group: ミニマムの格子の対角線の角度
number_slider = Slider(17, range=1..30)

# ----
panel = Panel("""[0]n_u
[1]n_v
[2]n+1_u
[3]n+1_v""")
pairing = GhPythonScript(crvU=crv_22, crvV=crv_23)  # -> out, simplify(a); inputs crvU: tree, crvV: tree
# ---------- pairing: Python ----------
__author__ = "m0rya"

import rhinoscriptsyntax as rs
import ghpythonlib.treehelpers as th

result = []


for i in range(crvU.BranchCount-1):
    
    '''
    [0] n_u
    [1] n_v
    [2] n+1_u
    [3] n+1_v
    '''
    tmp = [[] for j in range(4)]
    
    tmp[0] = crvU.Branch(i)
    tmp[1] = crvV.Branch(i)
    tmp[2] = crvU.Branch(i+1)
    tmp[3] = crvV.Branch(i+1)
    
    
    result.append(tmp)
    
a = th.list_to_tree(result, source=[0,0])
# ---------- end pairing ----------

# ---- group: 最適な格子になるように分割
subdivision_ver2 = GhPythonScript(crvUV=pairing.a, threshold=number_slider)  # -> out, a, debug; inputs crvUV: tree
# ---------- subdivision_ver2: Python ----------
__author__ = "m0rya"

import rhinoscriptsyntax as rs
import ghpythonlib.treehelpers as th

result = []
debug = []

tgl = True


while tgl:
    
    tgl = False
    
    past_result = list(result)
    result = []
    
    for i in range(int(crvUV.BranchCount/4)):
        
        if len(past_result) == 0:
            n_u = crvUV.Branch(4*i)
            n_v = crvUV.Branch(4*i+1)
            n1_u = crvUV.Branch(4*i+2)
            n1_v = crvUV.Branch(4*i+3)
        else:
            
            n_u = past_result[i][0]
            n_v = past_result[i][1]
            n1_u = past_result[i][2]
            n1_v = past_result[i][3]
            
    
        editP_n_u = [rs.CurveEditPoints(crv) for crv in n_u]
        editP_n_v = [rs.CurveEditPoints(crv) for crv in n_v]
        editP_n1_u = [rs.CurveEditPoints(crv) for crv in n1_u]
        editP_n1_v = [rs.CurveEditPoints(crv) for crv in n1_v]
        
    
        #Adjusting for CrvV
        new_n_u = [n_u[0]]
        new_n1_u = [n1_u[0]]
    
    
        tmpVpnts = [[p[0]] for p in editP_n_v]
        tmpVpnts2 = [[p[0]] for p in editP_n1_v]
    
    
        for j in range(len(n_u)-1):
        
            tmpUpnts = []
            tmpUpnts2 = []
                
        
            for k in range(len(n_v)-1):
            
                #check angle
                pnt1 = editP_n_v[k][j]
                
                pnt2 = editP_n1_v[k][j+1]
                pnt3 = editP_n_v[k][j+1]
            
                vec1 = rs.VectorCreate(pnt2, pnt1)
                vec2 = rs.VectorCreate(pnt3, pnt1)
            
                angle = rs.VectorAngle(vec1, vec2)
        
            
                #create points for new crv
                if angle < threshold:
                    
                    if not tgl:
                        print(angle)
                    
                    tgl = True
                
                    if len(tmpUpnts) == 0:
                        tmpUpnts.append((pnt1+pnt3)/2)
                        tmpUpnts2.append((editP_n1_v[k][j]+editP_n1_v[k][j+1])/2)
                    
                    tmpUpnts.append((editP_n_v[k+1][j] + editP_n_v[k+1][j+1])/2)
                    tmpUpnts2.append((editP_n1_v[k+1][j] + editP_n1_v[k+1][j+1])/2)
                
                
                    tmpVpnts[k].append((editP_n_v[k][j] + editP_n_v[k][j+1])/2)
                    tmpVpnts2[k].append((editP_n1_v[k][j] + editP_n1_v[k][j+1])/2)
                    
                    if k == len(n_v)-2:
                        tmpVpnts[k+1].append((editP_n_v[k+1][j] + editP_n_v[k+1][j+1])/2)
                        tmpVpnts2[k+1].append((editP_n1_v[k+1][j] + editP_n1_v[k+1][j+1])/2)
                    
                
                
            
                tmpVpnts[k].append(editP_n_v[k][j+1])
                tmpVpnts2[k].append(editP_n1_v[k][j+1])
            
                if k == len(n_v)-2:
                
                    tmpVpnts[k+1].append(editP_n_v[k+1][j+1])
                    tmpVpnts2[k+1].append(editP_n1_v[k+1][j+1])
            

            if len(tmpUpnts) != 0:
                
                newUcrv = rs.AddPolyline(tmpUpnts)
                newUcrv2 = rs.AddPolyline(tmpUpnts2)
            
                new_n_u.append(newUcrv)
                new_n1_u.append(newUcrv2)
            
            new_n_u.append(n_u[j+1])
            new_n1_u.append(n1_u[j+1])
        
        
        #build v crvs    
        new_n_v = [rs.AddPolyline(ps) for ps in tmpVpnts]
        new_n1_v = [rs.AddPolyline(ps) for ps in tmpVpnts2]
    
        result.append([new_n_u, new_n_v, new_n1_u, new_n1_v])
    tgl = False
        
            
    
      
a = th.list_to_tree(result, source=[0,0])
                
debug = th.list_to_tree(debug, source=[0])
# ---------- end subdivision_ver2 ----------

# ----
number_slider_2 = Slider(0.4, range=0..1)
crv_24 = Curve(simplify(subdivision_ver2.a))

# ---- group: 通常のワイヤー化
wiring_ver5 = GhPythonScript(crvUV=crv_24, lh=number_slider_2)  # -> out, a, debug; inputs crvUV: tree
# ---------- wiring_ver5: Python ----------
__author__ = "m0rya"

import rhinoscriptsyntax as rs
import ghpythonlib.treehelpers as th

result = []
debug = []

'''
crv_n_u
crv_n_v
crv_n1_u
crv_n1_v
'''

def alt_reverse(crv):
    for itr,c in enumerate(crv):
            if itr%2 == 0:
                continue
            else:
                rs.ReverseCurve(c)

for i in range(int(crvUV.BranchCount/4)):
    
    
    crv_n_u = crvUV.Branch(4*i)
    crv_n_v = crvUV.Branch(4*i+1)
    crv_n1_u = crvUV.Branch(4*i+2)
    crv_n1_v = crvUV.Branch(4*i+3)
    
    #first layer
    
    if i == 0:
        
        first_layer = []
        
        #shell
        shell = []
        shell.append(crv_n_u[0])
        shell.append(crv_n_u[len(crv_n_u)-1])
        shell.append(crv_n_v[0])
        shell.append(crv_n_v[len(crv_n_v)-1])
        
        shell = rs.JoinCurves(shell)
        
        #infill
        infill1 = rs.CopyObjects(crv_n_u[1:len(crv_n_u)-1])
        alt_reverse(infill1)
        
        infill2 = rs.CopyObjects(crv_n_v[1:len(crv_n_v)-1])
        alt_reverse(infill2)
        
        first_layer.extend(shell)
        first_layer.extend(infill1)
        first_layer.extend(infill2)
        
        result.append(first_layer)
        
    
 
        
    layer_path = []
        
        
    #prepare for zigzag
    zigzag = rs.CopyObjects(crv_n_u)
    zigzag2 = rs.CopyObjects(crv_n1_u)
        
    zigzag1a, zigzag1b, zigzag2a, zigzag2b = [], [], [], []
    for j in range(len(zigzag)):
            
        if j%2 == 0:
            zigzag1a.append(zigzag[j])
            zigzag2a.append(zigzag2[j])
        else:
            zigzag1b.append(zigzag[j])
            zigzag2b.append(zigzag2[j])
                
        
    #first zigzag
    zigzagResult = []
    for j in range(len(zigzag1a)):
            
        editPnts = rs.CurveEditPoints(zigzag1a[j])
        editPnts2 = rs.CurveEditPoints(zigzag2a[j])
            
        #ここでeditPnts2をeditPnts側に2*lhだけよせる
        for k in range(len(editPnts)):
            tmpVec = rs.VectorCreate(editPnts2[k], editPnts[k])
            tmpVec = rs.VectorScale(tmpVec, (rs.VectorLength(tmpVec)-2*lh)/rs.VectorLength(tmpVec))
            editPnts2[k] = rs.VectorAdd(editPnts[k],tmpVec)
            
            
        tmp = []
        for k in range(len(editPnts)-1):
                
            tmp.append(rs.AddLine(editPnts[k], editPnts2[k]))
            tmp.append(rs.AddLine(editPnts2[k], editPnts[k+1]))
                

                
        else:
            tmp.append(rs.AddLine(editPnts[k+1], editPnts2[k+1]))
                
            for l in range(len(editPnts)-1):
                tmp.append(rs.AddLine(editPnts2[len(editPnts)-1-l], editPnts2[len(editPnts)-1-l-1]))
                
        zigzagResult.extend(tmp)
            
    layer_path.extend(zigzagResult)
        
        
    #vvv line
    vvv = rs.CopyObjects(crv_n_v)
    vvv2 = rs.CopyObjects(crv_n1_v)
        
        
    for j in range(len(vvv)):
            
        editPnts = rs.CurveEditPoints(vvv[j])
        editPnts2 = rs.CurveEditPoints(vvv2[j])
        #ここでeditPnts2をeditPntsの向きに1*lhだけよせる
            
        for k in range(len(editPnts)):
            tmpVec = rs.VectorCreate(editPnts2[k], editPnts[k])
            tmpVec = rs.VectorScale(tmpVec, (rs.VectorLength(tmpVec)-lh)/rs.VectorLength(tmpVec))
            editPnts2[k] = rs.VectorAdd(editPnts[k],tmpVec)
            
            
        tmp = []
        for k in range(len(editPnts)-1):
            if k%2 == 0:
                tmp.append(rs.AddLine(editPnts2[k], editPnts[k+1]))
            else:
                tmp.append(rs.AddLine(editPnts[k], editPnts2[k+1]))
                    
        #debug.append(tmp)
        layer_path.extend(tmp)
        
    #second zigzag
    zigzagResult2 = []
    for j in range(len(zigzag1b)):
            
        editPnts = rs.CurveEditPoints(zigzag1b[j])
        editPnts2 = rs.CurveEditPoints(zigzag2b[j])
        #ここでeditPnts2をeditPntsの向きに1*lhだけよせる
        for k in range(len(editPnts)):
            tmpVec = rs.VectorCreate(editPnts2[k], editPnts[k])
            tmpVec = rs.VectorScale(tmpVec, (rs.VectorLength(tmpVec)-lh)/rs.VectorLength(tmpVec))
            editPnts2[k] = rs.VectorAdd(editPnts[k],tmpVec)
            
        tmp = []
        for k in range(len(editPnts)-1):
                
            tmp.append(rs.AddLine(editPnts[k], editPnts2[k]))
            tmp.append(rs.AddLine(editPnts2[k], editPnts[k+1]))
        else:
            tmp.append(rs.AddLine(editPnts[k+1], editPnts2[k+1]))
                
            for l in range(len(editPnts)-1):
                tmp.append(rs.AddLine(editPnts2[len(editPnts)-1-l], editPnts2[len(editPnts)-1-l-1]))
                
        zigzagResult2.extend(tmp)
            
    layer_path.extend(zigzagResult2)
        
        
    #flat vertical line
    flatV = list(crv_n1_v)
    alt_reverse(flatV)
    exploded = rs.ExplodeCurves(flatV)
        
    layer_path.extend(exploded)
        
        
    result.append(layer_path)
        



debug = th.list_to_tree(debug, source=[0])

a = th.list_to_tree(result, source=[0])
# ---------- end wiring_ver5 ----------

# ---- group: 一筆書きのワイヤー化
wiring6_onepath = GhPythonScript(crvUV=crv_24, lh=number_slider_2)  # -> out, a, debug; inputs crvUV: tree
# ---------- wiring6_onepath: Python ----------
__author__ = "m0rya"

import rhinoscriptsyntax as rs
import ghpythonlib.treehelpers as th

result = []
debug = []

'''
crv_n_u
crv_n_v
crv_n1_u
crv_n1_v
'''

def alt_reverse(crv):
    for itr,c in enumerate(crv):
            if itr%2 == 0:
                continue
            else:
                rs.ReverseCurve(c)
                
def bridge(crv1, crv2):
    
    end = rs.CurveEndPoint(crv1)
    
    endPnts = [rs.CurveStartPoint(crv2), rs.CurveEndPoint(crv2)]
    dists = [rs.Distance(end, p) for p in endPnts]
    
    
    if dists[0] < dists[1]:
        start = endPnts[0]
    else:
        start = endPnts[1]
        
    bridgeLine = rs.AddLine(end, start)
    dir = rs.VectorCreate(start, end)
    dir = rs.VectorRotate(dir, 90, (0,0,1))
    
    return rs.OffsetCurve(bridgeLine, dir, 1.0)
    
def bridge2(crv1, crv2):
    
    end = rs.CurveEndPoint(crv1)
    
    endPnts = [rs.CurveStartPoint(crv2), rs.CurveEndPoint(crv2)]
    dists = [rs.Distance(end, p) for p in endPnts]
    
    
    if dists[0] < dists[1]:
        tgl = True
    else:
        tgl = False
    
    start = endPnts[0]
    bridgeLine = rs.AddLine(end, start)
    dir = rs.VectorCreate(start, end)
    dir = rs.VectorRotate(dir, 90, (0,0,1))
    
    if tgl:
        return rs.OffsetCurve(bridgeLine, dir, 1.0)
    else:
        return bridgeLine
    

for i in range(int(crvUV.BranchCount/4)):
    
    
    crv_n_u = crvUV.Branch(4*i)
    
    crv_n_v = crvUV.Branch(4*i+1)
    crv_n1_u = crvUV.Branch(4*i+2)
    crv_n1_v = crvUV.Branch(4*i+3)
    
    #first layer
    
    if i == 0:
        
        first_layer = []
        
        #shell
        shell = []
        shell.append(crv_n_u[0])
        shell.append(crv_n_u[len(crv_n_u)-1])
        shell.append(crv_n_v[0])
        shell.append(crv_n_v[len(crv_n_v)-1])
        
        shell = rs.JoinCurves(shell)
        
        #infill
        infill1 = rs.CopyObjects(crv_n_u[1:len(crv_n_u)-1])
        alt_reverse(infill1)
        
        #BRIDGE : shell to infill1
        bridge1 = bridge2(shell,infill1[0])
       
        
        
        #BRIDGE : within infill1 
        #latter
        
        #BRIDGE : infill1 to infill2
        
        #BRIDGE : within infill2
        
        infill2 = rs.CopyObjects(crv_n_v[1:len(crv_n_v)-1])
        alt_reverse(infill2)
        
        first_layer.extend(shell)
        first_layer.append(bridge1)
        first_layer.extend(infill1)
        first_layer.extend(infill2)
        
        #first_layer.extend(bridge(first_layer[-1], first_layer[0]))
        
        result.append(first_layer)
        
    
 
        
    layer_path = []
        
        
    #prepare for zigzag
    zigzag = rs.CopyObjects(crv_n_u)
    zigzag2 = rs.CopyObjects(crv_n1_u)
        
    zigzag1a = zigzag
    zigzag2a = zigzag2

    '''
    zigzag1a, zigzag1b, zigzag2a, zigzag2b = [], [], [], []
    for j in range(len(zigzag)):
            
        if j%2 == 0:
            zigzag1a.append(zigzag[j])
            zigzag2a.append(zigzag2[j])
        else:
            zigzag1b.append(zigzag[j])
            zigzag2b.append(zigzag2[j])
    '''
    #first zigzag
    zigzagResult = []
    
    if i%2 == 1:
        zigzag1a.reverse()
        zigzag2a.reverse()
        
    for j in range(len(zigzag1a)):
        
        editPnts = rs.CurveEditPoints(zigzag1a[j])
        editPnts2 = rs.CurveEditPoints(zigzag2a[j])
        
        if i == 0 and j == 0:
          
            
            zigzagResult.append(rs.AddLine(rs.CurveEndPoint(infill1[0]), editPnts[0]))
            
        #ここでeditPnts2をeditPnts側に2*lhだけよせる
        for k in range(len(editPnts)):
            tmpVec = rs.VectorCreate(editPnts2[k], editPnts[k])
            tmpVec = rs.VectorScale(tmpVec, (rs.VectorLength(tmpVec)-2*lh)/rs.VectorLength(tmpVec))
            editPnts2[k] = rs.VectorAdd(editPnts[k],tmpVec)
            
            
        tmp = []
        for k in range(len(editPnts)-1):
                
            tmp.append(rs.AddLine(editPnts[k], editPnts2[k]))
            tmp.append(rs.AddLine(editPnts2[k], editPnts[k+1]))
                

                
        else:
            tmp.append(rs.AddLine(editPnts[k+1], editPnts2[k+1]))
                
            for l in range(len(editPnts)-1):
                tmp.append(rs.AddLine(editPnts2[len(editPnts)-1-l], editPnts2[len(editPnts)-1-l-1]))
                
            
            
            
            if j is not len(zigzag1a)-1:
                #debug.append(editPnts[0])
               
                bridgeLine = rs.AddLine(rs.CurveStartPoint(zigzag2a[j]), rs.CurveStartPoint(zigzag1a[j+1]))
                tmp.append(bridgeLine)
                #debug.append(bridgeLine)
                
        zigzagResult.extend(tmp)
    
    layer_path.extend(zigzagResult)
        
        
    '''
    #vvv line
    vvv = rs.CopyObjects(crv_n_v)
    vvv2 = rs.CopyObjects(crv_n1_v)
        
        
    for j in range(len(vvv)):
            
        editPnts = rs.CurveEditPoints(vvv[j])
        editPnts2 = rs.CurveEditPoints(vvv2[j])
        #ここでeditPnts2をeditPntsの向きに1*lhだけよせる
            
        for k in range(len(editPnts)):
            tmpVec = rs.VectorCreate(editPnts2[k], editPnts[k])
            tmpVec = rs.VectorScale(tmpVec, (rs.VectorLength(tmpVec)-lh)/rs.VectorLength(tmpVec))
            editPnts2[k] = rs.VectorAdd(editPnts[k],tmpVec)
            
            
        tmp = []
        for k in range(len(editPnts)-1):
            if k%2 == 0:
                tmp.append(rs.AddLine(editPnts2[k], editPnts[k+1]))
            else:
                tmp.append(rs.AddLine(editPnts[k], editPnts2[k+1]))
                    
        #debug.append(tmp)
        layer_path.extend(tmp)
    '''
    
    '''
    #second zigzag
    zigzagResult2 = []
    for j in range(len(zigzag1b)):
            
        editPnts = rs.CurveEditPoints(zigzag1b[j])
        editPnts2 = rs.CurveEditPoints(zigzag2b[j])
        #ここでeditPnts2をeditPntsの向きに1*lhだけよせる
        for k in range(len(editPnts)):
            tmpVec = rs.VectorCreate(editPnts2[k], editPnts[k])
            tmpVec = rs.VectorScale(tmpVec, (rs.VectorLength(tmpVec)-lh)/rs.VectorLength(tmpVec))
            editPnts2[k] = rs.VectorAdd(editPnts[k],tmpVec)
            
        tmp = []
        for k in range(len(editPnts)-1):
                
            tmp.append(rs.AddLine(editPnts[k], editPnts2[k]))
            tmp.append(rs.AddLine(editPnts2[k], editPnts[k+1]))
        else:
            tmp.append(rs.AddLine(editPnts[k+1], editPnts2[k+1]))
                
            for l in range(len(editPnts)-1):
                tmp.append(rs.AddLine(editPnts2[len(editPnts)-1-l], editPnts2[len(editPnts)-1-l-1]))
                
        zigzagResult2.extend(tmp)
            
    layer_path.extend(zigzagResult2)
    '''
        
    #flat vertical line
    
    if i%2 == 0:
        flatV = list(crv_n1_v)
        flatV2 = []
        for c in flatV:
            tmpEditPnts = rs.CurveEditPoints(c)
            tmpEditPnts.reverse()
            flatV2.append(rs.AddPolyline(tmpEditPnts))
        
        alt_reverse(flatV2)
        debug.append(flatV2)
    
        bridge = rs.AddLine(rs.CurveEndPoint(flatV2[0]), rs.CurveStartPoint(flatV2[1]))
        bridge2 = rs.AddLine(rs.CurveEndPoint(flatV2[1]), rs.CurveStartPoint(flatV2[0]))
        flatV2.insert(1, bridge)
    
        flatV2 = rs.JoinCurves(flatV2)
        exploded = rs.ExplodeCurves(flatV2)
        
        layer_path.extend(exploded)
        layer_path.append(bridge2)
    else:
        flatV = list(crv_n1_v)
        flatV2 = []
        
        alt_reverse(flatV)
        
        bridge = rs.AddLine(rs.CurveEndPoint(flatV[0]), rs.CurveStartPoint(flatV[1]))
        bridge2 = rs.AddLine(rs.CurveEndPoint(flatV[1]), rs.CurveStartPoint(flatV[0]))
        flatV.insert(1, bridge)
    
        flatV = rs.JoinCurves(flatV)
        
        exploded = rs.ExplodeCurves(flatV)
        
        layer_path.extend(exploded)
        layer_path.append(bridge2)
        
        
        
    result.append(layer_path)
        



debug = th.list_to_tree(debug, source=[0])

a = th.list_to_tree(result, source=[0])
# ---------- end wiring6_onepath ----------

# ----
crv_25 = Curve(simplify(wiring_ver5.a))
crv_26 = Curve(simplify(wiring6_onepath.a))
crv_27 = Curve(crv_25)
scale = Scale(Geometry=crv_27, Center=Point(0, 0, 0), Factor=Slider(0.8, range=0..1))  # -> Geometry, Transform
crv_28 = Curve(scale.Geometry)
number_slider_3 = Slider(1, range=0..1)
number_slider_4 = Slider(85, range=0..10000)
number_slider_5 = Slider(1000, range=0..1000)
base_params = BassParams(
    Nozzle_Diameter=Slider(1.75, range=0..10),
    Layer_Height=Slider(1.2, range=0..10),
    Top_Solid_Layers=2,
    Bottom_Solid_Layers=2,
    Num_of_Shell=2,
    Infill_Ratio=25,
    Artifact_Shell=2,
    Temp_Nozzle=Slider(175, range=0..1000),
    Temp_Bed=Slider(0, range=0..100),
    E_multiplier=1,
    E_Speed=Slider(150, range=0..200),
    F_Speed=Slider(600, range=0..10000),
    Retract=Slider(3, range=0..10))  # -> out, params; inputs E_Speed: Int32
# ---------- base_params: Python ----------
__author__ = "m0rya"

import rhinoscriptsyntax as rs
import ghpythonlib.treehelpers as th
import Rhino

layerTree = []

layerTree.append(["nozzle diameter", Nozzle_Diameter])
layerTree.append(["layer height", Layer_Height])
layerTree.append(["top solid layers", Top_Solid_Layers])
layerTree.append(["bottom solid layers", Bottom_Solid_Layers])
layerTree.append(["num of shell", Num_of_Shell])
layerTree.append(["infill pitch", Infill_Ratio])
layerTree.append(["num of artifacts shells", Artifact_Shell])
layerTree.append(["Temp_Nozzle", Temp_Nozzle])
layerTree.append(["Temp_Bed", Temp_Bed])

layerTree.append(["E_multiplier", E_multiplier])
layerTree.append(["E_Speed", E_Speed])
layerTree.append(["F_Speed", F_Speed])
layerTree.append(["Retract", Retract])

layerTree = th.list_to_tree(layerTree, source=[0])
params = layerTree
# ---------- end base_params ----------

# ---- group: ワイヤーを.pcsに変換
crv_29 = Curve(crv_28)
brec = BoundingRectangle(Geometry=flatten(crv_29), Plane=PlaneXY(0, 0, 0), Axis=0, Slide=0, Union=True)
vec = VectorXYZ(XComponent=1500, YComponent=0, ZComponent=0)  # -> Vector, Length
area = Area(Geometry=brec)  # -> Area, Centroid
subtraction = Subtraction(A=vec.Vector, B=area.Centroid)
move = Move(Geometry=crv_29, Motion=subtraction)  # -> Geometry, Transform
rotate = Rotate(Geometry=move.Geometry, Angle=1.570796327, Plane=vec.Vector)  # -> Geometry, Transform
scale_2 = Scale(Geometry=rotate.Geometry, Center=vec.Vector, Factor=Slider(7, range=0..100))  # -> Geometry, Transform
export_for_pcs = GhPythonScript(path=scale_2.Geometry, button=Button(), params=base_params.params)  # -> out, a; inputs path: tree, params: tree
# ---------- export_for_pcs: Python ----------
__author__ = "m0rya"

import rhinoscriptsyntax as rs
import datetime


class GCoder:
    
    def __init__(self):
        print("hello")
        
        
    def calc_e(self, dist):
        
        filamentDia = 1.75
        
        resultE = self.E_multiplier * (dist * self.layerHeight * self.nozzleDiameter) / (3.14 * (filamentDia/2.0) * (filamentDia/2.0))
        return resultE
        
    def parseParams(self, params):
        self.nozzleDiameter = params.Branch(0)[1]
        self.layerHeight = params.Branch(1)[1]
        self.topSolidLayer = params.Branch(2)[1]
        self.bottomSolidLayer = params.Branch(3)[1]
        self.numOfShell = params.Branch(4)[1]
        self.pitchOfInfill = params.Branch(5)[1]
        self.numOfArtifactShell = params.Branch(6)[1]
        #self.distOfArtifact = params.Branch(7)[1]
        self.temp_bed = params.Branch(8)[1]
        self.temp_nozzle = params.Branch(7)[1]
        
        self.E_multiplier = params.Branch(9)[1]
        self.eSpeed = params.Branch(10)[1]
        self.mSpeed = params.Branch(11)[1]
        self.retractValue = params.Branch(12)[1]
        
        self.initE = "G92 E0\n"
        
        self.prePoint = [None, None]
        
        self.firstLayerRatio = 0.2
        
        self.lastPnt = (0,10,0)
        
        self.waitMillSec = 500
        self.waitForZ = 5000
        self.retractSpeed = 1500
        self.endRetract = 5
        
        self.eSpeed_slow = 85
        
        self.zUpTgl = False
        
    def initFile(self):
        
        #savePath = rs.SaveFileName("Export G-Code File", "G-Code Files (*.gcode) |*.gcode||")
        #self.f = open(savePath, 'w')
        
        savePath = rs.SaveFileName("Export .pcs File", "pcs Files (*.pcs) |*.pcs||")
        self.f = open(savePath, 'w')
        
        
        #write basic info
        #self.f.write("; This G-Code is generated by Ryoma Takamori's Tool\n")
        
        #write comment
        
        #self.f.write("; Comment\n")
        #comment = rs.StringBox()
        #self.f.write(": " + comment + "\n")
        #self.f.write(";\n")
        
        
        #write date
        #dateCode = "; date : {0}\n".format(datetime.datetime.today())
        #self.f.write(dateCode)
        
        #write init G-Code
        
        initPCode = ''
        initPCode += "Sub Main\n"
        initPCode += "\tTakeArm Keep = 0\n"
        initPCode += "\tDim pos As Position\n"
        initPCode += "\tpos = P(1500, 0, 0, 180, 0, 0)\n" #Home for Robot Arm
        initPCode += "\tMove L,pos\n"
        
        self.lastPnt = [1500, 0, 0]
        self.armAngle = [180, 0, 0]
        
        
        '''
        #initGCode = "; initial G-Code\n"
        initGCode += "G90\n"
        initGCode += "M82\n"
        initGCode += "G28\n"
        initGCode += "G1 Z10.0 F1500.0\n"
        initGCode += "M106 P0 S255\n"
        initGCode += "M190 S{0}\n".format(self.temp_bed)
        initGCode += "M109 S{0}\n".format(self.temp_nozzle)
        '''

        self.f.writelines(initPCode)
        self.f.write('\n')
        
        
        
    def closeFile(self):
        
        '''
        endGCode = "; End G-Code\n"
        endGCode += "M140 S0.0\n"
        endGCode += "M104 S0.0\n"
        endGCode += "M106 S0.0\n"
        #"""z up finish"""
        #endGCode += "G92 Z0\nG1 Z10 F500\n"
        endGCode += "M84\n"
        '''
        
        endPCode = "End Sub\n"
        self.f.writelines(endPCode)
        self.f.close()
    
    def crv2gcode(self, crv):
        
        gcode = []
        pcode = []
        
        e_value = 0
        
        
        if rs.IsCurveLinear(crv):
            exploded = [crv]
            
        else:
            exploded = rs.ExplodeCurves(crv)
            #return(';currently only linear crv\n')
            
            
            
        for itr, e in enumerate(exploded):
            
            crv_length = rs.CurveLength(e)
            e_value = self.calc_e(crv_length)
            
            startPnt = rs.CurveStartPoint(e)
            endPnt = rs.CurveEndPoint(e)
            
            
            if itr == 0:
                dist_last = rs.Distance(self.lastPnt, startPnt)
            
                #retract and move or none
                #comment for one path
                
                #if dist_last > 0.01:
                if dist_last > 5:

                    #retract
                    gcode.append("G92 E0\n")
                    gcode.append("G1 E{0} F{1}\n".format(-self.retractValue, self.retractSpeed))
                
                    #move up z 5
                    gcode.append("G1 Z{0} F{1}\n".format(self.lastPnt[2] + 10, self.mSpeed))
                    self.lastPnt[2] = self.lastPnt[2] + 10
                    pcode.append("\tpos = P({0[0]}, {0[1]}, {0[2]}, {1[0]}, {1[1]}, {1[2]})\n".format(self.lastPnt, self.armAngle))
                    pcode.append("\tMove L,pos\n")
                
                
                    #move to startPnt with up z 5
                    gcode.append("G1 X{0} Y{1}\n".format(startPnt.X, startPnt.Y))
                    self.lastPnt[0] = startPnt.X
                    self.lastPnt[1] = startPnt.Y
                    pcode.append("\tpos = P({0[0]}, {0[1]}, {0[2]}, {1[0]}, {1[1]}, {1[2]})\n".format(self.lastPnt, self.armAngle))
                    pcode.append("\tMove L,pos\n")
                    
                    
                    #move to startPnt
                    gcode.append("G1 Z{0}\n".format(startPnt.Z))
                    self.lastPnt[2] = startPnt.Z
                    pcode.append("\tpos = P({0[0]}, {0[1]}, {0[2]}, {1[0]}, {1[1]}, {1[2]})\n".format(self.lastPnt, self.armAngle))
                    pcode.append("\tMove L,pos\n")
                    
                    #back to retract
                    #gcode.append("G1 E{0} F{1}\n".format(self.calc_e(0.3), self.retractSpeed))
                    gcode.append("G1 E{0} F{1}\n".format(self.calc_e(self.nozzleDiameter), self.retractSpeed))
                    gcode.append("G4 P{0}\n".format(self.waitMillSec*3))
                    self.zUpTgl = True
                
            

            
            

            
            vec1 = rs.VectorCreate(endPnt, startPnt)
            vec2 = rs.VectorCreate((0,0,1), (0,0,0))
            angle = rs.VectorAngle(vec1, vec2)
            
            
            #stop a while
            if angle < 70:
                
                #split crv, (crv_length - n : n) n = 0.6
                n = 0.6
                
                
                crv_vec = rs.VectorCreate(endPnt, startPnt)
                crv_vec = rs.VectorUnitize(crv_vec)
                crv_vec = rs.VectorScale(crv_vec, crv_length-n)
                split_pnt = rs.VectorAdd(startPnt, crv_vec)
                
                e_value = self.calc_e(crv_length-n)
                
                
                gcode.append("G92 E0\n")
                gcode.append("G1 X{0} Y{1} Z{2} E{3} F{4}\n".format(split_pnt.X, split_pnt.Y, split_pnt.Z, e_value, self.eSpeed_slow))
                
                self.lastPnt = (split_pnt.X, split_pnt.Y, split_pnt.Z)
                pcode.append("\tpos = P({0[0]}, {0[1]}, {0[2]}, {1[0]}, {1[1]}, {1[2]})\n".format(self.lastPnt, self.armAngle))
                pcode.append("\tMove L,pos\n")
                
                    
                #retract at end of the curve
                gcode.append("G92 E0\n")
                gcode.append("G1 E{0} F{1}\n".format(-self.endRetract, self.retractSpeed))
                gcode.append("G4 P{0}\n".format(self.waitForZ))
                gcode.append("G1 E0 F{0}\n".format(self.retractSpeed))
                
                #extrude little bit
                e_value = self.calc_e(n)
                gcode.append("G1 X{0} Y{1} Z{2} E{3} F{4}\n".format(endPnt.X, endPnt.Y, endPnt.Z, e_value, self.eSpeed_slow))
                
                self.lastPnt = (endPnt.X, endPnt.Y, endPnt.Z)
                pcode.append("\tpos = P({0[0]}, {0[1]}, {0[2]}, {1[0]}, {1[1]}, {1[2]})\n".format(self.lastPnt, self.armAngle))
                pcode.append("\tMove L,pos\n")
                
                self.zUpTgl = True
                
            else:
                
                if self.zUpTgl:
                    speed = self.eSpeed_slow
                    self.zUpTgl = False
                else:
                    speed = self.eSpeed
                
                #extrude crv
                gcode.append("G92 E0\n")
                gcode.append("G1 X{0} Y{1} Z{2} E{3} F{4}\n".format(endPnt.X, endPnt.Y, endPnt.Z, e_value, speed))
                
                self.lastPnt = (endPnt.X, endPnt.Y, endPnt.Z)
                pcode.append("\tpos = P({0[0]}, {0[1]}, {0[2]}, {1[0]}, {1[1]}, {1[2]})\n".format(self.lastPnt, self.armAngle))
                pcode.append("\tMove L,pos\n")
                
                #stop a while
                gcode.append("G4 P{0}\n".format(self.waitMillSec))
            
        
                                
        else:
            self.lastPnt = endPnt
            
        return ''.join(pcode)
        
        
        
        
    def writePath(self, path):
        
        for i in range(path.BranchCount):
            
            for c in path.Branch(i):
                self.f.write(self.crv2gcode(c))
        
        
def main():
        
    gcoder = GCoder()
    
    gcoder.parseParams(params)
    gcoder.initFile()
    gcoder.writePath(path)
    gcoder.closeFile()
    
    
if button:
    main()
# ---------- end export_for_pcs ----------

# ---- group: ワイヤーをメッシュに変換
crv_30 = Curve(crv_28)
number_slider_6 = Slider(1, range=0..10)
curve_charge = CurveCharge(Curve=flatten(crv_30), Radius=Slider(1.75, range=0..10), ChargeStrengths=Slider(1.5, range=0..10))
cocoon = Cocoon(
    Charges=curve_charge,
    Iso=Slider(0.56, range=0..1),
    CellSize=Slider(0.5, range=0..1),
    Execute=Toggle(False),
    Simple=False)  # -> Mesh, RefinementData
mesh = Mesh(cocoon.Mesh)

# ---- group: 一筆書きでないパスの出力
export2 = GhPythonScript(path=crv_28, button=Button(), params=base_params.params)  # -> out, a; inputs path: tree, params: tree
# ---------- export2: Python ----------
__author__ = "m0rya"

import rhinoscriptsyntax as rs
import datetime


class GCoder:
    
    def __init__(self):
        print("hello")
        
        
    def calc_e(self, dist):
        
        filamentDia = 1.75
        
        resultE = self.E_multiplier * (dist * self.layerHeight * self.nozzleDiameter) / (3.14 * (filamentDia/2.0) * (filamentDia/2.0))
        return resultE
        
    def parseParams(self, params):
        self.nozzleDiameter = params.Branch(0)[1]
        self.layerHeight = params.Branch(1)[1]
        self.topSolidLayer = params.Branch(2)[1]
        self.bottomSolidLayer = params.Branch(3)[1]
        self.numOfShell = params.Branch(4)[1]
        self.pitchOfInfill = params.Branch(5)[1]
        self.numOfArtifactShell = params.Branch(6)[1]
        #self.distOfArtifact = params.Branch(7)[1]
        self.temp_bed = params.Branch(8)[1]
        self.temp_nozzle = params.Branch(7)[1]
        
        self.E_multiplier = params.Branch(9)[1]
        self.eSpeed = params.Branch(10)[1]
        self.mSpeed = params.Branch(11)[1]
        self.retractValue = params.Branch(12)[1]
        
        self.initE = "G92 E0\n"
        
        self.prePoint = [None, None]
        
        self.firstLayerRatio = 0.2
        
        self.lastPnt = (0,10,0)
        
        self.waitMillSec = 500
        self.waitForZ = 5000
        self.retractSpeed = 1500
        self.endRetract = 5
        
        self.eSpeed_slow = 85
        
        self.zUpTgl = False
        
    def initFile(self):
        
        savePath = rs.SaveFileName("Export G-Code File", "G-Code Files (*.gcode) |*.gcode||")
        self.f = open(savePath, 'w')
        
        
        #write basic info
        #self.f.write("; This G-Code is generated by Ryoma Takamori's Tool\n")
        
        #write comment
        
        #self.f.write("; Comment\n")
        #comment = rs.StringBox()
        #self.f.write(": " + comment + "\n")
        #self.f.write(";\n")
        
        
        #write date
        #dateCode = "; date : {0}\n".format(datetime.datetime.today())
        #self.f.write(dateCode)
        
        #write init G-Code
        
        initGCode = ''
        #initGCode = "; initial G-Code\n"
        initGCode += "G90\n"
        initGCode += "M82\n"
        initGCode += "G28\n"
        initGCode += "G1 Z10.0 F1500.0\n"
        initGCode += "M106 P0 S255\n"
        initGCode += "M190 S{0}\n".format(self.temp_bed)
        initGCode += "M109 S{0}\n".format(self.temp_nozzle)
        

        self.f.writelines(initGCode)
        self.f.write('\n')
        
        
        
    def closeFile(self):
        
        endGCode = "; End G-Code\n"
        endGCode += "M140 S0.0\n"
        endGCode += "M104 S0.0\n"
        endGCode += "M106 S0.0\n"
        #'''z up finish'''
        #endGCode += "G92 Z0\nG1 Z10 F500\n"
        endGCode += "M84\n"
        
        self.f.writelines(endGCode)
        self.f.write('\n')
        self.f.close()
    
    def crv2gcode(self, crv):
        
        gcode = []
        e_value = 0
        
        
        if rs.IsCurveLinear(crv):
            exploded = [crv]
            
        else:
            exploded = rs.ExplodeCurves(crv)
            #return(';currently only linear crv\n')
            
            
            
        for itr, e in enumerate(exploded):
            
            crv_length = rs.CurveLength(e)
            e_value = self.calc_e(crv_length)
            
            startPnt = rs.CurveStartPoint(e)
            endPnt = rs.CurveEndPoint(e)
            
            
            if itr == 0:
                dist_last = rs.Distance(self.lastPnt, startPnt)
            
                #retract and move or none
                #comment for one path
                
                #if dist_last > 0.01:
                if dist_last > 5:

                    #retract
                    gcode.append("G92 E0\n")
                    gcode.append("G1 E{0} F{1}\n".format(-self.retractValue, self.retractSpeed))
                
                    #move up z 5
                    gcode.append("G1 Z{0} F{1}\n".format(self.lastPnt[2] + 10, self.mSpeed))
                
                    #move to startPnt with up z 5
                    gcode.append("G1 X{0} Y{1}\n".format(startPnt.X, startPnt.Y))
                
                    #move to startPnt
                    gcode.append("G1 Z{0}\n".format(startPnt.Z))
                
                
                    #back to retract
                    #gcode.append("G1 E{0} F{1}\n".format(self.calc_e(0.3), self.retractSpeed))
                    gcode.append("G1 E{0} F{1}\n".format(self.calc_e(self.nozzleDiameter), self.retractSpeed))
                    gcode.append("G4 P{0}\n".format(self.waitMillSec*3))
                    self.zUpTgl = True
                
            

            
            

            
            vec1 = rs.VectorCreate(endPnt, startPnt)
            vec2 = rs.VectorCreate((0,0,1), (0,0,0))
            angle = rs.VectorAngle(vec1, vec2)
            
            
            #stop a while
            if angle < 70:
                
                print("hi")
                #split crv, (crv_length - n : n) n = 0.6
                n = 0.6
                
                
                crv_vec = rs.VectorCreate(endPnt, startPnt)
                crv_vec = rs.VectorUnitize(crv_vec)
                crv_vec = rs.VectorScale(crv_vec, crv_length-n)
                split_pnt = rs.VectorAdd(startPnt, crv_vec)
                
                e_value = self.calc_e(crv_length-n)
                
                
                gcode.append("G92 E0\n")
                gcode.append("G1 X{0} Y{1} Z{2} E{3} F{4}\n".format(split_pnt.X, split_pnt.Y, split_pnt.Z, e_value, self.eSpeed_slow))
                
                
                    
                #retract at end of the curve
                gcode.append("G92 E0\n")
                gcode.append("G1 E{0} F{1}\n".format(-self.endRetract, self.retractSpeed))
                gcode.append("G4 P{0}\n".format(self.waitForZ))
                gcode.append("G1 E0 F{0}\n".format(self.retractSpeed))
                
                #extrude little bit
                e_value = self.calc_e(n)
                gcode.append("G1 X{0} Y{1} Z{2} E{3} F{4}\n".format(endPnt.X, endPnt.Y, endPnt.Z, e_value, self.eSpeed_slow))
                
                self.zUpTgl = True
                
            else:
                
                if self.zUpTgl:
                    speed = self.eSpeed_slow
                    self.zUpTgl = False
                else:
                    speed = self.eSpeed
                
                #extrude crv
                gcode.append("G92 E0\n")
                gcode.append("G1 X{0} Y{1} Z{2} E{3} F{4}\n".format(endPnt.X, endPnt.Y, endPnt.Z, e_value, speed))
                
                #stop a while
                gcode.append("G4 P{0}\n".format(self.waitMillSec))
            
        
                                
        else:
            self.lastPnt = endPnt
            
        return ''.join(gcode)
        
        
    def writePath(self, path):
        
        for i in range(path.BranchCount):
            
            for c in path.Branch(i):
                self.f.write(self.crv2gcode(c))
        
        
def main():
        
    gcoder = GCoder()
    
    gcoder.parseParams(params)
    gcoder.initFile()
    gcoder.writePath(path)
    gcoder.closeFile()
    
    
if button:
    main()
# ---------- end export2 ----------

# ---- group: 一筆書きのパス出力
export3_one_path = GhPythonScript(path=crv_28, button=Button(), params=base_params.params)  # -> out, a; inputs path: tree, params: tree
# ---------- export3_one_path: Python ----------
__author__ = "m0rya"

import rhinoscriptsyntax as rs
import datetime


class GCoder:
    
    def __init__(self):
        print("hello")
        
        
    def calc_e(self, dist):
        
        filamentDia = 1.75
        
        resultE = self.E_multiplier * (dist * self.layerHeight * self.nozzleDiameter) / (3.14 * (filamentDia/2.0) * (filamentDia/2.0))
        return resultE
        
    def parseParams(self, params):
        self.nozzleDiameter = params.Branch(0)[1]
        self.layerHeight = params.Branch(1)[1]
        self.topSolidLayer = params.Branch(2)[1]
        self.bottomSolidLayer = params.Branch(3)[1]
        self.numOfShell = params.Branch(4)[1]
        self.pitchOfInfill = params.Branch(5)[1]
        self.numOfArtifactShell = params.Branch(6)[1]
        #self.distOfArtifact = params.Branch(7)[1]
        self.temp_bed = params.Branch(8)[1]
        self.temp_nozzle = params.Branch(7)[1]
        
        self.E_multiplier = params.Branch(9)[1]
        self.eSpeed = params.Branch(10)[1]
        self.mSpeed = params.Branch(11)[1]
        self.retractValue = params.Branch(12)[1]
        
        self.initE = "G92 E0\n"
        
        self.prePoint = [None, None]
        
        self.firstLayerRatio = 0.2
        
        self.lastPnt = (0,10,0)
        
        self.waitMillSec = 500
        self.waitForZ = 5000
        self.retractSpeed = 1500
        self.endRetract = 5
        
        self.eSpeed_slow = 75
        
        self.zUpTgl = False
        
    def initFile(self):
        
        savePath = rs.SaveFileName("Export G-Code File", "G-Code Files (*.gcode) |*.gcode||")
        self.f = open(savePath, 'w')
        
        
        #write basic info
        #self.f.write("; This G-Code is generated by Ryoma Takamori's Tool\n")
        
        #write comment
        
        #self.f.write("; Comment\n")
        #comment = rs.StringBox()
        #self.f.write(": " + comment + "\n")
        #self.f.write(";\n")
        
        
        #write date
        #dateCode = "; date : {0}\n".format(datetime.datetime.today())
        #self.f.write(dateCode)
        
        #write init G-Code
        
        initGCode = ''
        #initGCode = "; initial G-Code\n"
        initGCode += "G90\n"
        initGCode += "M82\n"
        initGCode += "G28\n"
        initGCode += "G1 Z10.0 F1500.0\n"
        initGCode += "M106 P0 S255\n"
        initGCode += "M190 S{0}\n".format(self.temp_bed)
        initGCode += "M109 S{0}\n".format(self.temp_nozzle)
        

        self.f.writelines(initGCode)
        self.f.write('\n')
        
        
        
    def closeFile(self):
        
        endGCode = "; End G-Code\n"
        endGCode += "M140 S0.0\n"
        endGCode += "M104 S0.0\n"
        endGCode += "M106 S0.0\n"
        #'''z up finish'''
        #endGCode += "G92 Z0\nG1 Z10 F500\n"
        endGCode += "M84\n"
        
        self.f.writelines(endGCode)
        self.f.write('\n')
        self.f.close()
    
    def crv2gcode(self, crv):
        
        gcode = []
        e_value = 0
        
        
        if rs.IsCurveLinear(crv):
            exploded = [crv]
            
        else:
            exploded = rs.ExplodeCurves(crv)
            #return(';currently only linear crv\n')
            
            
            
        for itr, e in enumerate(exploded):
            
            crv_length = rs.CurveLength(e)
            e_value = self.calc_e(crv_length)
            
            startPnt = rs.CurveStartPoint(e)
            endPnt = rs.CurveEndPoint(e)
            
            
            if itr == 0:
                dist_last = rs.Distance(self.lastPnt, startPnt)
            
                #retract and move or none
                #comment for one path
                
                #if dist_last > 0.01:
                if dist_last > 5:

                    #retract
                    gcode.append("G92 E0\n")
                    gcode.append("G1 E{0} F{1}\n".format(-self.retractValue, self.retractSpeed))
                
                    #move up z 5
                    gcode.append("G1 Z{0} F{1}\n".format(self.lastPnt[2] + 10, self.mSpeed))
                
                    #move to startPnt with up z 5
                    gcode.append("G1 X{0} Y{1}\n".format(startPnt.X, startPnt.Y))
                
                    #move to startPnt
                    gcode.append("G1 Z{0}\n".format(startPnt.Z))
                
                
                    #back to retract
                    #gcode.append("G1 E{0} F{1}\n".format(self.calc_e(0.3), self.retractSpeed))
                    gcode.append("G1 E{0} F{1}\n".format(self.calc_e(self.nozzleDiameter), self.retractSpeed))
                    gcode.append("G4 P{0}\n".format(self.waitMillSec*3))
                    self.zUpTgl = True
                
            

            
            

            
            vec1 = rs.VectorCreate(endPnt, startPnt)
            vec2 = rs.VectorCreate((0,0,1), (0,0,0))
            angle = rs.VectorAngle(vec1, vec2)
            
            
            #stop a while
            if angle < 70:
                
                print("hi")
                #split crv, (crv_length - n : n) n = 0.6
                n = 0.6
                
                
                crv_vec = rs.VectorCreate(endPnt, startPnt)
                crv_vec = rs.VectorUnitize(crv_vec)
                crv_vec = rs.VectorScale(crv_vec, crv_length-n)
                split_pnt = rs.VectorAdd(startPnt, crv_vec)
                
                e_value = self.calc_e(crv_length-n)
                
                
                gcode.append("G92 E0\n")
                gcode.append("G1 X{0} Y{1} Z{2} E{3} F{4}\n".format(split_pnt.X, split_pnt.Y, split_pnt.Z, e_value, self.eSpeed_slow))
                
                
                    
                #retract at end of the curve
                gcode.append("G92 E0\n")
                #gcode.append("G1 E{0} F{1}\n".format(-self.endRetract, self.retractSpeed))
                gcode.append("G4 P{0}\n".format(self.waitForZ))
                #gcode.append("G1 E0 F{0}\n".format(self.retractSpeed))
                
                #extrude little bit
                e_value = self.calc_e(n)
                gcode.append("G1 X{0} Y{1} Z{2} E{3} F{4}\n".format(endPnt.X, endPnt.Y, endPnt.Z, e_value, self.eSpeed_slow))
                
                self.zUpTgl = True
                
            else:
                
                if self.zUpTgl:
                    speed = self.eSpeed_slow
                    self.zUpTgl = False
                else:
                    speed = self.eSpeed
                
                #extrude crv
                gcode.append("G92 E0\n")
                gcode.append("G1 X{0} Y{1} Z{2} E{3} F{4}\n".format(endPnt.X, endPnt.Y, endPnt.Z, e_value, speed))
                
                #stop a while
                gcode.append("G4 P{0}\n".format(self.waitMillSec))
            
        
                                
        else:
            self.lastPnt = endPnt
            
        return ''.join(gcode)
        
        
    def writePath(self, path):
        
        for i in range(path.BranchCount):
            
            for c in path.Branch(i):
                self.f.write(self.crv2gcode(c))
        
        
def main():
        
    gcoder = GCoder()
    
    gcoder.parseParams(params)
    gcoder.initFile()
    gcoder.writePath(path)
    gcoder.closeFile()
    
    
if button:
    main()
# ---------- end export3_one_path ----------

# ----
polygon = Polygon(Plane=PlaneXY(0, 0, 0), Radius=Slider(100, range=0..100), Segments=3, FilletRadius=0)  # -> Polygon, Length
area_2 = Area(Geometry=polygon.Polygon)  # -> Area, Centroid
Z = UnitZ(Factor=Slider(50, range=0..100))
cp = ControlPoints(Curve=polygon.Polygon)  # -> Points, Weights, Knots
move_2 = Move(Geometry=area_2.Centroid, Motion=Z)  # -> Geometry, Transform
cull_i = CullIndex(List=cp.Points, Indices=-1, Wrap=True)
explode = Explode(Curve=polygon.Polygon, Recursive=True)  # -> Segments, Vertices
ln = Line(StartPoint=cull_i, EndPoint=move_2.Geometry)
number_slider_7 = Slider(2, range=0..10)

crv_31 = Curve(ln)
crv_32 = Curve(explode.Segments)

python = GhPythonScript(x=crv_31, y=crv_32, z=number_slider_7)  # -> out, simplify(a), b; inputs x: list, y: list, z: Int32
# ---------- python: Python ----------
__author__ = "m0rya"

import rhinoscriptsyntax as rs
import ghpythonlib.treehelpers as th


def div(crvRoof, crvBottom):
    
    result = []
    newCrvs = [[[],[]] for i in range(4)]
    
    midPntsRoof = [rs.CurveMidPoint(crv) for crv in crvRoof]
    midPntsBottom = [rs.CurveMidPoint(crv) for crv in crvBottom]
    
    
    topPnt = rs.CurveEndPoint(crvRoof[0])
    
    
    
    for i in range(3):
        newCrvs[0][0].append(rs.AddLine(midPntsRoof[i], topPnt))
        newCrvs[0][1].append(rs.AddLine(midPntsRoof[i], midPntsRoof[(i+1)%3]))
        
    
    for i in range(3):
        
  
        newCrvs[i+1][0].append(rs.AddLine(rs.CurveStartPoint(crvRoof[i]), midPntsRoof[i]))
        newCrvs[i+1][0].append(rs.AddLine(midPntsBottom[i], midPntsRoof[i]))
        newCrvs[i+1][0].append(rs.AddLine(midPntsBottom[(i+2)%3], midPntsRoof[i]))
    
        newCrvs[i+1][1].append(rs.AddLine(rs.CurveStartPoint(crvRoof[i]), midPntsBottom[i]))
        newCrvs[i+1][1].append(rs.AddLine(midPntsBottom[i], midPntsBottom[(i+2)%3]))
        newCrvs[i+1][1].append(rs.AddLine(midPntsBottom[(i+2)%3], rs.CurveStartPoint(crvRoof[i])))
    
        
        
    return newCrvs
        
        
        
tmp = div(x,y)
a = th.list_to_tree(tmp, source=[0,0])

result = []
for i in range(z):
    
    
    
    if i == 0:
        result = div(x,y)
    
        
    else:
        tmpResult = []

        for j in range(len(result)):
            tmpResult.extend(div(result[j][0], result[j][1]))
            
        result = tmpResult
        
a = th.list_to_tree(result, source = [0,0])
b = result
# ---------- end python ----------
python_2 = GhPythonScript(x=crv_31, y=crv_32, n=number_slider_7)  # -> out, simplify(a), b; inputs x: list, y: list, n: Int32
# ---------- python_2: Python ----------
__author__ = "m0rya"

import rhinoscriptsyntax as rs
import ghpythonlib.treehelpers as th


#Bottom

result = []

btmCrv = y
for i in range(n):
    
    if i == 0:
        result.append([y])
    
a = th.list_to_tree(result, source=[0,0])


'''
def div(crvRoof, crvBottom):
    
    result = []
    newCrvs = [[[],[]] for i in range(4)]
    
    midPntsRoof = [rs.CurveMidPoint(crv) for crv in crvRoof]
    midPntsBottom = [rs.CurveMidPoint(crv) for crv in crvBottom]
    
    
    topPnt = rs.CurveEndPoint(crvRoof[0])
    
    
    
    for i in range(3):
        newCrvs[0][0].append(rs.AddLine(midPntsRoof[i], topPnt))
        newCrvs[0][1].append(rs.AddLine(midPntsRoof[i], midPntsRoof[(i+1)%3]))
        
    
    for i in range(3):
        
  
        newCrvs[i+1][0].append(rs.AddLine(rs.CurveStartPoint(crvRoof[i]), midPntsRoof[i]))
        newCrvs[i+1][0].append(rs.AddLine(midPntsBottom[i], midPntsRoof[i]))
        newCrvs[i+1][0].append(rs.AddLine(midPntsBottom[(i+2)%3], midPntsRoof[i]))
    
        newCrvs[i+1][1].append(rs.AddLine(rs.CurveStartPoint(crvRoof[i]), midPntsBottom[i]))
        newCrvs[i+1][1].append(rs.AddLine(midPntsBottom[i], midPntsBottom[(i+2)%3]))
        newCrvs[i+1][1].append(rs.AddLine(midPntsBottom[(i+2)%3], rs.CurveStartPoint(crvRoof[i])))
    
        
        
    return newCrvs
        
        
        
tmp = div(x,y)
a = th.list_to_tree(tmp, source=[0,0])

result = []
for i in range(z):
    
    
    
    if i == 0:
        result = div(x,y)
    
        
    else:
        tmpResult = []

        for j in range(len(result)):
            tmpResult.extend(div(result[j][0], result[j][1]))
            
        result = tmpResult
        
a = th.list_to_tree(result, source = [0,0])
b = result    

'''
# ---------- end python_2 ----------
python_3 = GhPythonScript(x=python.a, n=number_slider_7)  # -> out, a; inputs x: tree, n: Int32
# ---------- python_3: Python ----------
__author__ = "m0rya"

import rhinoscriptsyntax as rs
import ghpythonlib.treehelpers as th

'''
len(x) == 4**n
'''

gasket = []
debug = []
for i in range(int(x.BranchCount/2)):

    gasket.append([x.Branch(2*i), x.Branch(2*i+1)])


Torigos = []

for i in range(4):
    Torigos.append(gasket[i*int(len(gasket)/4):(i+1)*int(len(gasket)/4)])


#a = th.list_to_tree(Torigos[1], source=[0])


#Bottom
for i in range(n):
    
    for j in range(3):
        
        debug.append(Torigos[j+1][1][1][0])
        debug.append(Torigos[j+1][2][1][2])
        debug.append(Torigos[j+1][3][1][0])
        debug.append(Torigos[j+1][1][1][2])
        
a = debug
# ---------- end python_3 ----------
viewer = ParamViewer(python.a)
crv_33 = Curve(python.a)

# ==== cluster Cluster
x = ClusterInput()
y = ClusterInput()
num = ClusterInput()
num_2 = ClusterInput()
num_3 = Number(num_2)
num_4 = Number(num)
pairing = GhPythonScript(x=x, y=y)  # -> out, a; inputs x: tree, y: list
# ---------- pairing: Python ----------
__author__ = "m0rya"

import rhinoscriptsyntax as rs
import ghpythonlib.treehelpers as th

result = []

for i in range(x.BranchCount):
    
    for j in range(len(x.Branch(i))):
        
        endPoints = [rs.CurveStartPoint(x.Branch(i)[j]), rs.CurveEndPoint(x.Branch(i)[j])]
        tmp = [x.Branch(i)[j]]
        
        
        for k in range(len(y)):
                        
            intersect = rs.CurveCurveIntersection(x.Branch(i)[j], y[k])
            
            if intersect != None:
                tmp.append(y[k])
                
        result.append(tmp)
        
        
a = th.list_to_tree(result, source=[0])
# ---------- end pairing ----------
dup = DuplicateData(Data=num_3, Number=2, Order=True)  # -> simplify(flatten(Data))
dup_2 = DuplicateData(Data=num_4, Number=4, Order=True)  # -> graft(Data)
item = ListItem(List=pairing.a, Index=1, Wrap=True)
item_2 = ListItem(List=pairing.a, Index=0, Wrap=True)
item_3 = ListItem(List=pairing.a, Index=2, Wrap=True)
merge = Merge(Data1=simplify(graft(dup)), Data2=simplify(dup_2))
swp2 = Sweep2(Rail1=item, Rail2=item_3, Sections=item_2, SameHeight=False)
item_4 = ListItem(List=merge, Index=0, Wrap=True)
item_5 = ListItem(List=merge, Index=1, Wrap=True)
sdivide = DivideSurface(Surface=swp2, UCount=item_5, VCount=item_4)  # -> Points, Normals, Parameters
int = Integer(num_4)
pline = PolyLine(Vertices=sdivide.Points, Closed=False)  # -> simplify(Polyline)
int_2 = Integer(num_3)
python = GhPythonScript(x=pline, y=int)  # -> out, a; inputs x: tree
# ---------- python: Python ----------
__author__ = "m0rya"

import rhinoscriptsyntax as rs
import ghpythonlib.treehelpers as th

result = [[] for i in range(y+1)]


for i in range(x.BranchCount):
    
    result[i%(y+1)].append(x.Branch(i)[0])
    
    
a = th.list_to_tree(result, source=[0])
# ---------- end python ----------
bang = ExplodeTree(Data=int_2)  # -> Branch0, Branch1
item_6 = ListItem(List=python.a, Index=0, Wrap=True)
item_7 = ListItem(List=python.a, Index=1, Wrap=True)
item_8 = ListItem(List=python.a, Index=2, Wrap=True)
item_9 = ListItem(List=python.a, Index=3, Wrap=True)
flip = FlipCurve(Curve=item_7)  # -> Curve, Flag
flip_2 = FlipCurve(Curve=item_9)  # -> Curve, Flag
merge_2 = Merge(Data1=item_6, Data2=flip.Curve)
swp2_2 = Sweep2(Rail1=item_8, Rail2=flip_2.Curve, Sections=merge_2, SameHeight=False)
sdivide_2 = DivideSurface(Surface=simplify(swp2_2), UCount=bang.Branch1, VCount=bang.Branch0)  # -> Points, Normals, Parameters
python_2 = GhPythonScript(x=sdivide_2.Points, y=swp2_2)  # -> out, a; inputs x: tree, y: tree
# ---------- python_2: Python ----------
__author__ = "m0rya"

import rhinoscriptsyntax as rs
import ghpythonlib.treehelpers as th

srfNum = y.BranchCount

partionItr = x.BranchCount / srfNum

a = partionItr

result = []

for i in range(int(srfNum)):
    
    tmp2 = []
    for j in range(len(x.Branch(i*partionItr))):
        tmp = [x.Branch(i*partionItr+k)[j] for k in range(int(partionItr))]
        tmp2.append(tmp)
        
    result.append(tmp2)
        
        
        

a = th.list_to_tree(result, source=[0])
# ---------- end python_2 ----------
pline_2 = PolyLine(Vertices=sdivide_2.Points, Closed=False)
pline_3 = PolyLine(Vertices=python_2.a, Closed=False)
trim = TrimTree(Tree=pline_3, Depth=1)  # -> simplify(Tree)
T = ClusterOutput(trim)
trim_2 = TrimTree(Tree=pline_2, Depth=1)  # -> simplify(Tree)
T_2 = ClusterOutput(trim_2)

# ==== cluster Cluster_2
neg = Negative(Value=Slider(21, range=0..100))
vec = VectorXYZ(XComponent=0, YComponent=0, ZComponent=0)  # -> Vector, Length
vec_2 = VectorXYZ(XComponent=Slider(3, range=0..100), YComponent=0, ZComponent=Slider(41, range=0..1000))  # -> Vector, Length
vec_3 = VectorXYZ(XComponent=Slider(30, range=0..100), YComponent=neg, ZComponent=Slider(59, range=0..100))  # -> Vector, Length
rectangle = Rectangle(Plane=PlaneXY(0, 0, 0), XSize=Slider(40, range=0..100), YSize=Slider(20, range=0..100), Radius=0)  # -> Rectangle, Length
move = Move(Geometry=vec.Vector, Motion=vec_2.Vector)  # -> Geometry, Transform
move_2 = Move(Geometry=move.Geometry, Motion=vec_3.Vector)  # -> Geometry, Transform
merge = Merge(Data1=vec.Vector, Data2=move.Geometry, Data3=move_2.Geometry)
cp = ControlPoints(Curve=rectangle.Rectangle)  # -> Points, Weights, Knots
intcrv = Interpolate(Vertices=merge, Degree=3, Periodic=False, KnotStyle=1)  # -> Curve, Length, Domain
item = ListItem(List=cp.Points, Index=1, Wrap=True)
area = Area(Geometry=rectangle.Rectangle)  # -> Area, Centroid
move_3 = Move(Geometry=intcrv.Curve, Motion=item)  # -> Geometry, Transform
yz = YZPlane(Origin=area.Centroid)
mirror = Mirror(Geometry=move_3.Geometry, Plane=yz)  # -> Geometry, Transform
crv = Curve(rectangle.Rectangle)
merge_2 = Merge(Data1=move_3.Geometry, Data2=mirror.Geometry)
xz = XZPlane(Origin=area.Centroid)
explode = Explode(Curve=crv, Recursive=True)  # -> Segments, Vertices
mirror_2 = Mirror(Geometry=merge_2, Plane=xz)  # -> Geometry, Transform
crv_2 = Curve(explode.Segments)
merge_3 = Merge(Data1=merge_2, Data2=mirror_2.Geometry)  # -> flatten(Result)
R = ClusterOutput(merge_3)
crv_3 = Curve(crv_2)
len = Length(Curve=crv_3)
sort = SortList(Keys=len, ValuesA=crv_3)  # -> Keys, ValuesA
partition = PartitionList(List=sort.ValuesA, Size=2)
crv_4 = Curve(partition)
bang = ExplodeTree(Data=crv_4)  # -> Branch0, Branch1
_0_0_0 = ClusterOutput(bang.Branch0)
_0_0_1 = ClusterOutput(bang.Branch1)

# ==== cluster Cluster_3
number_slider = Slider(30, range=0..100)
vec = VectorXYZ(XComponent=0, YComponent=0, ZComponent=0)  # -> Vector, Length
vec_2 = VectorXYZ(XComponent=number_slider, YComponent=Slider(7, range=0..100), ZComponent=0)  # -> Vector, Length
multiplication = Multiplication(A=number_slider, B=2)
X = UnitX(Factor=multiplication)
move = Move(Geometry=vec.Vector, Motion=vec_2.Vector)  # -> Geometry, Transform
move_2 = Move(Geometry=vec.Vector, Motion=X)  # -> Geometry, Transform
Y = UnitY(Factor=1)
vec_3 = VectorXYZ(XComponent=0, YComponent=0, ZComponent=0)  # -> Vector, Length
merge = Merge(Data1=vec.Vector, Data2=move.Geometry, Data3=move_2.Geometry)
line = LineSDL(Start=vec_3.Vector, Direction=Y, Length=3)
intcrv = Interpolate(Vertices=merge, Degree=3, Periodic=False, KnotStyle=1)  # -> Curve, Length, Domain
midpt = CurveMiddle(Curve=intcrv.Curve)
rot3d = Rotate3D(Geometry=intcrv.Curve, Angle=-1.570796327, Center=Point(0, 0, 0), Axis=line)  # -> Geometry, Transform
rotate = Rotate(Geometry=intcrv.Curve, Angle=1.570796327, Plane=PlaneXY(0, 0, 0))  # -> Geometry, Transform
midpt_2 = CurveMiddle(Curve=rotate.Geometry)
yz = YZPlane(Origin=midpt)
xz = XZPlane(Origin=midpt_2)
mirror = Mirror(Geometry=rotate.Geometry, Plane=yz)  # -> Geometry, Transform
mirror_2 = Mirror(Geometry=intcrv.Curve, Plane=xz)  # -> Geometry, Transform

crv = Curve(mirror_2.Geometry)
crv_2 = Curve(mirror.Geometry)
crv_3 = Curve(intcrv.Curve)
crv_4 = Curve(rotate.Geometry)

end = EndPoints(Curve=crv_3)  # -> Start, End
end_2 = EndPoints(Curve=crv)  # -> Start, End
merge_2 = Merge(Data1=end.Start, Data2=end.End, Data3=end_2.Start, Data4=end_2.End)
move_3 = Move(Geometry=rot3d.Geometry, Motion=merge_2)  # -> Geometry, Transform
panel = Panel("""-45
45
-135
135""")
rad = Radians(Degrees=panel)
rotate_2 = Rotate(Geometry=move_3.Geometry, Angle=rad, Plane=merge_2)  # -> Geometry, Transform
G = ClusterOutput(rotate_2.Geometry)
merge_3 = Merge(Data1=crv_3, Data2=crv, Data3=crv_4, Data4=crv_2)
R = ClusterOutput(merge_3)

# ==== cluster Cluster_4
number_slider = Slider(100, range=0..100)
number_slider_2 = Slider(20, range=0..100)
number_slider_3 = Slider(65, range=0..100)
division = Division(A=Slider(120, range=0..1000), B=number_slider_2)
series = Series(Start=0, Step=division, Count=number_slider_2)
Z = UnitZ(Factor=series)
rectangle = Rectangle(Plane=PlaneXY(0, 0, 0), XSize=number_slider_3, YSize=number_slider_3, Radius=0)  # -> Rectangle, Length
division_2 = Division(A=Slider(64, range=0..100), B=number_slider_2)
move = Move(Geometry=rectangle.Rectangle, Motion=Z)  # -> Geometry, Transform
series_2 = Series(Start=0, Step=division_2, Count=number_slider_2)
area = Area(Geometry=move.Geometry)  # -> Area, Centroid
rad = Radians(Degrees=series_2)
rotate = Rotate(Geometry=move.Geometry, Angle=rad, Plane=area.Centroid)  # -> Geometry, Transform
lng = ListLength(List=rotate.Geometry)
series_3 = Series(Start=0, Step=1, Count=lng)
dom = ConstructDomain(DomainStart=0, DomainEnd=lng)
remap = RemapNumbers(Value=series_3, Source=dom, Target=Domain(0, 1))  # -> Mapped, Clipped
area_2 = Area(Geometry=rotate.Geometry)  # -> Area, Centroid
graph = GraphMapper(
    remap.Mapped,
    x0=0,
    x1=1,
    y0=0,
    y1=1,
    container_name="Bezier",
    cpx=[0, 0.4811943173, 0.5324544907, 1],
    cpy=[1, 0.2012637854, 0.2066637278, 1])
rev = ReverseList(List=graph)
scale = Scale(Geometry=rotate.Geometry, Center=area_2.Centroid, Factor=rev)  # -> Geometry, Transform
explode = Explode(Curve=scale.Geometry, Recursive=True)  # -> Segments, Vertices
flip = FlipMatrix(Data=explode.Vertices)
intcrv = Interpolate(Vertices=flip, Degree=3, Periodic=False, KnotStyle=1)  # -> flatten(Curve), Length, Domain
item = ListItem(List=scale.Geometry, Index=0, Wrap=True)
cull_i = CullIndex(List=intcrv.Curve, Indices=-1, Wrap=True)
explode_2 = Explode(Curve=item, Recursive=True)  # -> Segments, Vertices
crv = Curve(explode_2.Segments)
crv_2 = Curve(cull_i)
explode_3 = Explode(Curve=crv, Recursive=True)  # -> flatten(Segments), Vertices
bang = ExplodeTree(Data=graft(crv_2))  # -> Branch0, Branch1, Branch2, Branch3
bang_2 = ExplodeTree(Data=graft(explode_3.Segments))  # -> Branch0, Branch1, Branch2, Branch3
merge = Merge(Data1=flatten(bang.Branch0), Data2=flatten(bang.Branch1), Data3=flatten(bang.Branch3), Data4=flatten(bang.Branch2))  # -> flatten(Result)
R = ClusterOutput(merge)
merge_2 = Merge(
    Data1=flatten(bang_2.Branch0),
    Data2=flatten(bang_2.Branch2),
    Data3=flatten(bang_2.Branch3),
    Data4=flatten(bang_2.Branch1))  # -> flatten(Result)
R_2 = ClusterOutput(merge_2)

# ==== cluster Cluster_5
C = ClusterInput()
C_2 = ClusterInput()
C_3 = ClusterInput()
int = ClusterInput()
int_2 = ClusterInput()
int_3 = ClusterInput()
int_4 = Integer(int)
int_5 = Integer(int_2)
int_6 = Integer(int_3)
int_7 = ClusterOutput(int_6)
entwine = Entwine(Branch00=int_4, Branch01=int_5, FlattenInputs=True)
R = ClusterOutput(entwine)
divide = DivideCurve(Curve=C, Count=int_5, Kinks=False)  # -> Points, Tangents, Parameters
divide_2 = DivideCurve(Curve=C_3, Count=int_6, Kinks=False)  # -> Points, Tangents, Parameters
divide_3 = DivideCurve(Curve=C_2, Count=int_4, Kinks=False)  # -> Points, Tangents, Parameters
pline = PolyLine(Vertices=divide_3.Points, Closed=False)  # -> flatten(Polyline)
pline_2 = PolyLine(Vertices=divide.Points, Closed=False)  # -> flatten(Polyline)
pline_3 = PolyLine(Vertices=divide_2.Points, Closed=False)  # -> flatten(Polyline)
pl = ClusterOutput(pline_3)
entwine_2 = Entwine(Branch00=pline, Branch01=pline_2, FlattenInputs=True)
R_2 = ClusterOutput(entwine_2)
