# Grasshopper definition wire_print_pcs.gh (Grasshopper 1.0.7)
# plug-ins: Pufferfish, Noise 4D, MarchingCubes

number_slider = Slider(30, range=0..100)
vec = VectorXYZ(XComponent=0, YComponent=0, ZComponent=0)  # -> Vector, Length
vec_2 = VectorXYZ(XComponent=number_slider, YComponent=Slider(7, range=0..100), ZComponent=0)  # -> Vector, Length
multiplication = Multiplication(A=number_slider, B=2)
number_slider_2 = Slider(100, range=0..100)
number_slider_3 = Slider(20, range=0..100)
X = UnitX(Factor=multiplication)
number_slider_4 = Slider(65, range=0..100)
move = Move(Geometry=vec.Vector, Motion=vec_2.Vector)  # -> Geometry, Transform
move_2 = Move(Geometry=vec.Vector, Motion=X)  # -> Geometry, Transform
division = Division(A=Slider(120, range=0..1000), B=number_slider_3)
Y = UnitY(Factor=1)
vec_3 = VectorXYZ(XComponent=0, YComponent=0, ZComponent=0)  # -> Vector, Length
vec_4 = VectorXYZ(XComponent=0, YComponent=0, ZComponent=0)  # -> Vector, Length
merge = Merge(Data1=vec.Vector, Data2=move.Geometry, Data3=move_2.Geometry)
series = Series(Start=0, Step=division, Count=number_slider_3)
Z = UnitZ(Factor=series)
vec_5 = VectorXYZ(XComponent=Slider(3, range=0..100), YComponent=0, ZComponent=Slider(41, range=0..1000))  # -> Vector, Length
vec_6 = VectorXYZ(XComponent=0, YComponent=0, ZComponent=0)  # -> Vector, Length
line = LineSDL(Start=vec_3.Vector, Direction=Y, Length=3)
rectangle = Rectangle(Plane=PlaneXY(0, 0, 0), XSize=number_slider_4, YSize=number_slider_4, Radius=0)  # -> Rectangle, Length
neg = Negative(Value=Slider(52, range=0..100))
vec_7 = VectorXYZ(XComponent=Slider(3, range=0..100), YComponent=0, ZComponent=Slider(41, range=0..1000))  # -> Vector, Length
intcrv = Interpolate(Vertices=merge, Degree=3, Periodic=False, KnotStyle=1)  # -> Curve, Length, Domain
neg_2 = Negative(Value=Slider(21, range=0..100))
move_3 = Move(Geometry=vec_4.Vector, Motion=vec_5.Vector)  # -> Geometry, Transform
division_2 = Division(A=Slider(64, range=0..100), B=number_slider_3)
vec_8 = VectorXYZ(XComponent=Slider(30, range=0..100), YComponent=neg, ZComponent=Slider(59, range=0..100))  # -> Vector, Length
move_4 = Move(Geometry=rectangle.Rectangle, Motion=Z)  # -> Geometry, Transform
rectangle_2 = Rectangle(Plane=PlaneXY(0, 0, 0), XSize=Slider(40, range=0..100), YSize=Slider(20, range=0..100), Radius=0)  # -> Rectangle, Length
move_5 = Move(Geometry=vec_6.Vector, Motion=vec_7.Vector)  # -> Geometry, Transform
vec_9 = VectorXYZ(XComponent=Slider(30, range=0..100), YComponent=neg_2, ZComponent=Slider(59, range=0..100))  # -> Vector, Length
midpt = CurveMiddle(Curve=intcrv.Curve)
rot3d = Rotate3D(Geometry=intcrv.Curve, Angle=-1.570796327, Center=Point(0, 0, 0), Axis=line)  # -> Geometry, Transform
move_6 = Move(Geometry=move_3.Geometry, Motion=vec_8.Vector)  # -> Geometry, Transform
series_2 = Series(Start=0, Step=division_2, Count=number_slider_3)
rotate = Rotate(Geometry=intcrv.Curve, Angle=1.570796327, Plane=PlaneXY(0, 0, 0))  # -> Geometry, Transform
midpt_2 = CurveMiddle(Curve=rotate.Geometry)
move_7 = Move(Geometry=move_5.Geometry, Motion=vec_9.Vector)  # -> Geometry, Transform
yz = YZPlane(Origin=midpt)
xz = XZPlane(Origin=midpt_2)
area = Area(Geometry=move_4.Geometry)  # -> Area, Centroid
rad = Radians(Degrees=series_2)
merge_2 = Merge(Data1=vec_4.Vector, Data2=move_3.Geometry, Data3=move_6.Geometry)
merge_3 = Merge(Data1=vec_6.Vector, Data2=move_5.Geometry, Data3=move_7.Geometry)
mirror = Mirror(Geometry=rotate.Geometry, Plane=yz)  # -> Geometry, Transform
mirror_2 = Mirror(Geometry=intcrv.Curve, Plane=xz)  # -> Geometry, Transform
cp = ControlPoints(Curve=rectangle_2.Rectangle)  # -> Points, Weights, Knots
rotate_2 = Rotate(Geometry=move_4.Geometry, Angle=rad, Plane=area.Centroid)  # -> Geometry, Transform
lng = ListLength(List=rotate_2.Geometry)
series_3 = Series(Start=0, Step=1, Count=lng)
dom = ConstructDomain(DomainStart=0, DomainEnd=lng)
intcrv_2 = Interpolate(Vertices=merge_2, Degree=3, Periodic=False, KnotStyle=1)  # -> Curve, Length, Domain
intcrv_3 = Interpolate(Vertices=merge_3, Degree=3, Periodic=False, KnotStyle=1)  # -> Curve, Length, Domain
remap = RemapNumbers(Value=series_3, Source=dom, Target=Domain(0, 1))  # -> Mapped, Clipped
item = ListItem(List=cp.Points, Index=1, Wrap=True)

crv = Curve(mirror_2.Geometry)
crv_2 = Curve(mirror.Geometry)
crv_3 = Curve(intcrv.Curve)
crv_4 = Curve(rotate.Geometry)

area_2 = Area(Geometry=rotate_2.Geometry)  # -> Area, Centroid
graph = GraphMapper(
    remap.Mapped,
    x0=0,
    x1=1,
    y0=0,
    y1=1,
    container_name="Bezier",
    cpx=[0, 0.4811943173, 0.5324544907, 1],
    cpy=[1, 0.2012637854, 0.2066637278, 1])
move_8 = Move(Geometry=intcrv_3.Curve, Motion=item)  # -> Geometry, Transform
area_3 = Area(Geometry=rectangle_2.Rectangle)  # -> Area, Centroid
yz_2 = YZPlane(Origin=area_3.Centroid)
mirror_3 = Mirror(Geometry=move_8.Geometry, Plane=yz_2)  # -> Geometry, Transform
end = EndPoints(Curve=crv_3)  # -> Start, End
end_2 = EndPoints(Curve=crv)  # -> Start, End
merge_4 = Merge(Data1=move_8.Geometry, Data2=mirror_3.Geometry)
crv_5 = Curve(rectangle_2.Rectangle)
xz_2 = XZPlane(Origin=area_3.Centroid)
rev = ReverseList(List=graph)
mirror_4 = Mirror(Geometry=merge_4, Plane=xz_2)  # -> Geometry, Transform
merge_5 = Merge(Data1=end.Start, Data2=end.End, Data3=end_2.Start, Data4=end_2.End)
explode = Explode(Curve=crv_5, Recursive=True)  # -> Segments, Vertices
scale = Scale(Geometry=rotate_2.Geometry, Center=area_2.Centroid, Factor=rev)  # -> Geometry, Transform
explode_2 = Explode(Curve=scale.Geometry, Recursive=True)  # -> Segments, Vertices
crv_6 = Curve(explode.Segments)
merge_6 = Merge(Data1=merge_4, Data2=mirror_4.Geometry)  # -> flatten(Result)
move_9 = Move(Geometry=rot3d.Geometry, Motion=merge_5)  # -> Geometry, Transform
cir = Circle(Plane=PlaneXY(0, 0, 0), Radius=Slider(36, range=0..100))
flip = FlipMatrix(Data=explode_2.Vertices)
panel = Panel("""-45
45
-135
135""")
crv_7 = Curve(crv_6)
merge_7 = Merge(Data1=crv_3, Data2=crv, Data3=crv_4, Data4=crv_2)
divide = DivideCurve(Curve=cir, Count=Slider(4, range=0..10), Kinks=False)  # -> Points, Tangents, Parameters
intcrv_4 = Interpolate(Vertices=flip, Degree=3, Periodic=False, KnotStyle=1)  # -> flatten(Curve), Length, Domain
rad_2 = Radians(Degrees=panel)
len = Length(Curve=crv_7)
number_slider_5 = Slider(5, range=0..10)
crv_8 = Curve(merge_7)
item_2 = ListItem(List=scale.Geometry, Index=0, Wrap=True)
cull_i = CullIndex(List=intcrv_4.Curve, Indices=-1, Wrap=True)
rotate_3 = Rotate(Geometry=move_9.Geometry, Angle=rad_2, Plane=merge_5)  # -> Geometry, Transform
crv_9 = Curve(rotate_3.Geometry)
shatter = Shatter(Curve=cir, Parameters=divide.Parameters)
sort = SortList(Keys=len, ValuesA=crv_7)  # -> Keys, ValuesA
explode_3 = Explode(Curve=item_2, Recursive=True)  # -> Segments, Vertices
number_slider_6 = Slider(3, range=0..10)
partition = PartitionList(List=sort.ValuesA, Size=2)
number_slider_7 = Slider(21, range=0..100)
crv_10 = Curve(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)
crv_11 = Curve([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])
crv_12 = Curve(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)
crv_13 = Curve([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])
crv_14 = Curve(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)
crv_15 = Curve(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)
crv_16 = Curve(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)
crv_17 = Curve(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)
crv_18 = Curve(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)
crv_19 = Curve(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)
crv_20 = Curve(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)
crv_21 = Curve(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)
crv_22 = Curve([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])
crv_23 = Curve(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)
crv_24 = Curve(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)
crv_25 = Curve(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)
crv_26 = Curve(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)
crv_27 = Curve(explode_3.Segments)
crv_28 = Curve(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)
crv_29 = Curve(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)
crv_30 = Curve(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)
crv_31 = Curve(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)
crv_32 = Curve(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)
crv_33 = Curve(merge_6)
crv_34 = Curve(partition)
flip_2 = FlipCurve(Curve=crv_15)  # -> Curve, Flag
flip_3 = FlipCurve(Curve=crv_12)  # -> Curve, Flag
crv_35 = Curve(cull_i)
flip_4 = FlipCurve(Curve=crv_10)  # -> Curve, Flag
explode_4 = Explode(Curve=crv_27, Recursive=True)  # -> flatten(Segments), Vertices
divide_2 = DivideCurve(Curve=shatter, Count=number_slider_5, Kinks=False)  # -> Points, Tangents, Parameters
pt = Point(divide.Points)
flip_5 = FlipCurve(Curve=crv_16)  # -> Curve, Flag
flip_6 = FlipCurve(Curve=crv_23)  # -> Curve, Flag
flip_7 = FlipCurve(Curve=crv_24)  # -> Curve, Flag
flip_8 = FlipCurve(Curve=crv_25)  # -> Curve, Flag
series_4 = Series(Start=0, Step=Slider(7, range=0..10), Count=Slider(16, range=0..100))
flip_9 = FlipCurve(Curve=crv_26)  # -> Curve, Flag
flip_10 = FlipCurve(Curve=crv_31)  # -> Curve, Flag
flip_11 = FlipCurve(Curve=crv_30)  # -> Curve, Flag
bang = ExplodeTree(Data=crv_34)  # -> Branch0, Branch1
crv_36 = Curve(flip_2.Curve)
crv_37 = Curve(flip_3.Curve)
crv_38 = Curve(flip_4.Curve)
crv_39 = Curve(flip_5.Curve)
crv_40 = Curve(flip_6.Curve)
crv_41 = Curve(flip_7.Curve)
Z_2 = UnitZ(Factor=series_4)
crv_42 = Curve(flip_8.Curve)
bang_2 = ExplodeTree(Data=graft(crv_35))  # -> Branch0, Branch1, Branch2, Branch3
bang_3 = ExplodeTree(Data=graft(explode_4.Segments))  # -> Branch0, Branch1, Branch2, Branch3
crv_43 = Curve(flip_9.Curve)
crv_44 = Curve(flip_10.Curve)
crv_45 = Curve(flip_11.Curve)
int = Integer(Slider(1, range=0..10))
int_2 = Integer(Slider(2, range=0..10))
crv_46 = Curve(bang.Branch0)
crv_47 = Curve(bang.Branch1)
int_3 = Integer(Slider(12, range=0..100))
lng_2 = ListLength(List=Z_2)
merge_8 = Merge(
    Data1=flatten(bang_2.Branch0),
    Data2=flatten(bang_2.Branch1),
    Data3=flatten(bang_2.Branch3),
    Data4=flatten(bang_2.Branch2))  # -> flatten(Result)
dup = DuplicateData(Data=Z_2, Number=Slider(4, range=0..10), Order=True)
dup_2 = DuplicateData(Data=int_3, Number=4, Order=True)  # -> graft(Data)
divide_3 = DivideCurve(Curve=crv_47, Count=int_2, Kinks=False)  # -> Points, Tangents, Parameters
divide_4 = DivideCurve(Curve=crv_46, Count=int, Kinks=False)  # -> Points, Tangents, Parameters
entwine = Entwine(Branch00=int, Branch01=int_2, FlattenInputs=True)
pline = PolyLine(Vertices=divide_2.Points, Closed=False)
divide_5 = DivideCurve(Curve=crv_33, Count=int_3, Kinks=False)  # -> Points, Tangents, Parameters
merge_9 = Merge(
    Data1=flatten(bang_3.Branch0),
    Data2=flatten(bang_3.Branch2),
    Data3=flatten(bang_3.Branch3),
    Data4=flatten(bang_3.Branch1))  # -> flatten(Result)

crv_48 = Curve(merge_9)
crv_49 = Curve(merge_8)

item_3 = ListItem(List=crv_48, Index=Slider(2, range=0..10), Wrap=True)
divide_6 = DivideCurve(Curve=crv_48, Count=number_slider_6, Kinks=False)  # -> Points, Tangents, Parameters
divide_7 = DivideCurve(Curve=crv_49, Count=number_slider_7, Kinks=False)  # -> Points, Tangents, Parameters

pline_2 = PolyLine(Vertices=divide_6.Points, Closed=False)  # -> flatten(Polyline)
pline_3 = PolyLine(Vertices=divide_7.Points, Closed=False)  # -> flatten(Polyline)

partition_2 = PartitionList(List=dup, Size=lng_2)
move_10 = Move(Geometry=simplify(graft(divide_2.Points)), Motion=partition_2)  # -> simplify(Geometry), Transform
merge_10 = Merge(
    Data1=crv_20,
    Data2=crv_21,
    Data3=crv_22,
    Data4=crv_36,
    Data5=crv_37,
    Data6=crv_38,
    Data7=crv_11,
    Data8=crv_13,
    Data9=crv_14,
    Data10=crv_39,
    Data11=crv_17,
    Data12=crv_40,
    Data13=crv_18,
    Data14=crv_41,
    Data15=crv_19,
    Data16=crv_28,
    Data17=crv_42,
    Data18=crv_43,
    Data19=crv_44,
    Data20=crv_32,
    Data21=crv_29,
    Data22=crv_45)
pline_4 = PolyLine(Vertices=divide_4.Points, Closed=False)  # -> flatten(Polyline)
pline_5 = PolyLine(Vertices=divide_3.Points, Closed=False)  # -> flatten(Polyline)
dup_3 = DuplicateData(Data=entwine, Number=2, Order=True)  # -> simplify(flatten(Data))
pline_6 = PolyLine(Vertices=divide_5.Points, Closed=False)  # -> flatten(Polyline)
flip_12 = FlipMatrix(Data=move_10.Geometry)
number_slider_8 = Slider(0.1, range=0..0.1)
item_4 = ListItem(List=pline_3, Index=[2, 3], Wrap=True)
item_5 = ListItem(List=pline_3, Index=[0, 2], Wrap=True)
entwine_2 = Entwine(Branch00=pline_4, Branch01=pline_5, FlattenInputs=True)
partition_3 = PartitionList(List=flip_12, Size=Slider(6, range=0..10))
item_6 = ListItem(List=pline_3, Index=[1, 3], Wrap=True)
item_7 = ListItem(List=pline_3, Index=[0, 1], Wrap=True)
item_8 = ListItem(List=pline_2, Index=2, Wrap=True)
project = Project(Geometry=partition_3, Plane=PlaneXY(0, 0, 0))  # -> Geometry, Transform
bang_4 = ExplodeTree(Data=graft(item_7))  # -> Branch0, Branch1
number_slider_9 = Slider(10, range=0..10)
bang_5 = ExplodeTree(Data=graft(item_4))  # -> Branch0, Branch1
bang_6 = ExplodeTree(Data=graft(item_5))  # -> Branch0, Branch1
item_9 = ListItem(List=pline_2, Index=3, Wrap=True)
bang_7 = ExplodeTree(Data=graft(item_6))  # -> Branch0, Branch1
item_10 = ListItem(List=pline_2, Index=0, Wrap=True)
item_11 = ListItem(List=pline_2, Index=1, Wrap=True)
simplex = SimplexNoise(Values=partition_3, Time=0, Scale=Slider(0.03, range=0..1))  # -> simplify(OutputNoise)

crv_50 = Curve(flatten(pline_6))
crv_51 = Curve(entwine_2)

unit = UnitVector(Vector=project.Geometry)

swp2 = Sweep2(Rail1=bang_7.Branch0, Rail2=bang_7.Branch1, Sections=item_9, SameHeight=False)
swp2_2 = Sweep2(Rail1=bang_6.Branch0, Rail2=bang_6.Branch1, Sections=item_8, SameHeight=False)
swp2_3 = Sweep2(Rail1=bang_4.Branch0, Rail2=bang_4.Branch1, Sections=item_10, SameHeight=False)
swp2_4 = Sweep2(Rail1=bang_5.Branch0, Rail2=bang_5.Branch1, Sections=item_11, SameHeight=False)

pairing = GhPythonScript(x=crv_51, y=crv_50)  # -> out, a; inputs x: tree, y: list
# ---------- pairing: Python ----------
__author__ = "m0rya"

import rhinoscriptsyntax as rs
import ghpythonlib.treehelpers as th

result = []

for i in range(x.BranchCount):
    
    for j in range(len(x.Branch(i))):
        
        endPoints = [rs.CurveStartPoint(x.Branch(i)[j]), rs.CurveEndPoint(x.Branch(i)[j])]
        tmp = [x.Branch(i)[j]]
        
        
        for k in range(len(y)):
                        
            intersect = rs.CurveCurveIntersection(x.Branch(i)[j], y[k])
            
            if intersect != None:
                tmp.append(y[k])
                
        result.append(tmp)
        
        
a = th.list_to_tree(result, source=[0])
# ---------- end pairing ----------
bnd = Bounds(Numbers=flatten(simplex))
dom_2 = ConstructDomain(DomainStart=0, DomainEnd=Slider(20, range=0..100))
num = Number(number_slider_6)
item_12 = ListItem(List=pairing.a, Index=1, Wrap=True)
item_13 = ListItem(List=pairing.a, Index=0, Wrap=True)
num_2 = Number(number_slider_7)
item_14 = ListItem(List=pairing.a, Index=2, Wrap=True)
remap_2 = RemapNumbers(Value=simplex, Source=bnd, Target=dom_2)  # -> Mapped, Clipped
multiplication_2 = Multiplication(A=unit, B=remap_2.Mapped)  # -> simplify(Result)
addition = Addition(A=partition_3, B=multiplication_2)
num_3 = Number(number_slider_6)
num_4 = Number(number_slider_7)
pline_7 = PolyLine(Vertices=addition, Closed=False)
merge_11 = Merge(Data1=swp2_3, Data2=swp2_4, Data3=swp2_2, Data4=swp2)
num_5 = Number(number_slider_6)
num_6 = Number(number_slider_6)
sdivide = DivideSurface(Surface=swp2_3, UCount=num_2, VCount=num)  # -> Points, Normals, Parameters
num_7 = Number(number_slider_7)
num_8 = Number(number_slider_7)
panel_2 = Panel(remap_2.Mapped)
sdivide_2 = DivideSurface(Surface=swp2_4, UCount=num_4, VCount=num_3)  # -> Points, Normals, Parameters
trim = TrimTree(Tree=pline_7, Depth=1)
merge_12 = Merge(Data1=simplify(graft(dup_3)), Data2=simplify(dup_2))
sdivide_3 = DivideSurface(Surface=swp2_2, UCount=num_7, VCount=num_5)  # -> Points, Normals, Parameters
sdivide_4 = DivideSurface(Surface=swp2, UCount=num_8, VCount=num_6)  # -> Points, Normals, Parameters
swp2_5 = Sweep2(Rail1=item_12, Rail2=item_14, Sections=item_13, SameHeight=False)
item_15 = ListItem(List=merge_12, Index=0, Wrap=True)
item_16 = ListItem(List=merge_12, Index=1, Wrap=True)
item_17 = ListItem(List=trim, Index=[1, 3], Wrap=True)
pline_8 = PolyLine(Vertices=sdivide.Points, Closed=False)
pline_9 = PolyLine(Vertices=sdivide_2.Points, Closed=False)
item_18 = ListItem(List=trim, Index=2, Wrap=True)
item_19 = ListItem(List=trim, Index=0, Wrap=True)
dispatch = Dispatch(List=item_17, DispatchPattern=[True, False])  # -> ListA, ListB
pline_10 = PolyLine(Vertices=sdivide_3.Points, Closed=False)
pline_11 = PolyLine(Vertices=sdivide_4.Points, Closed=False)
sdivide_5 = DivideSurface(Surface=swp2_5, UCount=item_16, VCount=item_15)  # -> Points, Normals, Parameters
flip_13 = FlipCurve(Curve=item_19)  # -> Curve, Flag
flip_14 = FlipCurve(Curve=dispatch.ListA)  # -> Curve, Flag
pline_12 = PolyLine(Vertices=sdivide_5.Points, Closed=False)  # -> simplify(Polyline)
int_4 = Integer(int_3)
crv_52 = Curve([<curve referenced from the Rhino model> x4])
crv_53 = Curve([<curve referenced from the Rhino model> x4])
crv_54 = Curve(pline_10)
crv_55 = Curve(pline_11)
int_5 = Integer(entwine)
merge_13 = Merge(Data1=flip_14.Curve, Data2=dispatch.ListB)
python = GhPythonScript(x=pline_12, y=int_4)  # -> out, a; inputs x: tree
# ---------- python: Python ----------
__author__ = "m0rya"

import rhinoscriptsyntax as rs
import ghpythonlib.treehelpers as th

result = [[] for i in range(y+1)]


for i in range(x.BranchCount):
    
    result[i%(y+1)].append(x.Branch(i)[0])
    
    
a = th.list_to_tree(result, source=[0])
# ---------- end python ----------
swp2_6 = Sweep2(Rail1=flip_13.Curve, Rail2=item_18, Sections=merge_13, SameHeight=False)
crv_56 = Curve(<curve referenced from the Rhino model>)
bang_8 = ExplodeTree(Data=int_5)  # -> Branch0, Branch1
join = JoinCurves(Curves=crv_52, Preserve=False)
merge_14 = Merge(Data1=crv_54, Data2=crv_55)
neg_3 = Negative(Value=Slider(1, range=0..1))
crv_57 = Curve(pline_8)
crv_58 = Curve(pline_9)
item_20 = ListItem(List=python.a, Index=0, Wrap=True)
item_21 = ListItem(List=python.a, Index=1, Wrap=True)
item_22 = ListItem(List=python.a, Index=2, Wrap=True)
item_23 = ListItem(List=python.a, Index=3, Wrap=True)
offset = OffsetCurve(Curve=crv_56, Distance=neg_3, Plane=PlaneXY(0, 0, 0), Corners=1)
dispatch_2 = Dispatch(List=merge_14, DispatchPattern=[True, False])  # -> ListA, ListB
flip_15 = FlipCurve(Curve=item_21)  # -> Curve, Flag
flip_16 = FlipCurve(Curve=item_23)  # -> Curve, Flag
flip_17 = FlipCurve(Curve=crv_58)  # -> Curve, Flag
neg_4 = Negative(Value=Slider(1, range=0..1))
flip_18 = FlipCurve(Curve=dispatch_2.ListA)  # -> Curve, Flag
explode_5 = Explode(Curve=offset, Recursive=True)  # -> Segments, Vertices
merge_15 = Merge(Data1=item_20, Data2=flip_15.Curve)
len_2 = Length(Curve=explode_5.Segments)
weave = Weave(Pattern=[0, 1], Stream0=flip_18.Curve, Stream1=dispatch_2.ListB, NullGaps=False)
swp2_7 = Sweep2(Rail1=simplify(crv_57), Rail2=simplify(flip_17.Curve), Sections=simplify(weave), SameHeight=False)  # -> simplify(Brep)
num_9 = Number(number_slider_6)
int_6 = Integer(number_slider_5)
sort_2 = SortList(Keys=len_2, ValuesA=explode_5.Segments)  # -> Keys, ValuesA
swp2_8 = Sweep2(Rail1=item_22, Rail2=flip_16.Curve, Sections=merge_15, SameHeight=False)
srf = Surface(swp2_6)
num_10 = Number(num_9)
srf_2 = Surface(swp2_7)
rev_2 = ReverseList(List=sort_2.Keys)
rev_3 = ReverseList(List=sort_2.ValuesA)
number_slider_10 = Slider(3, range=0..10)
sdivide_6 = DivideSurface(Surface=simplify(swp2_8), UCount=bang_8.Branch1, VCount=bang_8.Branch0)  # -> Points, Normals, Parameters
python_2 = GhPythonScript(x=sdivide_6.Points, y=swp2_8)  # -> out, a; inputs x: tree, y: tree
# ---------- python_2: Python ----------
__author__ = "m0rya"

import rhinoscriptsyntax as rs
import ghpythonlib.treehelpers as th

srfNum = y.BranchCount

partionItr = x.BranchCount / srfNum

a = partionItr

result = []

for i in range(int(srfNum)):
    
    tmp2 = []
    for j in range(len(x.Branch(i*partionItr))):
        tmp = [x.Branch(i*partionItr+k)[j] for k in range(int(partionItr))]
        tmp2.append(tmp)
        
    result.append(tmp2)
        
        
        

a = th.list_to_tree(result, source=[0])
# ---------- end python_2 ----------
sdivide_7 = DivideSurface(Surface=simplify(srf_2), UCount=num_10, VCount=num_10)  # -> simplify(Points), Normals, Parameters
offset_2 = OffsetCurve(Curve=join, Distance=neg_4, Plane=PlaneXY(0, 0, 0), Corners=1)
item_24 = ListItem(List=rev_2, Index=[2, 3], Wrap=True)
item_25 = ListItem(List=rev_3, Index=[2, 3], Wrap=True)
item_26 = ListItem(List=sort_2.Keys, Index=-1, Wrap=True)
item_27 = ListItem(List=rev_3, Index=[0, 1], Wrap=True)
pline_13 = PolyLine(Vertices=sdivide_6.Points, Closed=False)
python_3 = GhPythonScript(x=sdivide_7.Points, y=srf_2)  # -> out, a; inputs x: tree, y: tree; same code as python_2
explode_6 = Explode(Curve=offset_2, Recursive=True)  # -> Segments, Vertices
division_3 = Division(A=item_26, B=Slider(3, range=0..10))
pline_14 = PolyLine(Vertices=python_2.a, Closed=False)
division_4 = Division(A=item_24, B=number_slider_10)
crv_59 = Curve(<curve referenced from the Rhino model>)
crv_60 = Curve(<curve referenced from the Rhino model>)
divide_8 = DivideCurve(Curve=item_27, Count=division_3, Kinks=False)  # -> Points, Tangents, Parameters
trim_2 = TrimTree(Tree=pline_14, Depth=1)  # -> simplify(Tree)
crv_61 = Curve(simplify(trim_2))
pline_15 = PolyLine(Vertices=sdivide_7.Points, Closed=False)
trim_3 = TrimTree(Tree=pline_13, Depth=1)  # -> simplify(Tree)
crv_62 = Curve(simplify(trim_3))
pline_16 = PolyLine(Vertices=python_3.a, Closed=False)
offset_3 = OffsetCurve(Curve=crv_60, Distance=neg_3, Plane=PlaneXY(0, 0, 0), Corners=1)
divide_9 = DivideCurve(Curve=item_25, Count=division_4, Kinks=False)  # -> Points, Tangents, Parameters
offset_4 = OffsetCurve(Curve=crv_59, Distance=neg_3, Plane=PlaneXY(0, 0, 0), Corners=1)
panel_3 = Panel("""[0]n_u
[1]n_v
[2]n+1_u
[3]n+1_v""")
trim_4 = TrimTree(Tree=pline_16, Depth=1)  # -> simplify(Tree)
trim_5 = TrimTree(Tree=pline_15, Depth=1)
pairing_2 = GhPythonScript(crvU=crv_62, crvV=crv_61)  # -> out, simplify(a); inputs crvU: tree, crvV: tree
# ---------- pairing_2: Python ----------
__author__ = "m0rya"

import rhinoscriptsyntax as rs
import ghpythonlib.treehelpers as th

result = []


for i in range(crvU.BranchCount-1):
    
    '''
    [0] n_u
    [1] n_v
    [2] n+1_u
    [3] n+1_v
    '''
    tmp = [[] for j in range(4)]
    
    tmp[0] = crvU.Branch(i)
    tmp[1] = crvV.Branch(i)
    tmp[2] = crvU.Branch(i+1)
    tmp[3] = crvV.Branch(i+1)
    
    
    result.append(tmp)
    
a = th.list_to_tree(result, source=[0,0])
# ---------- end pairing_2 ----------
explode_7 = Explode(Curve=offset_3, Recursive=True)  # -> Segments, Vertices
divide_10 = DivideCurve(Curve=explode_6.Segments, Count=Slider(19, range=0..100), Kinks=False)  # -> Points, Tangents, Parameters
explode_8 = Explode(Curve=offset_4, Recursive=True)  # -> Segments, Vertices
len_3 = Length(Curve=explode_7.Segments)
wiring2 = GhPythonScript(crvU=trim_5, crvV=trim_4, lh=Slider(0.4, range=0..1))  # -> out, simplify(a), debug; inputs crvU: tree, crvV: tree
# ---------- wiring2: Python ----------
__author__ = "m0rya"

import rhinoscriptsyntax as rs
import ghpythonlib.treehelpers as th

debug = []

result = []
#
    
def alt_reverse(crv):
    for itr,c in enumerate(crv):
            if itr%2 == 0:
                continue
            else:
                rs.ReverseCurve(c)
                
maxAngle = 0
                
for i in range(crvU.BranchCount):               
#for i in range(2):
    
    
    #first layer
    if i == 0:
        
        tmp = []
        
        shell = []
        shell.append(crvU.Branch(0)[0])
        shell.append(crvU.Branch(0)[len(crvU.Branch(0))-1])
        
        shell.append(crvV.Branch(0)[0])
        shell.append(crvV.Branch(0)[len(crvU.Branch(0))-1])
        
        shell = rs.JoinCurves(shell)
        
        uLines = crvU.Branch(0)[1:len(crvU.Branch(0))-1]
        uLines = rs.CopyObjects(uLines)
        alt_reverse(uLines)
        
        vLines = crvV.Branch(0)[1:len(crvV.Branch(0))-1]
        vLines = rs.CopyObjects(vLines)
        alt_reverse(vLines)
                
        tmp.extend(shell)
        tmp.extend(uLines)
        tmp.extend(vLines)
        
        result.append(tmp)
        
    
    
    
    #not first layer
    else:
        
        layer_path = []
        
        
        #first zigzag
        zigzag = rs.CopyObjects(crvU.Branch(i-1))
        zigzag2 = rs.CopyObjects(crvU.Branch(i))
        
        zigzag1a, zigzag1b, zigzag2a, zigzag2b = [], [], [], []
        for j in range(len(zigzag)):
            
            if j%2 == 0:
                zigzag1a.append(zigzag[j])
                zigzag2a.append(zigzag2[j])
            else:
                zigzag1b.append(zigzag[j])
                zigzag2b.append(zigzag2[j])
                
     
        
        zigzagResult = []
        for j in range(len(zigzag1a)):
            
            editPnts = rs.CurveEditPoints(zigzag1a[j])
            editPnts2 = rs.CurveEditPoints(zigzag2a[j])
            
            #ここでeditPnts2をeditPnts側に2*lhだけよせる
            for k in range(len(editPnts)):
                tmpVec = rs.VectorCreate(editPnts2[k], editPnts[k])
                tmpVec = rs.VectorScale(tmpVec, (rs.VectorLength(tmpVec)-2*lh)/rs.VectorLength(tmpVec))
                editPnts2[k] = rs.VectorAdd(editPnts[k],tmpVec)
            
            
            tmp = []
            for k in range(len(editPnts)-1):
                
                tmp.append(rs.AddLine(editPnts[k], editPnts2[k]))
                tmp.append(rs.AddLine(editPnts2[k], editPnts[k+1]))
                
                vecA = rs.VectorCreate(editPnts2[k], editPnts[k+1])
                vecB = rs.VectorCreate((editPnts2[k][0], editPnts2[k][1], editPnts[k+1][2]), editPnts[k+1])
                angle = rs.VectorAngle(vecA,vecB)
                
                if maxAngle < angle:
                    maxAngle = angle
                
            else:
                tmp.append(rs.AddLine(editPnts[k+1], editPnts2[k+1]))
                
                for l in range(len(editPnts)-1):
                    tmp.append(rs.AddLine(editPnts2[len(editPnts)-1-l], editPnts2[len(editPnts)-1-l-1]))
                
            zigzagResult.extend(tmp)
            
        layer_path.extend(zigzagResult)
        
        
                
        
        #vvv line
        vvv = rs.CopyObjects(crvV.Branch(i-1))
        vvv2 = rs.CopyObjects(crvV.Branch(i))
        
        
        for j in range(len(vvv)):
            
            editPnts = rs.CurveEditPoints(vvv[j])
            editPnts2 = rs.CurveEditPoints(vvv2[j])
            #ここでeditPnts2をeditPntsの向きに1*lhだけよせる
            
            for k in range(len(editPnts)):
                tmpVec = rs.VectorCreate(editPnts2[k], editPnts[k])
                tmpVec = rs.VectorScale(tmpVec, (rs.VectorLength(tmpVec)-lh)/rs.VectorLength(tmpVec))
                editPnts2[k] = rs.VectorAdd(editPnts[k],tmpVec)
            
            
            tmp = []
            for k in range(len(editPnts)-1):
                if k%2 == 0:
                    tmp.append(rs.AddLine(editPnts2[k], editPnts[k+1]))
                else:
                    tmp.append(rs.AddLine(editPnts[k], editPnts2[k+1]))
                    
            #debug.append(tmp)
            layer_path.extend(tmp)
               
               
        
        #second zigzag
        
        zigzagResult2 = []
        for j in range(len(zigzag1b)):
            
            editPnts = rs.CurveEditPoints(zigzag1b[j])
            editPnts2 = rs.CurveEditPoints(zigzag2b[j])
            #ここでeditPnts2をeditPntsの向きに1*lhだけよせる
            for k in range(len(editPnts)):
                tmpVec = rs.VectorCreate(editPnts2[k], editPnts[k])
                tmpVec = rs.VectorScale(tmpVec, (rs.VectorLength(tmpVec)-lh)/rs.VectorLength(tmpVec))
                editPnts2[k] = rs.VectorAdd(editPnts[k],tmpVec)
            
            tmp = []
            for k in range(len(editPnts)-1):
                
                tmp.append(rs.AddLine(editPnts[k], editPnts2[k]))
                tmp.append(rs.AddLine(editPnts2[k], editPnts[k+1]))
            else:
                tmp.append(rs.AddLine(editPnts[k+1], editPnts2[k+1]))
                
                for l in range(len(editPnts)-1):
                    tmp.append(rs.AddLine(editPnts2[len(editPnts)-1-l], editPnts2[len(editPnts)-1-l-1]))
                
            zigzagResult2.extend(tmp)
            
        layer_path.extend(zigzagResult2)
        
        
        
        
        #flat vertical line
        flatV = rs.CopyObjects(crvV.Branch(i))
        alt_reverse(flatV)
        exploded = rs.ExplodeCurves(flatV)
        
        #debug.extend(exploded)
        layer_path.extend(exploded)
        
        
        result.append(layer_path)
        
    
print(maxAngle)

        
debug = th.list_to_tree(debug, source=[0,0])
a = th.list_to_tree(result, source = [0,0])
# ---------- end wiring2 ----------
python_4 = GhPythonScript(crvU=trim_5, crvV=trim_4)  # -> out, simplify(a), debug; inputs crvU: tree, crvV: tree
# ---------- python_4: Python ----------
__author__ = "m0rya"

import rhinoscriptsyntax as rs
import ghpythonlib.treehelpers as th

debug = []

result = []
#
    
def alt_reverse(crv):
    for itr,c in enumerate(crv):
            if itr%2 == 0:
                continue
            else:
                rs.ReverseCurve(c)
                
maxAngle = 0
                
for i in range(crvU.BranchCount):               
#for i in range(2):
    
    
    #first layer
    if i == 0:
        
        tmp = []
        
        shell = []
        shell.append(crvU.Branch(0)[0])
        shell.append(crvU.Branch(0)[len(crvU.Branch(0))-1])
        
        shell.append(crvV.Branch(0)[0])
        shell.append(crvV.Branch(0)[len(crvU.Branch(0))-1])
        
        shell = rs.JoinCurves(shell)
        
        uLines = crvU.Branch(0)[1:len(crvU.Branch(0))-1]
        uLines = rs.CopyObjects(uLines)
        alt_reverse(uLines)
        
        vLines = crvV.Branch(0)[1:len(crvV.Branch(0))-1]
        vLines = rs.CopyObjects(vLines)
        alt_reverse(vLines)
                
        tmp.extend(shell)
        tmp.extend(uLines)
        tmp.extend(vLines)
        
        result.append(tmp)
        
        #debug.extend(tmp)
    
    
    
    #not first layer
    else:
        
        layer_path = []
        
        #2n zigzag
        zigzag = rs.CopyObjects(crvU.Branch(i-1))
        zigzag2 = rs.CopyObjects(crvU.Branch(i))
        
        zigzag1a, zigzag1b, zigzag2a, zigzag2b = [], [], [], []
        for j in range(len(zigzag)):
            
            if j%2 == 0:
                zigzag1a.append(zigzag[j])
                zigzag2a.append(zigzag2[j])
            else:
                zigzag1b.append(zigzag[j])
                zigzag2b.append(zigzag2[j])
                
     
        
        
        zigzagResult = []
        for j in range(len(zigzag1a)):
            
            editPnts = rs.CurveEditPoints(zigzag1a[j])
            editPnts2 = rs.CurveEditPoints(zigzag2a[j])
            
            tmp = []
            for k in range(len(editPnts)-1):
                
                tmp.append(rs.AddLine(editPnts[k], editPnts2[k]))
                tmp.append(rs.AddLine(editPnts2[k], editPnts[k+1]))
                
                vecA = rs.VectorCreate(editPnts2[k], editPnts[k+1])
                vecB = rs.VectorCreate((editPnts2[k][0], editPnts2[k][1], editPnts[k+1][2]), editPnts[k+1])
                angle = rs.VectorAngle(vecA,vecB)
                
                if maxAngle < angle:
                    maxAngle = angle
                
            else:
                tmp.append(rs.AddLine(editPnts[k+1], editPnts2[k+1]))
                
                for l in range(len(editPnts)-1):
                    tmp.append(rs.AddLine(editPnts2[len(editPnts)-1-l], editPnts2[len(editPnts)-1-l-1]))
                
            zigzagResult.extend(tmp)
            
        #debug.extend(zigzagResult)
        layer_path.extend(zigzagResult)
        
        
                
        
        #vvv line
        
        vvv = rs.CopyObjects(crvV.Branch(i-1))
        vvv2 = rs.CopyObjects(crvV.Branch(i))
        
        
        
        for j in range(len(vvv)):
            
            editPnts = rs.CurveEditPoints(vvv[j])
            editPnts2 = rs.CurveEditPoints(vvv2[j])
            
            tmp = []
            for k in range(len(editPnts)-1):
                if k%2 == 0:
                    tmp.append(rs.AddLine(editPnts2[k], editPnts[k+1]))
                else:
                    tmp.append(rs.AddLine(editPnts[k], editPnts2[k+1]))
                    
            #debug.append(tmp)
            layer_path.extend(tmp)
                
        
        #2n+1 zigzag
        
        zigzagResult2 = []
        for j in range(len(zigzag1b)):
            
            editPnts = rs.CurveEditPoints(zigzag1b[j])
            editPnts2 = rs.CurveEditPoints(zigzag2b[j])
            
            tmp = []
            for k in range(len(editPnts)-1):
                
                tmp.append(rs.AddLine(editPnts[k], editPnts2[k]))
                tmp.append(rs.AddLine(editPnts2[k], editPnts[k+1]))
            else:
                tmp.append(rs.AddLine(editPnts[k+1], editPnts2[k+1]))
                
                for l in range(len(editPnts)-1):
                    tmp.append(rs.AddLine(editPnts2[len(editPnts)-1-l], editPnts2[len(editPnts)-1-l-1]))
                
            zigzagResult2.extend(tmp)
            
        #debug.append(zigzagResult2)
        layer_path.extend(zigzagResult2)
        
        
        
        
        #flat v line
        
        flatV = rs.CopyObjects(crvV.Branch(i))
        alt_reverse(flatV)
        exploded = rs.ExplodeCurves(flatV)
        
        #debug.extend(exploded)
        layer_path.extend(exploded)
        
        
        result.append(layer_path)
        
    
print(maxAngle)

        
debug = th.list_to_tree(debug, source=[0,0])
a = th.list_to_tree(result, source = [0,0])
# ---------- end python_4 ----------
len_4 = Length(Curve=explode_8.Segments)
number_slider_11 = Slider(0.4, range=0..1)
number_slider_12 = Slider(24, range=0..100)
subdivision = GhPythonScript(crvUV=pairing_2.a, threshold=number_slider_12)  # -> out, a, debug; inputs crvUV: tree; disabled
# ---------- subdivision: Python ----------
__author__ = "m0rya"

import rhinoscriptsyntax as rs
import ghpythonlib.treehelpers as th

result = []
debug = []

for i in range(int(crvUV.BranchCount/4)):
    
    n_u = crvUV.Branch(4*i)
    n_v = crvUV.Branch(4*i+1)
    n1_u = crvUV.Branch(4*i+2)
    n1_v = crvUV.Branch(4*i+3)
    
    editP_n_u = [rs.CurveEditPoints(crv) for crv in n_u]
    editP_n_v = [rs.CurveEditPoints(crv) for crv in n_v]
    editP_n1_u = [rs.CurveEditPoints(crv) for crv in n1_u]
    editP_n1_v = [rs.CurveEditPoints(crv) for crv in n1_v]
        
    
    #Adjusting for CrvV
    
    new_n_u = [n_u[0]]
    #new_n_v = [n_v[0]]
    
    new_n1_u = [n1_u[0]]
    #new_n1_v = [n1_v[0]]
    
    
    tmpVpnts = [[p[0]] for p in editP_n_v]
    tmpVpnts2 = [[p[0]] for p in editP_n1_v]
    
    
    for j in range(len(n_u)-1):
        
        tmpUpnts = []
        tmpUpnts2 = []
                
        
        for k in range(len(n_v)-1):
            
            #check angle
            pnt1 = editP_n_v[k][j]
            pnt2 = editP_n1_v[k][j+1]
            pnt3 = editP_n_v[k][j+1]
            
            vec1 = rs.VectorCreate(pnt2, pnt1)
            vec2 = rs.VectorCreate(pnt3, pnt1)
            
            angle = rs.VectorAngle(vec1, vec2)
        
            
            #create points for new crv
            if angle < threshold:
                
                if len(tmpUpnts) == 0:
                    tmpUpnts.append((pnt1+pnt3)/2)
                    tmpUpnts2.append((editP_n1_v[k][j]+editP_n1_v[k][j+1])/2)
                    
                tmpUpnts.append((editP_n_v[k+1][j] + editP_n_v[k+1][j+1])/2)
                tmpUpnts2.append((editP_n1_v[k+1][j] + editP_n1_v[k+1][j+1])/2)
                
                
                tmpVpnts[k].append((editP_n_v[k][j] + editP_n_v[k][j+1])/2)
                tmpVpnts2[k].append((editP_n1_v[k][j] + editP_n1_v[k][j+1])/2)
                
                if k == len(n_v)-2:
                    tmpVpnts[k+1].append((editP_n_v[k+1][j] + editP_n_v[k+1][j+1])/2)
                    tmpVpnts2[k+1].append((editP_n1_v[k+1][j] + editP_n1_v[k+1][j+1])/2)
                    
                
                
            
            tmpVpnts[k].append(editP_n_v[k][j+1])
            tmpVpnts2[k].append(editP_n1_v[k][j+1])
            
            if k == len(n_v)-2:
                
                tmpVpnts[k+1].append(editP_n_v[k+1][j+1])
                tmpVpnts2[k+1].append(editP_n1_v[k+1][j+1])
            

        if len(tmpUpnts) != 0:
                
            newUcrv = rs.AddPolyline(tmpUpnts)
            newUcrv2 = rs.AddPolyline(tmpUpnts2)
           
            new_n_u.append(newUcrv)
            new_n1_u.append(newUcrv2)
            
        new_n_u.append(n_u[j+1])
        new_n1_u.append(n1_u[j+1])
        
        
    #build v crvs    
    new_n_v = [rs.AddPolyline(ps) for ps in tmpVpnts]
    new_n1_v = [rs.AddPolyline(ps) for ps in tmpVpnts2]
    
    result.append([new_n_u, new_n_v, new_n1_u, new_n1_v])
    
        
            
    
      
a = th.list_to_tree(result, source=[0,0])
                
debug = th.list_to_tree(debug, source=[0])
# ---------- end subdivision ----------
division_5 = Division(A=len_3, B=number_slider_10)
division_6 = Division(A=len_4, B=number_slider_10)
subdivision2 = GhPythonScript(crvUV=pairing_2.a, threshold=Slider(17, range=1..30))  # -> out, a, debug; inputs crvUV: tree
# ---------- subdivision2: Python ----------
__author__ = "m0rya"

import rhinoscriptsyntax as rs
import ghpythonlib.treehelpers as th

result = []
debug = []

tgl = True


while tgl:
    
    tgl = False
    
    past_result = list(result)
    result = []
    
    for i in range(int(crvUV.BranchCount/4)):
        
        if len(past_result) == 0:
            n_u = crvUV.Branch(4*i)
            n_v = crvUV.Branch(4*i+1)
            n1_u = crvUV.Branch(4*i+2)
            n1_v = crvUV.Branch(4*i+3)
        else:
            
            n_u = past_result[i][0]
            n_v = past_result[i][1]
            n1_u = past_result[i][2]
            n1_v = past_result[i][3]
            
    
        editP_n_u = [rs.CurveEditPoints(crv) for crv in n_u]
        editP_n_v = [rs.CurveEditPoints(crv) for crv in n_v]
        editP_n1_u = [rs.CurveEditPoints(crv) for crv in n1_u]
        editP_n1_v = [rs.CurveEditPoints(crv) for crv in n1_v]
        
    
        #Adjusting for CrvV
        new_n_u = [n_u[0]]
        new_n1_u = [n1_u[0]]
    
    
        tmpVpnts = [[p[0]] for p in editP_n_v]
        tmpVpnts2 = [[p[0]] for p in editP_n1_v]
    
    
        for j in range(len(n_u)-1):
        
            tmpUpnts = []
            tmpUpnts2 = []
                
        
            for k in range(len(n_v)-1):
            
                #check angle
                pnt1 = editP_n_v[k][j]
                
                pnt2 = editP_n1_v[k][j+1]
                pnt3 = editP_n_v[k][j+1]
            
                vec1 = rs.VectorCreate(pnt2, pnt1)
                vec2 = rs.VectorCreate(pnt3, pnt1)
            
                angle = rs.VectorAngle(vec1, vec2)
        
            
                #create points for new crv
                if angle < threshold:
                    
                    if not tgl:
                        print(angle)
                    
                    tgl = True
                
                    if len(tmpUpnts) == 0:
                        tmpUpnts.append((pnt1+pnt3)/2)
                        tmpUpnts2.append((editP_n1_v[k][j]+editP_n1_v[k][j+1])/2)
                    
                    tmpUpnts.append((editP_n_v[k+1][j] + editP_n_v[k+1][j+1])/2)
                    tmpUpnts2.append((editP_n1_v[k+1][j] + editP_n1_v[k+1][j+1])/2)
                
                
                    tmpVpnts[k].append((editP_n_v[k][j] + editP_n_v[k][j+1])/2)
                    tmpVpnts2[k].append((editP_n1_v[k][j] + editP_n1_v[k][j+1])/2)
                    
                    if k == len(n_v)-2:
                        tmpVpnts[k+1].append((editP_n_v[k+1][j] + editP_n_v[k+1][j+1])/2)
                        tmpVpnts2[k+1].append((editP_n1_v[k+1][j] + editP_n1_v[k+1][j+1])/2)
                    
                
                
            
                tmpVpnts[k].append(editP_n_v[k][j+1])
                tmpVpnts2[k].append(editP_n1_v[k][j+1])
            
                if k == len(n_v)-2:
                
                    tmpVpnts[k+1].append(editP_n_v[k+1][j+1])
                    tmpVpnts2[k+1].append(editP_n1_v[k+1][j+1])
            

            if len(tmpUpnts) != 0:
                
                newUcrv = rs.AddPolyline(tmpUpnts)
                newUcrv2 = rs.AddPolyline(tmpUpnts2)
            
                new_n_u.append(newUcrv)
                new_n1_u.append(newUcrv2)
            
            new_n_u.append(n_u[j+1])
            new_n1_u.append(n1_u[j+1])
        
        
        #build v crvs    
        new_n_v = [rs.AddPolyline(ps) for ps in tmpVpnts]
        new_n1_v = [rs.AddPolyline(ps) for ps in tmpVpnts2]
    
        result.append([new_n_u, new_n_v, new_n1_u, new_n1_v])
    tgl = False
        
            
    
      
a = th.list_to_tree(result, source=[0,0])
                
debug = th.list_to_tree(debug, source=[0])
# ---------- end subdivision2 ----------
divide_11 = DivideCurve(Curve=explode_7.Segments, Count=division_5, Kinks=False)  # -> Points, Tangents, Parameters
cir_2 = Circle(Plane=divide_10.Points, Radius=Slider(0.2, range=0..1))
crv_63 = Curve(wiring2.a)
brec = BoundingRectangle(Geometry=flatten(crv_63), Plane=PlaneXY(0, 0, 0), Axis=0, Slide=0, Union=True)
divide_12 = DivideCurve(Curve=explode_8.Segments, Count=division_6, Kinks=False)  # -> Points, Tangents, Parameters
wiring3 = GhPythonScript(crvV=trim_2, lh=number_slider_11)  # -> out, simplify(a), debug; inputs crvU: tree, crvV: tree
# ---------- wiring3: Python ----------
__author__ = "m0rya"

import rhinoscriptsyntax as rs
import ghpythonlib.treehelpers as th

debug = []

result = []
#
    
def alt_reverse(crv):
    for itr,c in enumerate(crv):
            if itr%2 == 0:
                continue
            else:
                rs.ReverseCurve(c)
                
maxAngle = 0
                
for i in range(crvU.BranchCount):               
#for i in range(2):
    
    
    #first layer
    if i == 0:
        
        tmp = []
        
        shell = []
        shell.append(crvU.Branch(0)[0])
        shell.append(crvU.Branch(0)[len(crvU.Branch(0))-1])
        
        shell.append(crvV.Branch(0)[0])
        shell.append(crvV.Branch(0)[len(crvV.Branch(0))-1])
        
        shell = rs.JoinCurves(shell)
        
        uLines = crvU.Branch(0)[1:len(crvU.Branch(0))-1]
        uLines = rs.CopyObjects(uLines)
        alt_reverse(uLines)
        
        vLines = crvV.Branch(0)[1:len(crvV.Branch(0))-1]
        vLines = rs.CopyObjects(vLines)
        alt_reverse(vLines)
                
        tmp.extend(shell)
        tmp.extend(uLines)
        tmp.extend(vLines)
        
        result.append(tmp)
        
    
    
    
    #not first layer
    else:
        
        layer_path = []
        
        
        #first zigzag
        zigzag = rs.CopyObjects(crvU.Branch(i-1))
        zigzag2 = rs.CopyObjects(crvU.Branch(i))
        
        zigzag1a, zigzag1b, zigzag2a, zigzag2b = [], [], [], []
        for j in range(len(zigzag)):
            
            if j%2 == 0:
                zigzag1a.append(zigzag[j])
                zigzag2a.append(zigzag2[j])
            else:
                zigzag1b.append(zigzag[j])
                zigzag2b.append(zigzag2[j])
                
     
        
        zigzagResult = []
        for j in range(len(zigzag1a)):
            
            editPnts = rs.CurveEditPoints(zigzag1a[j])
            editPnts2 = rs.CurveEditPoints(zigzag2a[j])
            
            #ここでeditPnts2をeditPnts側に2*lhだけよせる
            for k in range(len(editPnts)):
                tmpVec = rs.VectorCreate(editPnts2[k], editPnts[k])
                tmpVec = rs.VectorScale(tmpVec, (rs.VectorLength(tmpVec)-2*lh)/rs.VectorLength(tmpVec))
                editPnts2[k] = rs.VectorAdd(editPnts[k],tmpVec)
            
            
            tmp = []
            for k in range(len(editPnts)-1):
                
                tmp.append(rs.AddLine(editPnts[k], editPnts2[k]))
                tmp.append(rs.AddLine(editPnts2[k], editPnts[k+1]))
                
                vecA = rs.VectorCreate(editPnts2[k], editPnts[k+1])
                vecB = rs.VectorCreate((editPnts2[k][0], editPnts2[k][1], editPnts[k+1][2]), editPnts[k+1])
                angle = rs.VectorAngle(vecA,vecB)
                
                if maxAngle < angle:
                    maxAngle = angle
                
            else:
                tmp.append(rs.AddLine(editPnts[k+1], editPnts2[k+1]))
                
                for l in range(len(editPnts)-1):
                    tmp.append(rs.AddLine(editPnts2[len(editPnts)-1-l], editPnts2[len(editPnts)-1-l-1]))
                
            zigzagResult.extend(tmp)
            
        layer_path.extend(zigzagResult)
        
        
                
        
        #vvv line
        vvv = rs.CopyObjects(crvV.Branch(i-1))
        vvv2 = rs.CopyObjects(crvV.Branch(i))
        
        
        for j in range(len(vvv)):
            
            editPnts = rs.CurveEditPoints(vvv[j])
            editPnts2 = rs.CurveEditPoints(vvv2[j])
            #ここでeditPnts2をeditPntsの向きに1*lhだけよせる
            
            for k in range(len(editPnts)):
                tmpVec = rs.VectorCreate(editPnts2[k], editPnts[k])
                tmpVec = rs.VectorScale(tmpVec, (rs.VectorLength(tmpVec)-lh)/rs.VectorLength(tmpVec))
                editPnts2[k] = rs.VectorAdd(editPnts[k],tmpVec)
            
            
            tmp = []
            for k in range(len(editPnts)-1):
                if k%2 == 0:
                    tmp.append(rs.AddLine(editPnts2[k], editPnts[k+1]))
                else:
                    tmp.append(rs.AddLine(editPnts[k], editPnts2[k+1]))
                    
            #debug.append(tmp)
            layer_path.extend(tmp)
               
               
        
        #second zigzag
        
        zigzagResult2 = []
        for j in range(len(zigzag1b)):
            
            editPnts = rs.CurveEditPoints(zigzag1b[j])
            editPnts2 = rs.CurveEditPoints(zigzag2b[j])
            #ここでeditPnts2をeditPntsの向きに1*lhだけよせる
            for k in range(len(editPnts)):
                tmpVec = rs.VectorCreate(editPnts2[k], editPnts[k])
                tmpVec = rs.VectorScale(tmpVec, (rs.VectorLength(tmpVec)-lh)/rs.VectorLength(tmpVec))
                editPnts2[k] = rs.VectorAdd(editPnts[k],tmpVec)
            
            tmp = []
            for k in range(len(editPnts)-1):
                
                tmp.append(rs.AddLine(editPnts[k], editPnts2[k]))
                tmp.append(rs.AddLine(editPnts2[k], editPnts[k+1]))
            else:
                tmp.append(rs.AddLine(editPnts[k+1], editPnts2[k+1]))
                
                for l in range(len(editPnts)-1):
                    tmp.append(rs.AddLine(editPnts2[len(editPnts)-1-l], editPnts2[len(editPnts)-1-l-1]))
                
            zigzagResult2.extend(tmp)
            
        layer_path.extend(zigzagResult2)
        
        
        
        
        #flat vertical line
        flatV = rs.CopyObjects(crvV.Branch(i))
        alt_reverse(flatV)
        exploded = rs.ExplodeCurves(flatV)
        
        #debug.extend(exploded)
        layer_path.extend(exploded)
        
        
        result.append(layer_path)
        
    
print(maxAngle)

        
debug = th.list_to_tree(debug, source=[0,0])
a = th.list_to_tree(result, source = [0,0])
# ---------- end wiring3 ----------
num_11 = Number(Slider(1, range=0..1))
subdivision_2 = GhPythonScript(crvUV=subdivision.a, threshold=number_slider_12)  # -> out, a, debug; inputs crvUV: tree; disabled; same code as subdivision
number_slider_13 = Slider(1, range=0..1)
number_slider_14 = Slider(85, range=0..10000)
number_slider_15 = Slider(1000, range=0..1000)
offset_5 = OffsetCurve(Curve=brec, Distance=Slider(5, range=0..10), Plane=PlaneXY(0, 0, 0), Corners=1)
crv_64 = Curve(simplify(subdivision2.a))
area_4 = Area(Geometry=brec)  # -> Area, Centroid
panel_4 = Panel(wiring2.out)
panel_5 = Panel(subdivision.out)
wiring6_onepath = GhPythonScript(crvUV=crv_64, lh=number_slider_11)  # -> out, a, debug; inputs crvUV: tree
# ---------- wiring6_onepath: Python ----------
__author__ = "m0rya"

import rhinoscriptsyntax as rs
import ghpythonlib.treehelpers as th

result = []
debug = []

'''
crv_n_u
crv_n_v
crv_n1_u
crv_n1_v
'''

def alt_reverse(crv):
    for itr,c in enumerate(crv):
            if itr%2 == 0:
                continue
            else:
                rs.ReverseCurve(c)
                
def bridge(crv1, crv2):
    
    end = rs.CurveEndPoint(crv1)
    
    endPnts = [rs.CurveStartPoint(crv2), rs.CurveEndPoint(crv2)]
    dists = [rs.Distance(end, p) for p in endPnts]
    
    
    if dists[0] < dists[1]:
        start = endPnts[0]
    else:
        start = endPnts[1]
        
    bridgeLine = rs.AddLine(end, start)
    dir = rs.VectorCreate(start, end)
    dir = rs.VectorRotate(dir, 90, (0,0,1))
    
    return rs.OffsetCurve(bridgeLine, dir, 1.0)
    
def bridge2(crv1, crv2):
    
    end = rs.CurveEndPoint(crv1)
    
    endPnts = [rs.CurveStartPoint(crv2), rs.CurveEndPoint(crv2)]
    dists = [rs.Distance(end, p) for p in endPnts]
    
    
    if dists[0] < dists[1]:
        tgl = True
    else:
        tgl = False
    
    start = endPnts[0]
    bridgeLine = rs.AddLine(end, start)
    dir = rs.VectorCreate(start, end)
    dir = rs.VectorRotate(dir, 90, (0,0,1))
    
    if tgl:
        return rs.OffsetCurve(bridgeLine, dir, 1.0)
    else:
        return bridgeLine
    

for i in range(int(crvUV.BranchCount/4)):
    
    
    crv_n_u = crvUV.Branch(4*i)
    
    crv_n_v = crvUV.Branch(4*i+1)
    crv_n1_u = crvUV.Branch(4*i+2)
    crv_n1_v = crvUV.Branch(4*i+3)
    
    #first layer
    
    if i == 0:
        
        first_layer = []
        
        #shell
        shell = []
        shell.append(crv_n_u[0])
        shell.append(crv_n_u[len(crv_n_u)-1])
        shell.append(crv_n_v[0])
        shell.append(crv_n_v[len(crv_n_v)-1])
        
        shell = rs.JoinCurves(shell)
        
        #infill
        infill1 = rs.CopyObjects(crv_n_u[1:len(crv_n_u)-1])
        alt_reverse(infill1)
        
        #BRIDGE : shell to infill1
        bridge1 = bridge2(shell,infill1[0])
       
        
        
        #BRIDGE : within infill1 
        #latter
        
        #BRIDGE : infill1 to infill2
        
        #BRIDGE : within infill2
        
        infill2 = rs.CopyObjects(crv_n_v[1:len(crv_n_v)-1])
        alt_reverse(infill2)
        
        first_layer.extend(shell)
        first_layer.append(bridge1)
        first_layer.extend(infill1)
        first_layer.extend(infill2)
        
        #first_layer.extend(bridge(first_layer[-1], first_layer[0]))
        
        result.append(first_layer)
        
    
 
        
    layer_path = []
        
        
    #prepare for zigzag
    zigzag = rs.CopyObjects(crv_n_u)
    zigzag2 = rs.CopyObjects(crv_n1_u)
        
    zigzag1a = zigzag
    zigzag2a = zigzag2

    '''
    zigzag1a, zigzag1b, zigzag2a, zigzag2b = [], [], [], []
    for j in range(len(zigzag)):
            
        if j%2 == 0:
            zigzag1a.append(zigzag[j])
            zigzag2a.append(zigzag2[j])
        else:
            zigzag1b.append(zigzag[j])
            zigzag2b.append(zigzag2[j])
    '''
    #first zigzag
    zigzagResult = []
    
    if i%2 == 1:
        zigzag1a.reverse()
        zigzag2a.reverse()
        
    for j in range(len(zigzag1a)):
        
        editPnts = rs.CurveEditPoints(zigzag1a[j])
        editPnts2 = rs.CurveEditPoints(zigzag2a[j])
        
        if i == 0 and j == 0:
          
            
            zigzagResult.append(rs.AddLine(rs.CurveEndPoint(infill1[0]), editPnts[0]))
            
        #ここでeditPnts2をeditPnts側に2*lhだけよせる
        for k in range(len(editPnts)):
            tmpVec = rs.VectorCreate(editPnts2[k], editPnts[k])
            tmpVec = rs.VectorScale(tmpVec, (rs.VectorLength(tmpVec)-2*lh)/rs.VectorLength(tmpVec))
            editPnts2[k] = rs.VectorAdd(editPnts[k],tmpVec)
            
            
        tmp = []
        for k in range(len(editPnts)-1):
                
            tmp.append(rs.AddLine(editPnts[k], editPnts2[k]))
            tmp.append(rs.AddLine(editPnts2[k], editPnts[k+1]))
                

                
        else:
            tmp.append(rs.AddLine(editPnts[k+1], editPnts2[k+1]))
                
            for l in range(len(editPnts)-1):
                tmp.append(rs.AddLine(editPnts2[len(editPnts)-1-l], editPnts2[len(editPnts)-1-l-1]))
                
            
            
            
            if j is not len(zigzag1a)-1:
                #debug.append(editPnts[0])
               
                bridgeLine = rs.AddLine(rs.CurveStartPoint(zigzag2a[j]), rs.CurveStartPoint(zigzag1a[j+1]))
                tmp.append(bridgeLine)
                #debug.append(bridgeLine)
                
        zigzagResult.extend(tmp)
    
    layer_path.extend(zigzagResult)
        
        
    '''
    #vvv line
    vvv = rs.CopyObjects(crv_n_v)
    vvv2 = rs.CopyObjects(crv_n1_v)
        
        
    for j in range(len(vvv)):
            
        editPnts = rs.CurveEditPoints(vvv[j])
        editPnts2 = rs.CurveEditPoints(vvv2[j])
        #ここでeditPnts2をeditPntsの向きに1*lhだけよせる
            
        for k in range(len(editPnts)):
            tmpVec = rs.VectorCreate(editPnts2[k], editPnts[k])
            tmpVec = rs.VectorScale(tmpVec, (rs.VectorLength(tmpVec)-lh)/rs.VectorLength(tmpVec))
            editPnts2[k] = rs.VectorAdd(editPnts[k],tmpVec)
            
            
        tmp = []
        for k in range(len(editPnts)-1):
            if k%2 == 0:
                tmp.append(rs.AddLine(editPnts2[k], editPnts[k+1]))
            else:
                tmp.append(rs.AddLine(editPnts[k], editPnts2[k+1]))
                    
        #debug.append(tmp)
        layer_path.extend(tmp)
    '''
    
    '''
    #second zigzag
    zigzagResult2 = []
    for j in range(len(zigzag1b)):
            
        editPnts = rs.CurveEditPoints(zigzag1b[j])
        editPnts2 = rs.CurveEditPoints(zigzag2b[j])
        #ここでeditPnts2をeditPntsの向きに1*lhだけよせる
        for k in range(len(editPnts)):
            tmpVec = rs.VectorCreate(editPnts2[k], editPnts[k])
            tmpVec = rs.VectorScale(tmpVec, (rs.VectorLength(tmpVec)-lh)/rs.VectorLength(tmpVec))
            editPnts2[k] = rs.VectorAdd(editPnts[k],tmpVec)
            
        tmp = []
        for k in range(len(editPnts)-1):
                
            tmp.append(rs.AddLine(editPnts[k], editPnts2[k]))
            tmp.append(rs.AddLine(editPnts2[k], editPnts[k+1]))
        else:
            tmp.append(rs.AddLine(editPnts[k+1], editPnts2[k+1]))
                
            for l in range(len(editPnts)-1):
                tmp.append(rs.AddLine(editPnts2[len(editPnts)-1-l], editPnts2[len(editPnts)-1-l-1]))
                
        zigzagResult2.extend(tmp)
            
    layer_path.extend(zigzagResult2)
    '''
        
    #flat vertical line
    
    if i%2 == 0:
        flatV = list(crv_n1_v)
        flatV2 = []
        for c in flatV:
            tmpEditPnts = rs.CurveEditPoints(c)
            tmpEditPnts.reverse()
            flatV2.append(rs.AddPolyline(tmpEditPnts))
        
        alt_reverse(flatV2)
        debug.append(flatV2)
    
        bridge = rs.AddLine(rs.CurveEndPoint(flatV2[0]), rs.CurveStartPoint(flatV2[1]))
        bridge2 = rs.AddLine(rs.CurveEndPoint(flatV2[1]), rs.CurveStartPoint(flatV2[0]))
        flatV2.insert(1, bridge)
    
        flatV2 = rs.JoinCurves(flatV2)
        exploded = rs.ExplodeCurves(flatV2)
        
        layer_path.extend(exploded)
        layer_path.append(bridge2)
    else:
        flatV = list(crv_n1_v)
        flatV2 = []
        
        alt_reverse(flatV)
        
        bridge = rs.AddLine(rs.CurveEndPoint(flatV[0]), rs.CurveStartPoint(flatV[1]))
        bridge2 = rs.AddLine(rs.CurveEndPoint(flatV[1]), rs.CurveStartPoint(flatV[0]))
        flatV.insert(1, bridge)
    
        flatV = rs.JoinCurves(flatV)
        
        exploded = rs.ExplodeCurves(flatV)
        
        layer_path.extend(exploded)
        layer_path.append(bridge2)
        
        
        
    result.append(layer_path)
        



debug = th.list_to_tree(debug, source=[0])

a = th.list_to_tree(result, source=[0])
# ---------- end wiring6_onepath ----------
neg_5 = Negative(Value=area_4.Centroid)
base_params = BassParams(
    Nozzle_Diameter=Slider(1.75, range=0..10),
    Layer_Height=Slider(1.2, range=0..10),
    Top_Solid_Layers=2,
    Bottom_Solid_Layers=2,
    Num_of_Shell=2,
    Infill_Ratio=25,
    Artifact_Shell=2,
    Temp_Nozzle=Slider(175, range=0..1000),
    Temp_Bed=Slider(0, range=0..100),
    E_multiplier=1,
    E_Speed=Slider(150, range=0..200),
    F_Speed=Slider(600, range=0..10000),
    Retract=Slider(3, range=0..10))  # -> out, params; inputs E_Speed: Int32
# ---------- base_params: Python ----------
__author__ = "m0rya"

import rhinoscriptsyntax as rs
import ghpythonlib.treehelpers as th
import Rhino

layerTree = []

layerTree.append(["nozzle diameter", Nozzle_Diameter])
layerTree.append(["layer height", Layer_Height])
layerTree.append(["top solid layers", Top_Solid_Layers])
layerTree.append(["bottom solid layers", Bottom_Solid_Layers])
layerTree.append(["num of shell", Num_of_Shell])
layerTree.append(["infill pitch", Infill_Ratio])
layerTree.append(["num of artifacts shells", Artifact_Shell])
layerTree.append(["Temp_Nozzle", Temp_Nozzle])
layerTree.append(["Temp_Bed", Temp_Bed])

layerTree.append(["E_multiplier", E_multiplier])
layerTree.append(["E_Speed", E_Speed])
layerTree.append(["F_Speed", F_Speed])
layerTree.append(["Retract", Retract])

layerTree = th.list_to_tree(layerTree, source=[0])
params = layerTree
# ---------- end base_params ----------
wiring5 = GhPythonScript(crvUV=crv_64, lh=number_slider_11)  # -> out, a, debug; inputs crvUV: tree
# ---------- wiring5: Python ----------
__author__ = "m0rya"

import rhinoscriptsyntax as rs
import ghpythonlib.treehelpers as th

result = []
debug = []

'''
crv_n_u
crv_n_v
crv_n1_u
crv_n1_v
'''

def alt_reverse(crv):
    for itr,c in enumerate(crv):
            if itr%2 == 0:
                continue
            else:
                rs.ReverseCurve(c)

for i in range(int(crvUV.BranchCount/4)):
    
    
    crv_n_u = crvUV.Branch(4*i)
    crv_n_v = crvUV.Branch(4*i+1)
    crv_n1_u = crvUV.Branch(4*i+2)
    crv_n1_v = crvUV.Branch(4*i+3)
    
    #first layer
    
    if i == 0:
        
        first_layer = []
        
        #shell
        shell = []
        shell.append(crv_n_u[0])
        shell.append(crv_n_u[len(crv_n_u)-1])
        shell.append(crv_n_v[0])
        shell.append(crv_n_v[len(crv_n_v)-1])
        
        shell = rs.JoinCurves(shell)
        
        #infill
        infill1 = rs.CopyObjects(crv_n_u[1:len(crv_n_u)-1])
        alt_reverse(infill1)
        
        infill2 = rs.CopyObjects(crv_n_v[1:len(crv_n_v)-1])
        alt_reverse(infill2)
        
        first_layer.extend(shell)
        first_layer.extend(infill1)
        first_layer.extend(infill2)
        
        result.append(first_layer)
        
    
 
        
    layer_path = []
        
        
    #prepare for zigzag
    zigzag = rs.CopyObjects(crv_n_u)
    zigzag2 = rs.CopyObjects(crv_n1_u)
        
    zigzag1a, zigzag1b, zigzag2a, zigzag2b = [], [], [], []
    for j in range(len(zigzag)):
            
        if j%2 == 0:
            zigzag1a.append(zigzag[j])
            zigzag2a.append(zigzag2[j])
        else:
            zigzag1b.append(zigzag[j])
            zigzag2b.append(zigzag2[j])
                
        
    #first zigzag
    zigzagResult = []
    for j in range(len(zigzag1a)):
            
        editPnts = rs.CurveEditPoints(zigzag1a[j])
        editPnts2 = rs.CurveEditPoints(zigzag2a[j])
            
        #ここでeditPnts2をeditPnts側に2*lhだけよせる
        for k in range(len(editPnts)):
            tmpVec = rs.VectorCreate(editPnts2[k], editPnts[k])
            tmpVec = rs.VectorScale(tmpVec, (rs.VectorLength(tmpVec)-2*lh)/rs.VectorLength(tmpVec))
            editPnts2[k] = rs.VectorAdd(editPnts[k],tmpVec)
            
            
        tmp = []
        for k in range(len(editPnts)-1):
                
            tmp.append(rs.AddLine(editPnts[k], editPnts2[k]))
            tmp.append(rs.AddLine(editPnts2[k], editPnts[k+1]))
                

                
        else:
            tmp.append(rs.AddLine(editPnts[k+1], editPnts2[k+1]))
                
            for l in range(len(editPnts)-1):
                tmp.append(rs.AddLine(editPnts2[len(editPnts)-1-l], editPnts2[len(editPnts)-1-l-1]))
                
        zigzagResult.extend(tmp)
            
    layer_path.extend(zigzagResult)
        
        
    #vvv line
    vvv = rs.CopyObjects(crv_n_v)
    vvv2 = rs.CopyObjects(crv_n1_v)
        
        
    for j in range(len(vvv)):
            
        editPnts = rs.CurveEditPoints(vvv[j])
        editPnts2 = rs.CurveEditPoints(vvv2[j])
        #ここでeditPnts2をeditPntsの向きに1*lhだけよせる
            
        for k in range(len(editPnts)):
            tmpVec = rs.VectorCreate(editPnts2[k], editPnts[k])
            tmpVec = rs.VectorScale(tmpVec, (rs.VectorLength(tmpVec)-lh)/rs.VectorLength(tmpVec))
            editPnts2[k] = rs.VectorAdd(editPnts[k],tmpVec)
            
            
        tmp = []
        for k in range(len(editPnts)-1):
            if k%2 == 0:
                tmp.append(rs.AddLine(editPnts2[k], editPnts[k+1]))
            else:
                tmp.append(rs.AddLine(editPnts[k], editPnts2[k+1]))
                    
        #debug.append(tmp)
        layer_path.extend(tmp)
        
    #second zigzag
    zigzagResult2 = []
    for j in range(len(zigzag1b)):
            
        editPnts = rs.CurveEditPoints(zigzag1b[j])
        editPnts2 = rs.CurveEditPoints(zigzag2b[j])
        #ここでeditPnts2をeditPntsの向きに1*lhだけよせる
        for k in range(len(editPnts)):
            tmpVec = rs.VectorCreate(editPnts2[k], editPnts[k])
            tmpVec = rs.VectorScale(tmpVec, (rs.VectorLength(tmpVec)-lh)/rs.VectorLength(tmpVec))
            editPnts2[k] = rs.VectorAdd(editPnts[k],tmpVec)
            
        tmp = []
        for k in range(len(editPnts)-1):
                
            tmp.append(rs.AddLine(editPnts[k], editPnts2[k]))
            tmp.append(rs.AddLine(editPnts2[k], editPnts[k+1]))
        else:
            tmp.append(rs.AddLine(editPnts[k+1], editPnts2[k+1]))
                
            for l in range(len(editPnts)-1):
                tmp.append(rs.AddLine(editPnts2[len(editPnts)-1-l], editPnts2[len(editPnts)-1-l-1]))
                
        zigzagResult2.extend(tmp)
            
    layer_path.extend(zigzagResult2)
        
        
    #flat vertical line
    flatV = list(crv_n1_v)
    alt_reverse(flatV)
    exploded = rs.ExplodeCurves(flatV)
        
    layer_path.extend(exploded)
        
        
    result.append(layer_path)
        



debug = th.list_to_tree(debug, source=[0])

a = th.list_to_tree(result, source=[0])
# ---------- end wiring5 ----------
xy = XYPlane(Origin=Point(0, 0, 0))
move_11 = Move(Geometry=offset_5, Motion=neg_5)  # -> simplify(graft(Geometry)), Transform
move_12 = Move(Geometry=crv_63, Motion=neg_5)  # -> simplify(Geometry), Transform
crv_65 = Curve([<curve referenced from the Rhino model> x310])
crv_66 = Curve(simplify(wiring6_onepath.a))
number_slider_16 = Slider(0, range=0..10)
project_2 = Project(Geometry=crv_65, Plane=xy)  # -> Geometry, Transform
entwine_3 = Entwine(Branch00=move_11.Geometry, Branch01=move_12.Geometry, FlattenInputs=True)
crv_67 = Curve(flatten(wiring6_onepath.debug))
Z_3 = UnitZ(Factor=Slider(1.2, range=0..10))
pt_2 = Point(wiring6_onepath.debug)
crv_68 = Curve(merge_10)
crv_69 = Curve(crv_66)
move_13 = Move(Geometry=entwine_3, Motion=Z_3)  # -> Geometry, Transform
crv_70 = Curve(simplify(wiring5.a))
data = Data(wiring5.debug)
branch = TreeBranch(Tree=crv_66, Path=Slider(3, range=0..10), MaintainPaths=True)
toggle = BooleanToggle(True)
item_28 = ListItem(List=branch, Index=Slider(0, range=0..21), Wrap=True)
panel_6 = Panel(wiring6_onepath.out)
toggle_2 = BooleanToggle(True)
end_3 = EndPoints(Curve=item_28)  # -> Start, End
pt_3 = Point(end_3.Start)

crv_71 = Curve([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])
crv_72 = Curve([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])
python_5 = GhPythonScript(x=crv_69, y=crv_71, z=Slider(6, range=0..10))  # -> out, a; inputs x: tree, y: list
# ---------- python_5: Python ----------
__author__ = "m0rya"

import rhinoscriptsyntax as rs
import ghpythonlib.treehelpers as th

result = []

for i in range(x.BranchCount):
    
    if i == z:
        
        result.append(y)
    else:
        result.append(x.Branch(i))
        
a = th.list_to_tree(result, source=[0])
# ---------- end python_5 ----------
python_6 = GhPythonScript(x=python_5.a, y=crv_72, z=Slider(7, range=0..10))  # -> out, a; inputs x: tree, y: list; same code as python_5

scale_2 = Scale(Geometry=python_6.a, Center=Point(0, 0, 0), Factor=Slider(0.8, range=0..1))  # -> Geometry, Transform
python_7 = GhPythonScript(path=move_13.Geometry, params=base_params.params)  # -> out, a; inputs path: tree, params: tree
# ---------- python_7: Python ----------
__author__ = "m0rya"

import rhinoscriptsyntax as rs
import datetime


class GCoder:
    
    def __init__(self):
        print("hello")
        
        
    def calc_e(self, dist):
        
        filamentDia = 1.75
        
        resultE = self.E_multiplier * (dist * self.layerHeight * self.nozzleDiameter) / (3.14 * (filamentDia/2.0) * (filamentDia/2.0))
        return resultE
        
    def parseParams(self, params):
        self.nozzleDiameter = params.Branch(0)[1]
        self.layerHeight = params.Branch(1)[1]
        self.topSolidLayer = params.Branch(2)[1]
        self.bottomSolidLayer = params.Branch(3)[1]
        self.numOfShell = params.Branch(4)[1]
        self.pitchOfInfill = params.Branch(5)[1]
        self.numOfArtifactShell = params.Branch(6)[1]
        #self.distOfArtifact = params.Branch(7)[1]
        self.temp_bed = params.Branch(8)[1]
        self.temp_nozzle = params.Branch(7)[1]
        
        self.E_multiplier = params.Branch(9)[1]
        self.eSpeed = params.Branch(10)[1]
        self.mSpeed = params.Branch(11)[1]
        self.retractValue = params.Branch(12)[1]
        
        self.initE = "G92 E0\n"
        
        self.prePoint = [None, None]
        
        self.firstLayerRatio = 0.2
        
        self.lastPnt = (0,10,0)
        
        self.waitMillSec = 500
        self.waitForZ = 3000
        self.retractSpeed = 1500
        self.endRetract = 5
        
        self.eSpeed_slow = 85
        
        self.zUpTgl = False
        
    def initFile(self):
        
        savePath = rs.SaveFileName("Export G-Code File", "G-Code Files (*.gcode) |*.gcode||")
        self.f = open(savePath, 'w')
        
        
        #write basic info
        #self.f.write("; This G-Code is generated by Ryoma Takamori's Tool\n")
        
        #write comment
        
        #self.f.write("; Comment\n")
        #comment = rs.StringBox()
        #self.f.write(": " + comment + "\n")
        #self.f.write(";\n")
        
        
        #write date
        #dateCode = "; date : {0}\n".format(datetime.datetime.today())
        #self.f.write(dateCode)
        
        #write init G-Code
        
        initGCode = ''
        #initGCode = "; initial G-Code\n"
        initGCode += "G90\n"
        initGCode += "M82\n"
        initGCode += "G28\n"
        initGCode += "G1 Z10.0 F1500.0\n"
        initGCode += "M106 P0 S255\n"
        initGCode += "M190 S{0}\n".format(self.temp_bed)
        initGCode += "M109 S{0}\n".format(self.temp_nozzle)
        

        self.f.writelines(initGCode)
        self.f.write('\n')
        
        
        
    def closeFile(self):
        
        endGCode = "; End G-Code\n"
        endGCode += "M140 S0.0\n"
        endGCode += "M104 S0.0\n"
        endGCode += "M106 S0.0\n"
        #'''z up finish'''
        #endGCode += "G92 Z0\nG1 Z10 F500\n"
        endGCode += "M84\n"
        
        self.f.writelines(endGCode)
        self.f.write('\n')
        self.f.close()
    
    def crv2gcode(self, crv):
        
        gcode = []
        e_value = 0
        
        
        if rs.IsCurveLinear(crv):
            exploded = [crv]
            
        else:
            exploded = rs.ExplodeCurves(crv)
            #return(';currently only linear crv\n')
            
            
            
        for itr, e in enumerate(exploded):
            
            crv_length = rs.CurveLength(e)
            e_value = self.calc_e(crv_length)
            
            startPnt = rs.CurveStartPoint(e)
            endPnt = rs.CurveEndPoint(e)
            
            
            if itr == 0:
                dist_last = rs.Distance(self.lastPnt, startPnt)
            
                #retract and move or none
                if dist_last > 0.01:

                    #retract
                    gcode.append("G92 E0\n")
                    gcode.append("G1 E{0} F{1}\n".format(-self.retractValue, self.retractSpeed))
                
                    #move up z 5
                    gcode.append("G1 Z{0} F{1}\n".format(self.lastPnt[2] + 10, self.mSpeed))
                
                    #move to startPnt with up z 5
                    gcode.append("G1 X{0} Y{1}\n".format(startPnt.X, startPnt.Y))
                
                    #move to startPnt
                    gcode.append("G1 Z{0}\n".format(startPnt.Z))
                
                
                    #back to retract
                    gcode.append("G1 Z{0} F{1}\n".format(startPnt.Z + 0.3, self.mSpeed))
                    gcode.append("G1 E{0} F{1}\n".format(self.calc_e(0.3), self.retractSpeed))
                    gcode.append("G4 P{0}\n".format(self.waitMillSec*3))
                
            

            
            

            
            vec1 = rs.VectorCreate(endPnt, startPnt)
            vec2 = rs.VectorCreate((0,0,1), (0,0,0))
            angle = rs.VectorAngle(vec1, vec2)
            
            
            #stop a while
            if angle < 60:
            
                #split crv, (crv_length - n : n) n = 0.6
                n = 0.6
                
                
                crv_vec = rs.VectorCreate(endPnt, startPnt)
                crv_vec = rs.VectorUnitize(crv_vec)
                crv_vec = rs.VectorScale(crv_vec, crv_length-n)
                split_pnt = rs.VectorAdd(startPnt, crv_vec)
                
                e_value = self.calc_e(crv_length-n)
                
                
                gcode.append("G92 E0\n")
                gcode.append("G1 X{0} Y{1} Z{2} E{3} F{4}\n".format(split_pnt.X, split_pnt.Y, split_pnt.Z, e_value, self.eSpeed_slow))
                
                
                    
                #retract at end of the curve
                gcode.append("G92 E0\n")
                gcode.append("G1 E{0} F{1}\n".format(-self.endRetract, self.retractSpeed))
                gcode.append("G4 P{0}\n".format(self.waitForZ))
                gcode.append("G1 E0 F{0}\n".format(self.retractSpeed))
                
                #extrude little bit
                e_value = self.calc_e(n)
                gcode.append("G1 X{0} Y{1} Z{2} E{3} F{4}\n".format(endPnt.X, endPnt.Y, endPnt.Z, e_value, self.eSpeed_slow))
                
                self.zUpTgl = True
                
            else:
                
                if self.zUpTgl:
                    speed = self.eSpeed_slow
                    self.zUpTgl = False
                else:
                    speed = self.eSpeed
                
                #extrude crv
                gcode.append("G92 E0\n")
                gcode.append("G1 X{0} Y{1} Z{2} E{3} F{4}\n".format(endPnt.X, endPnt.Y, endPnt.Z, e_value, speed))
                
                #stop a while
                gcode.append("G4 P{0}\n".format(self.waitMillSec))
            
        
                                
        else:
            self.lastPnt = endPnt
            
        return ''.join(gcode)
        
        
    def writePath(self, path):
        
        for i in range(path.BranchCount):
            
            for c in path.Branch(i):
                self.f.write(self.crv2gcode(c))
        
        
def main():
        
    gcoder = GCoder()
    
    gcoder.parseParams(params)
    gcoder.initFile()
    gcoder.writePath(path)
    gcoder.closeFile()
    
    
if button:
    main()
# ---------- end python_7 ----------
export2 = GhPythonScript(path=scale_2.Geometry, params=base_params.params)  # -> out, a; inputs path: tree, params: tree
# ---------- export2: Python ----------
__author__ = "m0rya"

import rhinoscriptsyntax as rs
import datetime


class GCoder:
    
    def __init__(self):
        print("hello")
        
        
    def calc_e(self, dist):
        
        filamentDia = 1.75
        
        resultE = self.E_multiplier * (dist * self.layerHeight * self.nozzleDiameter) / (3.14 * (filamentDia/2.0) * (filamentDia/2.0))
        return resultE
        
    def parseParams(self, params):
        self.nozzleDiameter = params.Branch(0)[1]
        self.layerHeight = params.Branch(1)[1]
        self.topSolidLayer = params.Branch(2)[1]
        self.bottomSolidLayer = params.Branch(3)[1]
        self.numOfShell = params.Branch(4)[1]
        self.pitchOfInfill = params.Branch(5)[1]
        self.numOfArtifactShell = params.Branch(6)[1]
        #self.distOfArtifact = params.Branch(7)[1]
        self.temp_bed = params.Branch(8)[1]
        self.temp_nozzle = params.Branch(7)[1]
        
        self.E_multiplier = params.Branch(9)[1]
        self.eSpeed = params.Branch(10)[1]
        self.mSpeed = params.Branch(11)[1]
        self.retractValue = params.Branch(12)[1]
        
        self.initE = "G92 E0\n"
        
        self.prePoint = [None, None]
        
        self.firstLayerRatio = 0.2
        
        self.lastPnt = (0,10,0)
        
        self.waitMillSec = 500
        self.waitForZ = 5000
        self.retractSpeed = 1500
        self.endRetract = 5
        
        self.eSpeed_slow = 85
        
        self.zUpTgl = False
        
    def initFile(self):
        
        savePath = rs.SaveFileName("Export G-Code File", "G-Code Files (*.gcode) |*.gcode||")
        self.f = open(savePath, 'w')
        
        
        #write basic info
        #self.f.write("; This G-Code is generated by Ryoma Takamori's Tool\n")
        
        #write comment
        
        #self.f.write("; Comment\n")
        #comment = rs.StringBox()
        #self.f.write(": " + comment + "\n")
        #self.f.write(";\n")
        
        
        #write date
        #dateCode = "; date : {0}\n".format(datetime.datetime.today())
        #self.f.write(dateCode)
        
        #write init G-Code
        
        initGCode = ''
        #initGCode = "; initial G-Code\n"
        initGCode += "G90\n"
        initGCode += "M82\n"
        initGCode += "G28\n"
        initGCode += "G1 Z10.0 F1500.0\n"
        initGCode += "M106 P0 S255\n"
        initGCode += "M190 S{0}\n".format(self.temp_bed)
        initGCode += "M109 S{0}\n".format(self.temp_nozzle)
        

        self.f.writelines(initGCode)
        self.f.write('\n')
        
        
        
    def closeFile(self):
        
        endGCode = "; End G-Code\n"
        endGCode += "M140 S0.0\n"
        endGCode += "M104 S0.0\n"
        endGCode += "M106 S0.0\n"
        #'''z up finish'''
        #endGCode += "G92 Z0\nG1 Z10 F500\n"
        endGCode += "M84\n"
        
        self.f.writelines(endGCode)
        self.f.write('\n')
        self.f.close()
    
    def crv2gcode(self, crv):
        
        gcode = []
        e_value = 0
        
        
        if rs.IsCurveLinear(crv):
            exploded = [crv]
            
        else:
            exploded = rs.ExplodeCurves(crv)
            #return(';currently only linear crv\n')
            
            
            
        for itr, e in enumerate(exploded):
            
            crv_length = rs.CurveLength(e)
            e_value = self.calc_e(crv_length)
            
            startPnt = rs.CurveStartPoint(e)
            endPnt = rs.CurveEndPoint(e)
            
            
            if itr == 0:
                dist_last = rs.Distance(self.lastPnt, startPnt)
            
                #retract and move or none
                #comment for one path
                
                #if dist_last > 0.01:
                if dist_last > 5:

                    #retract
                    gcode.append("G92 E0\n")
                    gcode.append("G1 E{0} F{1}\n".format(-self.retractValue, self.retractSpeed))
                
                    #move up z 5
                    gcode.append("G1 Z{0} F{1}\n".format(self.lastPnt[2] + 10, self.mSpeed))
                
                    #move to startPnt with up z 5
                    gcode.append("G1 X{0} Y{1}\n".format(startPnt.X, startPnt.Y))
                
                    #move to startPnt
                    gcode.append("G1 Z{0}\n".format(startPnt.Z))
                
                
                    #back to retract
                    #gcode.append("G1 E{0} F{1}\n".format(self.calc_e(0.3), self.retractSpeed))
                    gcode.append("G1 E{0} F{1}\n".format(self.calc_e(self.nozzleDiameter), self.retractSpeed))
                    gcode.append("G4 P{0}\n".format(self.waitMillSec*3))
                    self.zUpTgl = True
                
            

            
            

            
            vec1 = rs.VectorCreate(endPnt, startPnt)
            vec2 = rs.VectorCreate((0,0,1), (0,0,0))
            angle = rs.VectorAngle(vec1, vec2)
            
            
            #stop a while
            if angle < 70:
                
                print("hi")
                #split crv, (crv_length - n : n) n = 0.6
                n = 0.6
                
                
                crv_vec = rs.VectorCreate(endPnt, startPnt)
                crv_vec = rs.VectorUnitize(crv_vec)
                crv_vec = rs.VectorScale(crv_vec, crv_length-n)
                split_pnt = rs.VectorAdd(startPnt, crv_vec)
                
                e_value = self.calc_e(crv_length-n)
                
                
                gcode.append("G92 E0\n")
                gcode.append("G1 X{0} Y{1} Z{2} E{3} F{4}\n".format(split_pnt.X, split_pnt.Y, split_pnt.Z, e_value, self.eSpeed_slow))
                
                
                    
                #retract at end of the curve
                gcode.append("G92 E0\n")
                gcode.append("G1 E{0} F{1}\n".format(-self.endRetract, self.retractSpeed))
                gcode.append("G4 P{0}\n".format(self.waitForZ))
                gcode.append("G1 E0 F{0}\n".format(self.retractSpeed))
                
                #extrude little bit
                e_value = self.calc_e(n)
                gcode.append("G1 X{0} Y{1} Z{2} E{3} F{4}\n".format(endPnt.X, endPnt.Y, endPnt.Z, e_value, self.eSpeed_slow))
                
                self.zUpTgl = True
                
            else:
                
                if self.zUpTgl:
                    speed = self.eSpeed_slow
                    self.zUpTgl = False
                else:
                    speed = self.eSpeed
                
                #extrude crv
                gcode.append("G92 E0\n")
                gcode.append("G1 X{0} Y{1} Z{2} E{3} F{4}\n".format(endPnt.X, endPnt.Y, endPnt.Z, e_value, speed))
                
                #stop a while
                gcode.append("G4 P{0}\n".format(self.waitMillSec))
            
        
                                
        else:
            self.lastPnt = endPnt
            
        return ''.join(gcode)
        
        
    def writePath(self, path):
        
        for i in range(path.BranchCount):
            
            for c in path.Branch(i):
                self.f.write(self.crv2gcode(c))
        
        
def main():
        
    gcoder = GCoder()
    
    gcoder.parseParams(params)
    gcoder.initFile()
    gcoder.writePath(path)
    gcoder.closeFile()
    
    
if button:
    main()
# ---------- end export2 ----------
export3_one_path = GhPythonScript(path=scale_2.Geometry, button=Button(), params=base_params.params)  # -> out, a; inputs path: tree, params: tree
# ---------- export3_one_path: Python ----------
__author__ = "m0rya"

import rhinoscriptsyntax as rs
import datetime


class GCoder:
    
    def __init__(self):
        print("hello")
        
        
    def calc_e(self, dist):
        
        filamentDia = 1.75
        
        resultE = self.E_multiplier * (dist * self.layerHeight * self.nozzleDiameter) / (3.14 * (filamentDia/2.0) * (filamentDia/2.0))
        return resultE
        
    def parseParams(self, params):
        self.nozzleDiameter = params.Branch(0)[1]
        self.layerHeight = params.Branch(1)[1]
        self.topSolidLayer = params.Branch(2)[1]
        self.bottomSolidLayer = params.Branch(3)[1]
        self.numOfShell = params.Branch(4)[1]
        self.pitchOfInfill = params.Branch(5)[1]
        self.numOfArtifactShell = params.Branch(6)[1]
        #self.distOfArtifact = params.Branch(7)[1]
        self.temp_bed = params.Branch(8)[1]
        self.temp_nozzle = params.Branch(7)[1]
        
        self.E_multiplier = params.Branch(9)[1]
        self.eSpeed = params.Branch(10)[1]
        self.mSpeed = params.Branch(11)[1]
        self.retractValue = params.Branch(12)[1]
        
        self.initE = "G92 E0\n"
        
        self.prePoint = [None, None]
        
        self.firstLayerRatio = 0.2
        
        self.lastPnt = (0,10,0)
        
        self.waitMillSec = 500
        self.waitForZ = 5000
        self.retractSpeed = 1500
        self.endRetract = 5
        
        self.eSpeed_slow = 75
        
        self.zUpTgl = False
        
    def initFile(self):
        
        savePath = rs.SaveFileName("Export G-Code File", "G-Code Files (*.gcode) |*.gcode||")
        self.f = open(savePath, 'w')
        
        
        #write basic info
        #self.f.write("; This G-Code is generated by Ryoma Takamori's Tool\n")
        
        #write comment
        
        #self.f.write("; Comment\n")
        #comment = rs.StringBox()
        #self.f.write(": " + comment + "\n")
        #self.f.write(";\n")
        
        
        #write date
        #dateCode = "; date : {0}\n".format(datetime.datetime.today())
        #self.f.write(dateCode)
        
        #write init G-Code
        
        initGCode = ''
        #initGCode = "; initial G-Code\n"
        initGCode += "G90\n"
        initGCode += "M82\n"
        initGCode += "G28\n"
        initGCode += "G1 Z10.0 F1500.0\n"
        initGCode += "M106 P0 S255\n"
        initGCode += "M190 S{0}\n".format(self.temp_bed)
        initGCode += "M109 S{0}\n".format(self.temp_nozzle)
        

        self.f.writelines(initGCode)
        self.f.write('\n')
        
        
        
    def closeFile(self):
        
        endGCode = "; End G-Code\n"
        endGCode += "M140 S0.0\n"
        endGCode += "M104 S0.0\n"
        endGCode += "M106 S0.0\n"
        #'''z up finish'''
        #endGCode += "G92 Z0\nG1 Z10 F500\n"
        endGCode += "M84\n"
        
        self.f.writelines(endGCode)
        self.f.write('\n')
        self.f.close()
    
    def crv2gcode(self, crv):
        
        gcode = []
        e_value = 0
        
        
        if rs.IsCurveLinear(crv):
            exploded = [crv]
            
        else:
            exploded = rs.ExplodeCurves(crv)
            #return(';currently only linear crv\n')
            
            
            
        for itr, e in enumerate(exploded):
            
            crv_length = rs.CurveLength(e)
            e_value = self.calc_e(crv_length)
            
            startPnt = rs.CurveStartPoint(e)
            endPnt = rs.CurveEndPoint(e)
            
            
            if itr == 0:
                dist_last = rs.Distance(self.lastPnt, startPnt)
            
                #retract and move or none
                #comment for one path
                
                #if dist_last > 0.01:
                if dist_last > 5:

                    #retract
                    gcode.append("G92 E0\n")
                    gcode.append("G1 E{0} F{1}\n".format(-self.retractValue, self.retractSpeed))
                
                    #move up z 5
                    gcode.append("G1 Z{0} F{1}\n".format(self.lastPnt[2] + 10, self.mSpeed))
                
                    #move to startPnt with up z 5
                    gcode.append("G1 X{0} Y{1}\n".format(startPnt.X, startPnt.Y))
                
                    #move to startPnt
                    gcode.append("G1 Z{0}\n".format(startPnt.Z))
                
                
                    #back to retract
                    #gcode.append("G1 E{0} F{1}\n".format(self.calc_e(0.3), self.retractSpeed))
                    gcode.append("G1 E{0} F{1}\n".format(self.calc_e(self.nozzleDiameter), self.retractSpeed))
                    gcode.append("G4 P{0}\n".format(self.waitMillSec*3))
                    self.zUpTgl = True
                
            

            
            

            
            vec1 = rs.VectorCreate(endPnt, startPnt)
            vec2 = rs.VectorCreate((0,0,1), (0,0,0))
            angle = rs.VectorAngle(vec1, vec2)
            
            
            #stop a while
            if angle < 70:
                
                print("hi")
                #split crv, (crv_length - n : n) n = 0.6
                n = 0.6
                
                
                crv_vec = rs.VectorCreate(endPnt, startPnt)
                crv_vec = rs.VectorUnitize(crv_vec)
                crv_vec = rs.VectorScale(crv_vec, crv_length-n)
                split_pnt = rs.VectorAdd(startPnt, crv_vec)
                
                e_value = self.calc_e(crv_length-n)
                
                
                gcode.append("G92 E0\n")
                gcode.append("G1 X{0} Y{1} Z{2} E{3} F{4}\n".format(split_pnt.X, split_pnt.Y, split_pnt.Z, e_value, self.eSpeed_slow))
                
                
                    
                #retract at end of the curve
                gcode.append("G92 E0\n")
                #gcode.append("G1 E{0} F{1}\n".format(-self.endRetract, self.retractSpeed))
                gcode.append("G4 P{0}\n".format(self.waitForZ))
                #gcode.append("G1 E0 F{0}\n".format(self.retractSpeed))
                
                #extrude little bit
                e_value = self.calc_e(n)
                gcode.append("G1 X{0} Y{1} Z{2} E{3} F{4}\n".format(endPnt.X, endPnt.Y, endPnt.Z, e_value, self.eSpeed_slow))
                
                self.zUpTgl = True
                
            else:
                
                if self.zUpTgl:
                    speed = self.eSpeed_slow
                    self.zUpTgl = False
                else:
                    speed = self.eSpeed
                
                #extrude crv
                gcode.append("G92 E0\n")
                gcode.append("G1 X{0} Y{1} Z{2} E{3} F{4}\n".format(endPnt.X, endPnt.Y, endPnt.Z, e_value, speed))
                
                #stop a while
                gcode.append("G4 P{0}\n".format(self.waitMillSec))
            
        
                                
        else:
            self.lastPnt = endPnt
            
        return ''.join(gcode)
        
        
    def writePath(self, path):
        
        for i in range(path.BranchCount):
            
            for c in path.Branch(i):
                self.f.write(self.crv2gcode(c))
        
        
def main():
        
    gcoder = GCoder()
    
    gcoder.parseParams(params)
    gcoder.initFile()
    gcoder.writePath(path)
    gcoder.closeFile()
    
    
if button:
    main()
# ---------- end export3_one_path ----------
export3_withdot = GhPythonScript(path=scale_2.Geometry, params=base_params.params)  # -> out, a; inputs path: tree, params: tree
# ---------- export3_withdot: Python ----------
__author__ = "m0rya"

import rhinoscriptsyntax as rs
import datetime


class GCoder:
    
    def __init__(self):
        print("hello")
        
        
    def calc_e(self, dist):
        
        filamentDia = 1.75
        
        resultE = self.E_multiplier * (dist * self.layerHeight * self.nozzleDiameter) / (3.14 * (filamentDia/2.0) * (filamentDia/2.0))
        return resultE
        
    def parseParams(self, params):
        self.nozzleDiameter = params.Branch(0)[1]
        self.layerHeight = params.Branch(1)[1]
        self.topSolidLayer = params.Branch(2)[1]
        self.bottomSolidLayer = params.Branch(3)[1]
        self.numOfShell = params.Branch(4)[1]
        self.pitchOfInfill = params.Branch(5)[1]
        self.numOfArtifactShell = params.Branch(6)[1]
        #self.distOfArtifact = params.Branch(7)[1]
        self.temp_bed = params.Branch(8)[1]
        self.temp_nozzle = params.Branch(7)[1]
        
        self.E_multiplier = params.Branch(9)[1]
        self.eSpeed = params.Branch(10)[1]
        self.mSpeed = params.Branch(11)[1]
        self.retractValue = params.Branch(12)[1]
        
        self.initE = "G92 E0\n"
        
        self.prePoint = [None, None]
        
        self.firstLayerRatio = 0.2
        
        self.lastPnt = (0,10,0)
        
        self.waitMillSec = 500
        self.waitForZ = 5000
        self.retractSpeed = 1500
        self.endRetract = 5
        
        self.eSpeed_slow = 85
        
        self.zUpTgl = False
        
    def initFile(self):
        
        savePath = rs.SaveFileName("Export G-Code File", "G-Code Files (*.gcode) |*.gcode||")
        self.f = open(savePath, 'w')
        
        
        #write basic info
        #self.f.write("; This G-Code is generated by Ryoma Takamori's Tool\n")
        
        #write comment
        
        #self.f.write("; Comment\n")
        #comment = rs.StringBox()
        #self.f.write(": " + comment + "\n")
        #self.f.write(";\n")
        
        
        #write date
        #dateCode = "; date : {0}\n".format(datetime.datetime.today())
        #self.f.write(dateCode)
        
        #write init G-Code
        
        initGCode = ''
        #initGCode = "; initial G-Code\n"
        initGCode += "G90\n"
        initGCode += "M82\n"
        initGCode += "G28\n"
        initGCode += "G1 Z10.0 F1500.0\n"
        initGCode += "M106 P0 S255\n"
        initGCode += "M190 S{0}\n".format(self.temp_bed)
        initGCode += "M109 S{0}\n".format(self.temp_nozzle)
        

        self.f.writelines(initGCode)
        self.f.write('\n')
        
        
        
    def closeFile(self):
        
        endGCode = "; End G-Code\n"
        endGCode += "M140 S0.0\n"
        endGCode += "M104 S0.0\n"
        endGCode += "M106 S0.0\n"
        #'''z up finish'''
        #endGCode += "G92 Z0\nG1 Z10 F500\n"
        endGCode += "M84\n"
        
        self.f.writelines(endGCode)
        self.f.write('\n')
        self.f.close()
    
    def crv2gcode(self, crv):
        
        gcode = []
        e_value = 0
        
        
        if rs.IsCurveLinear(crv):
            exploded = [crv]
            
        else:
            exploded = rs.ExplodeCurves(crv)
            #return(';currently only linear crv\n')
            
            
            
        for itr, e in enumerate(exploded):
            
            crv_length = rs.CurveLength(e)
            e_value = self.calc_e(crv_length)
            
            startPnt = rs.CurveStartPoint(e)
            endPnt = rs.CurveEndPoint(e)
            
            
            if itr == 0:
                dist_last = rs.Distance(self.lastPnt, startPnt)
            
                #retract and move or none
                if dist_last > 0.01:

                    #retract
                    gcode.append("G92 E0\n")
                    gcode.append("G1 E{0} F{1}\n".format(-self.retractValue, self.retractSpeed))
                
                    #move up z 5
                    gcode.append("G1 Z{0} F{1}\n".format(self.lastPnt[2] + 10, self.mSpeed))
                
                    #move to startPnt with up z 5
                    gcode.append("G1 X{0} Y{1}\n".format(startPnt.X, startPnt.Y))
                
                    #move to startPnt
                    gcode.append("G1 Z{0}\n".format(startPnt.Z))
                
                
                    #back to retract
                    #gcode.append("G1 E{0} F{1}\n".format(self.calc_e(0.3), self.retractSpeed))
                    gcode.append("G1 E{0} F{1}\n".format(self.calc_e(self.nozzleDiameter), self.retractSpeed))
                    gcode.append("G4 P{0}\n".format(self.waitMillSec*3))
                    self.zUpTgl = True
                
            

            
            

            
            vec1 = rs.VectorCreate(endPnt, startPnt)
            vec2 = rs.VectorCreate((0,0,1), (0,0,0))
            angle = rs.VectorAngle(vec1, vec2)
            
            
            #stop a while
            if angle < 60:
            
                #split crv, (crv_length - n : n) n = 0.6
                n = 0.6
                
                
                crv_vec = rs.VectorCreate(endPnt, startPnt)
                crv_vec = rs.VectorUnitize(crv_vec)
                crv_vec = rs.VectorScale(crv_vec, crv_length-n)
                split_pnt = rs.VectorAdd(startPnt, crv_vec)
                
                e_value = self.calc_e(crv_length-n)
                
                
                gcode.append("G92 E0\n")
                gcode.append("G1 X{0} Y{1} Z{2} E{3} F{4}\n".format(split_pnt.X, split_pnt.Y, split_pnt.Z, e_value, self.eSpeed_slow))
                
                
                    
                #retract at end of the curve
                gcode.append("G92 E0\n")
                gcode.append("G1 E{0} F{1}\n".format(-self.endRetract, self.retractSpeed))
                gcode.append("G4 P{0}\n".format(self.waitForZ))
                gcode.append("G1 E0 F{0}\n".format(self.retractSpeed))
                
                #extrude little bit
                e_value = self.calc_e(n)
                gcode.append("G1 X{0} Y{1} Z{2} E{3} F{4}\n".format(endPnt.X, endPnt.Y, endPnt.Z, e_value, self.eSpeed_slow))
                
                self.zUpTgl = True
                
            else:
                
                if self.zUpTgl:
                    speed = self.eSpeed_slow
                    self.zUpTgl = False
                else:
                    speed = self.eSpeed
                
                #extrude crv
                gcode.append("G92 E0\n")
                gcode.append("G1 X{0} Y{1} Z{2} E{3} F{4}\n".format(endPnt.X, endPnt.Y, endPnt.Z, e_value, speed))
                
                #stop a while
                gcode.append("G4 P{0}\n".format(self.waitMillSec))
            
        
                                
        else:
            self.lastPnt = endPnt
            
        return ''.join(gcode)
        
        
    def writePath(self, path):
        
        for i in range(path.BranchCount):
            
            for c in path.Branch(i):
                self.f.write(self.crv2gcode(c))
        
        
def main():
        
    gcoder = GCoder()
    
    gcoder.parseParams(params)
    gcoder.initFile()
    gcoder.writePath(path)
    gcoder.closeFile()
    
    
if button:
    main()
# ---------- end export3_withdot ----------
crv_73 = Curve(python_5.a)
crv_74 = Curve(scale_2.Geometry)
brec_2 = BoundingRectangle(Geometry=flatten(crv_74), Plane=PlaneXY(0, 0, 0), Axis=0, Slide=0, Union=True)
vec_10 = VectorXYZ(XComponent=1500, YComponent=0, ZComponent=0)  # -> Vector, Length
area_5 = Area(Geometry=brec_2)  # -> Area, Centroid

number_slider_17 = Slider(1, range=0..1)
crv_75 = Curve(scale_2.Geometry)
number_slider_18 = Slider(1.75, range=0..10)
number_slider_19 = Slider(1, range=0..10)
curve_charge = CurveCharge(Curve=flatten(crv_75), Radius=Slider(1.75, range=0..10), ChargeStrengths=Slider(1.5, range=0..10))
cocoon = Cocoon(
    Charges=curve_charge,
    Iso=Slider(0.56, range=0..1),
    CellSize=Slider(0.5, range=0..1),
    Execute=Toggle(False),
    Simple=False)  # -> Mesh, RefinementData
pipe = Pipe(Curve=crv_75, Radius=Slider(0.875, range=0..1), Caps=2)  # -> flatten(Pipe)
mesh = Mesh(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)

subtraction = Subtraction(A=vec_10.Vector, B=area_5.Centroid)
move_14 = Move(Geometry=crv_74, Motion=subtraction)  # -> Geometry, Transform
rotate_4 = Rotate(Geometry=move_14.Geometry, Angle=1.570796327, Plane=vec_10.Vector)  # -> Geometry, Transform
scale_3 = Scale(Geometry=rotate_4.Geometry, Center=vec_10.Vector, Factor=Slider(7, range=0..100))  # -> Geometry, Transform
button = Button()
export_for_pcs = GhPythonScript(path=scale_3.Geometry, button=Toggle(False), params=base_params.params)  # -> out, a; inputs path: tree, params: tree
# ---------- export_for_pcs: Python ----------
__author__ = "m0rya"

import rhinoscriptsyntax as rs
import datetime


class GCoder:
    
    def __init__(self):
        print("hello")
        
        
    def calc_e(self, dist):
        
        filamentDia = 1.75
        
        resultE = self.E_multiplier * (dist * self.layerHeight * self.nozzleDiameter) / (3.14 * (filamentDia/2.0) * (filamentDia/2.0))
        return resultE
        
    def parseParams(self, params):
        self.nozzleDiameter = params.Branch(0)[1]
        self.layerHeight = params.Branch(1)[1]
        self.topSolidLayer = params.Branch(2)[1]
        self.bottomSolidLayer = params.Branch(3)[1]
        self.numOfShell = params.Branch(4)[1]
        self.pitchOfInfill = params.Branch(5)[1]
        self.numOfArtifactShell = params.Branch(6)[1]
        #self.distOfArtifact = params.Branch(7)[1]
        self.temp_bed = params.Branch(8)[1]
        self.temp_nozzle = params.Branch(7)[1]
        
        self.E_multiplier = params.Branch(9)[1]
        self.eSpeed = params.Branch(10)[1]
        self.mSpeed = params.Branch(11)[1]
        self.retractValue = params.Branch(12)[1]
        
        self.initE = "G92 E0\n"
        
        self.prePoint = [None, None]
        
        self.firstLayerRatio = 0.2
        
        self.lastPnt = (0,10,0)
        
        self.waitMillSec = 500
        self.waitForZ = 5000
        self.retractSpeed = 1500
        self.endRetract = 5
        
        self.eSpeed_slow = 85
        
        self.zUpTgl = False
        
    def initFile(self):
        
        #savePath = rs.SaveFileName("Export G-Code File", "G-Code Files (*.gcode) |*.gcode||")
        #self.f = open(savePath, 'w')
        
        savePath = rs.SaveFileName("Export .pcs File", "pcs Files (*.pcs) |*.pcs||")
        self.f = open(savePath, 'w')
        
        
        #write basic info
        #self.f.write("; This G-Code is generated by Ryoma Takamori's Tool\n")
        
        #write comment
        
        #self.f.write("; Comment\n")
        #comment = rs.StringBox()
        #self.f.write(": " + comment + "\n")
        #self.f.write(";\n")
        
        
        #write date
        #dateCode = "; date : {0}\n".format(datetime.datetime.today())
        #self.f.write(dateCode)
        
        #write init G-Code
        
        initPCode = ''
        initPCode += "Sub Main\n"
        initPCode += "\tTakeArm Keep = 0\n"
        initPCode += "\tDim pos As Position\n"
        initPCode += "\tpos = P(1500, 0, 0, 180, 0, 0)\n" #Home for Robot Arm
        initPCode += "\tMove L,pos\n"
        
        self.lastPnt = [1500, 0, 0]
        self.armAngle = [180, 0, 0]
        
        
        '''
        #initGCode = "; initial G-Code\n"
        initGCode += "G90\n"
        initGCode += "M82\n"
        initGCode += "G28\n"
        initGCode += "G1 Z10.0 F1500.0\n"
        initGCode += "M106 P0 S255\n"
        initGCode += "M190 S{0}\n".format(self.temp_bed)
        initGCode += "M109 S{0}\n".format(self.temp_nozzle)
        '''

        self.f.writelines(initPCode)
        self.f.write('\n')
        
        
        
    def closeFile(self):
        
        '''
        endGCode = "; End G-Code\n"
        endGCode += "M140 S0.0\n"
        endGCode += "M104 S0.0\n"
        endGCode += "M106 S0.0\n"
        #"""z up finish"""
        #endGCode += "G92 Z0\nG1 Z10 F500\n"
        endGCode += "M84\n"
        '''
        
        endPCode = "End Sub\n"
        self.f.writelines(endPCode)
        self.f.close()
    
    def crv2gcode(self, crv):
        
        gcode = []
        pcode = []
        
        e_value = 0
        
        
        if rs.IsCurveLinear(crv):
            exploded = [crv]
            
        else:
            exploded = rs.ExplodeCurves(crv)
            #return(';currently only linear crv\n')
            
            
            
        for itr, e in enumerate(exploded):
            
            crv_length = rs.CurveLength(e)
            e_value = self.calc_e(crv_length)
            
            startPnt = rs.CurveStartPoint(e)
            endPnt = rs.CurveEndPoint(e)
            
            
            if itr == 0:
                dist_last = rs.Distance(self.lastPnt, startPnt)
            
                #retract and move or none
                #comment for one path
                
                #if dist_last > 0.01:
                if dist_last > 5:

                    #retract
                    gcode.append("G92 E0\n")
                    gcode.append("G1 E{0} F{1}\n".format(-self.retractValue, self.retractSpeed))
                
                    #move up z 5
                    gcode.append("G1 Z{0} F{1}\n".format(self.lastPnt[2] + 10, self.mSpeed))
                    self.lastPnt[2] = self.lastPnt[2] + 10
                    pcode.append("\tpos = P({0[0]}, {0[1]}, {0[2]}, {1[0]}, {1[1]}, {1[2]})\n".format(self.lastPnt, self.armAngle))
                    pcode.append("\tMove L,pos\n")
                
                
                    #move to startPnt with up z 5
                    gcode.append("G1 X{0} Y{1}\n".format(startPnt.X, startPnt.Y))
                    self.lastPnt[0] = startPnt.X
                    self.lastPnt[1] = startPnt.Y
                    pcode.append("\tpos = P({0[0]}, {0[1]}, {0[2]}, {1[0]}, {1[1]}, {1[2]})\n".format(self.lastPnt, self.armAngle))
                    pcode.append("\tMove L,pos\n")
                    
                    
                    #move to startPnt
                    gcode.append("G1 Z{0}\n".format(startPnt.Z))
                    self.lastPnt[2] = startPnt.Z
                    pcode.append("\tpos = P({0[0]}, {0[1]}, {0[2]}, {1[0]}, {1[1]}, {1[2]})\n".format(self.lastPnt, self.armAngle))
                    pcode.append("\tMove L,pos\n")
                    
                    #back to retract
                    #gcode.append("G1 E{0} F{1}\n".format(self.calc_e(0.3), self.retractSpeed))
                    gcode.append("G1 E{0} F{1}\n".format(self.calc_e(self.nozzleDiameter), self.retractSpeed))
                    gcode.append("G4 P{0}\n".format(self.waitMillSec*3))
                    self.zUpTgl = True
                
            

            
            

            
            vec1 = rs.VectorCreate(endPnt, startPnt)
            vec2 = rs.VectorCreate((0,0,1), (0,0,0))
            angle = rs.VectorAngle(vec1, vec2)
            
            
            #stop a while
            if angle < 70:
                
                #split crv, (crv_length - n : n) n = 0.6
                n = 0.6
                
                
                crv_vec = rs.VectorCreate(endPnt, startPnt)
                crv_vec = rs.VectorUnitize(crv_vec)
                crv_vec = rs.VectorScale(crv_vec, crv_length-n)
                split_pnt = rs.VectorAdd(startPnt, crv_vec)
                
                e_value = self.calc_e(crv_length-n)
                
                
                gcode.append("G92 E0\n")
                gcode.append("G1 X{0} Y{1} Z{2} E{3} F{4}\n".format(split_pnt.X, split_pnt.Y, split_pnt.Z, e_value, self.eSpeed_slow))
                
                self.lastPnt = (split_pnt.X, split_pnt.Y, split_pnt.Z)
                pcode.append("\tpos = P({0[0]}, {0[1]}, {0[2]}, {1[0]}, {1[1]}, {1[2]})\n".format(self.lastPnt, self.armAngle))
                pcode.append("\tMove L,pos\n")
                
                    
                #retract at end of the curve
                gcode.append("G92 E0\n")
                gcode.append("G1 E{0} F{1}\n".format(-self.endRetract, self.retractSpeed))
                gcode.append("G4 P{0}\n".format(self.waitForZ))
                gcode.append("G1 E0 F{0}\n".format(self.retractSpeed))
                
                #extrude little bit
                e_value = self.calc_e(n)
                gcode.append("G1 X{0} Y{1} Z{2} E{3} F{4}\n".format(endPnt.X, endPnt.Y, endPnt.Z, e_value, self.eSpeed_slow))
                
                self.lastPnt = (endPnt.X, endPnt.Y, endPnt.Z)
                pcode.append("\tpos = P({0[0]}, {0[1]}, {0[2]}, {1[0]}, {1[1]}, {1[2]})\n".format(self.lastPnt, self.armAngle))
                pcode.append("\tMove L,pos\n")
                
                self.zUpTgl = True
                
            else:
                
                if self.zUpTgl:
                    speed = self.eSpeed_slow
                    self.zUpTgl = False
                else:
                    speed = self.eSpeed
                
                #extrude crv
                gcode.append("G92 E0\n")
                gcode.append("G1 X{0} Y{1} Z{2} E{3} F{4}\n".format(endPnt.X, endPnt.Y, endPnt.Z, e_value, speed))
                
                self.lastPnt = (endPnt.X, endPnt.Y, endPnt.Z)
                pcode.append("\tpos = P({0[0]}, {0[1]}, {0[2]}, {1[0]}, {1[1]}, {1[2]})\n".format(self.lastPnt, self.armAngle))
                pcode.append("\tMove L,pos\n")
                
                #stop a while
                gcode.append("G4 P{0}\n".format(self.waitMillSec))
            
        
                                
        else:
            self.lastPnt = endPnt
            
        return ''.join(pcode)
        
        
        
        
    def writePath(self, path):
        
        for i in range(path.BranchCount):
            
            for c in path.Branch(i):
                self.f.write(self.crv2gcode(c))
        
        
def main():
        
    gcoder = GCoder()
    
    gcoder.parseParams(params)
    gcoder.initFile()
    gcoder.writePath(path)
    gcoder.closeFile()
    
    
if button:
    main()
# ---------- end export_for_pcs ----------

polygon = Polygon(Plane=PlaneXY(0, 0, 0), Radius=Slider(100, range=0..100), Segments=3, FilletRadius=0)  # -> Polygon, Length
area_6 = Area(Geometry=polygon.Polygon)  # -> Area, Centroid
Z_4 = UnitZ(Factor=Slider(50, range=0..100))
cp_2 = ControlPoints(Curve=polygon.Polygon)  # -> Points, Weights, Knots
move_15 = Move(Geometry=area_6.Centroid, Motion=Z_4)  # -> Geometry, Transform
cull_i_2 = CullIndex(List=cp_2.Points, Indices=-1, Wrap=True)
explode_9 = Explode(Curve=polygon.Polygon, Recursive=True)  # -> Segments, Vertices
ln = Line(StartPoint=cull_i_2, EndPoint=move_15.Geometry)
number_slider_20 = Slider(2, range=0..10)

crv_76 = Curve(ln)
crv_77 = Curve(explode_9.Segments)

python_8 = GhPythonScript(x=crv_76, y=crv_77, z=number_slider_20)  # -> out, simplify(a), b; inputs x: list, y: list, z: Int32
# ---------- python_8: Python ----------
__author__ = "m0rya"

import rhinoscriptsyntax as rs
import ghpythonlib.treehelpers as th


def div(crvRoof, crvBottom):
    
    result = []
    newCrvs = [[[],[]] for i in range(4)]
    
    midPntsRoof = [rs.CurveMidPoint(crv) for crv in crvRoof]
    midPntsBottom = [rs.CurveMidPoint(crv) for crv in crvBottom]
    
    
    topPnt = rs.CurveEndPoint(crvRoof[0])
    
    
    
    for i in range(3):
        newCrvs[0][0].append(rs.AddLine(midPntsRoof[i], topPnt))
        newCrvs[0][1].append(rs.AddLine(midPntsRoof[i], midPntsRoof[(i+1)%3]))
        
    
    for i in range(3):
        
  
        newCrvs[i+1][0].append(rs.AddLine(rs.CurveStartPoint(crvRoof[i]), midPntsRoof[i]))
        newCrvs[i+1][0].append(rs.AddLine(midPntsBottom[i], midPntsRoof[i]))
        newCrvs[i+1][0].append(rs.AddLine(midPntsBottom[(i+2)%3], midPntsRoof[i]))
    
        newCrvs[i+1][1].append(rs.AddLine(rs.CurveStartPoint(crvRoof[i]), midPntsBottom[i]))
        newCrvs[i+1][1].append(rs.AddLine(midPntsBottom[i], midPntsBottom[(i+2)%3]))
        newCrvs[i+1][1].append(rs.AddLine(midPntsBottom[(i+2)%3], rs.CurveStartPoint(crvRoof[i])))
    
        
        
    return newCrvs
        
        
        
tmp = div(x,y)
a = th.list_to_tree(tmp, source=[0,0])

result = []
for i in range(z):
    
    
    
    if i == 0:
        result = div(x,y)
    
        
    else:
        tmpResult = []

        for j in range(len(result)):
            tmpResult.extend(div(result[j][0], result[j][1]))
            
        result = tmpResult
        
a = th.list_to_tree(result, source = [0,0])
b = result
# ---------- end python_8 ----------
python_9 = GhPythonScript(x=crv_76, y=crv_77, n=number_slider_20)  # -> out, simplify(a), b; inputs x: list, y: list, n: Int32
# ---------- python_9: Python ----------
__author__ = "m0rya"

import rhinoscriptsyntax as rs
import ghpythonlib.treehelpers as th


#Bottom

result = []

btmCrv = y
for i in range(n):
    
    if i == 0:
        result.append([y])
    
a = th.list_to_tree(result, source=[0,0])


'''
def div(crvRoof, crvBottom):
    
    result = []
    newCrvs = [[[],[]] for i in range(4)]
    
    midPntsRoof = [rs.CurveMidPoint(crv) for crv in crvRoof]
    midPntsBottom = [rs.CurveMidPoint(crv) for crv in crvBottom]
    
    
    topPnt = rs.CurveEndPoint(crvRoof[0])
    
    
    
    for i in range(3):
        newCrvs[0][0].append(rs.AddLine(midPntsRoof[i], topPnt))
        newCrvs[0][1].append(rs.AddLine(midPntsRoof[i], midPntsRoof[(i+1)%3]))
        
    
    for i in range(3):
        
  
        newCrvs[i+1][0].append(rs.AddLine(rs.CurveStartPoint(crvRoof[i]), midPntsRoof[i]))
        newCrvs[i+1][0].append(rs.AddLine(midPntsBottom[i], midPntsRoof[i]))
        newCrvs[i+1][0].append(rs.AddLine(midPntsBottom[(i+2)%3], midPntsRoof[i]))
    
        newCrvs[i+1][1].append(rs.AddLine(rs.CurveStartPoint(crvRoof[i]), midPntsBottom[i]))
        newCrvs[i+1][1].append(rs.AddLine(midPntsBottom[i], midPntsBottom[(i+2)%3]))
        newCrvs[i+1][1].append(rs.AddLine(midPntsBottom[(i+2)%3], rs.CurveStartPoint(crvRoof[i])))
    
        
        
    return newCrvs
        
        
        
tmp = div(x,y)
a = th.list_to_tree(tmp, source=[0,0])

result = []
for i in range(z):
    
    
    
    if i == 0:
        result = div(x,y)
    
        
    else:
        tmpResult = []

        for j in range(len(result)):
            tmpResult.extend(div(result[j][0], result[j][1]))
            
        result = tmpResult
        
a = th.list_to_tree(result, source = [0,0])
b = result    

'''
# ---------- end python_9 ----------
viewer = ParamViewer(python_8.a)
python_10 = GhPythonScript(x=python_8.a, n=number_slider_20)  # -> out, a; inputs x: tree, n: Int32
# ---------- python_10: Python ----------
__author__ = "m0rya"

import rhinoscriptsyntax as rs
import ghpythonlib.treehelpers as th

'''
len(x) == 4**n
'''

gasket = []
debug = []
for i in range(int(x.BranchCount/2)):

    gasket.append([x.Branch(2*i), x.Branch(2*i+1)])


Torigos = []

for i in range(4):
    Torigos.append(gasket[i*int(len(gasket)/4):(i+1)*int(len(gasket)/4)])


#a = th.list_to_tree(Torigos[1], source=[0])


#Bottom
for i in range(n):
    
    for j in range(3):
        
        debug.append(Torigos[j+1][1][1][0])
        debug.append(Torigos[j+1][2][1][2])
        debug.append(Torigos[j+1][3][1][0])
        debug.append(Torigos[j+1][1][1][2])
        
a = debug
# ---------- end python_10 ----------
crv_78 = Curve(python_8.a)
